# Dynamo graph 00_Vistas de sector.dyn (Dynamo 4.0.2.3852)
# Una planta y cuatro elevaciones (A/B/C/D) por cada vista 3D con Section Box activo.

n01_procesar_todos_los_sectores = BoolSelector(false)  # "01. Procesar TODOS los sectores"; graph input
n02_filtro_por_nombre_de_la_vista = StringInput("SECTOR")  # "02. Filtro por nombre de la vista 3D (si TODOS = False)"; graph input
n03_recrear_vistas_existentes = BoolSelector(false)  # "03. Recrear vistas existentes (borra y rehace)"; graph input
n05_tipo_de_vista_base_se_duplica = StringInput("")  # "05. Tipo de vista BASE (se duplica para la subcarpeta)"; graph input
n06_view_template_planta_vacio = StringInput("1P_ILU")  # "06. View template - PLANTA (vacio = ninguno)"; graph input
n07_view_template_elevaciones = StringInput("1C_ILU")  # "07. View template - ELEVACIONES (vacio = ninguno)"; graph input
n10_margen_del_crop_mm = IntegerSlider(10, range=0..100 step 1)  # "10. Margen del crop (mm)"; graph input
n08_escala_de_las_vistas_1_n = IntegerSlider(75, range=10..500 step 5)  # "08. Escala de las vistas (1:N)"; graph input
n09_bajar_el_corte_bajo_el_tope = IntegerSlider(0, range=0..500 step 5)  # "09. Bajar el corte bajo el tope de la caja (cm)"; graph input
n04_subcarpeta_del_project = StringInput("")  # "04. Subcarpeta del Project Browser (vacio = usar el tipo base)"; graph input
n11_vinculos_y_cad_importado_en = BoolSelector(true)  # "11. Vinculos y CAD importado en halftone"; graph input
py_planta_4_elevaciones_por = Python(IN[0]=n01_procesar_todos_los_sectores, IN[1]=n02_filtro_por_nombre_de_la_vista, IN[2]=n03_recrear_vistas_existentes, IN[3]=n05_tipo_de_vista_base_se_duplica, IN[4]=n06_view_template_planta_vacio, IN[5]=n07_view_template_elevaciones, IN[6]=n10_margen_del_crop_mm, IN[7]=n08_escala_de_las_vistas_1_n, IN[8]=n09_bajar_el_corte_bajo_el_tope, IN[9]=n04_subcarpeta_del_project, IN[10]=n11_vinculos_y_cad_importado_en)  # "PY | planta + 4 elevaciones por section box"; PythonNet3
# ---------- py_planta_4_elevaciones_por.python (831 lines) ----------
# 00_Vistas de sector - ILUMINACION: una planta + cuatro elevaciones (A/B/C/D) por
# cada vista 3D que tenga el Section Box activo. El sector ES la caja: nada de
# assemblies, grupos ni ejes marcados.
# Revit 2027 / Dynamo 4 / CPython3
# IN[0]  = procesar todos los sectores (bool). OJO: arranca en False a proposito.
#          Tener el Section Box encendido NO convierte a una vista 3D en un sector.
#          Este modelo tiene varias vistas 3D de trabajo con el Section Box activo
#          (DETALLE 1, DET 2 LAM-004, "detalle nuevo fe"), y con True el graph las
#          documenta a todas: el 2026-08-11 dejo 40 vistas y 01 pidio 9 laminas.
# IN[1]  = filtro por nombre de la vista 3D si IN[0] es False (parcial, separado por
#          comas). Es el que decide QUE es un sector; por defecto "SECTOR".
# IN[2]  = recrear vistas existentes (bool) - borra y vuelve a crear
# IN[3]  = nombre del tipo de vista, comun a planta y elevaciones (ej. 02_ILUMINACION);
#          para las elevaciones se resuelve como ViewFamilyType de Section
# IN[4]  = view template de la PLANTA (vacio = ninguno; si no existe, avisa)
# IN[5]  = view template de las ELEVACIONES (vacio = ninguno; si no existe, avisa)
# IN[6]  = margen del crop sobre el borde de la caja, en mm de papel
# IN[7]  = escala de todas las vistas (1:N) - planta y elevaciones comparten escala.
#          En este proyecto es 1:75 y se reaplica tambien a las vistas que ya
#          existian: cambiar la escala aca y volver a correr basta, no hay que
#          recrearlas (ver preparar_vista, que le gana al view template).
# IN[8]  = cuanto BAJAR el plano de corte respecto del tope de la caja (cm; 0 = al ras)
# IN[10] = poner en halftone los vinculos de Revit y los CAD importados (bool)
# IN[9]  = subcarpeta del Project Browser: se crea un TIPO DE VISTA con ese nombre
#          (duplicado del tipo base de IN[3]) y se asigna a todas las vistas, que es
#          lo que hace aparecer el nodo en el browser. Vacio = usar el tipo de IN[3].
#
# QUE DESAPARECIO RESPECTO DEL 00 DE ACERO (T003), Y POR QUE
#
# 1. El Far Clip Offset ya no es un input. En una elevacion de eje habia que elegir a
#    mano hasta donde ver porque el eje es una linea infinita: no tenia profundidad
#    propia. La caja SI la tiene, y es justamente la definicion del sector, asi que el
#    far clip sale de la caja. Un input aca solo podria contradecirla.
#
# 2. Los offsets de corte por tipo de planta (NIPB / P.T. / T.A.) se fueron con los
#    niveles modelados por assembly. Este modelo tiene UN nivel ("nivel 1 luminarias")
#    y toda la geometria vertical se deriva de la caja: corte en el tope, fondo en el
#    piso de la caja. El nivel es solo el origen de coordenadas del View Range.
#
# 3. Todo el aislamiento por miembros (IsolateElementsTemporary + conversion a
#    permanente) se fue entero. Con assemblies hacia falta porque una seccion normal
#    muestra TODO el modelo dentro de su caja y no habia forma de decir "solo estas
#    piezas". Aca la caja no es una aproximacion al sector: es el sector. Lo que la
#    delimita ya es geometrico -crop en X/Y, View Range o far clip en profundidad- y
#    filtrar elemento por elemento seria describir dos veces el mismo recorte, con el
#    riesgo de que las dos descripciones se desincronicen (que es exactamente el bug
#    que se arreglo en 03 el 2026-08-11).

import clr
clr.AddReference('RevitAPI')
clr.AddReference('RevitServices')
from Autodesk.Revit.DB import (FilteredElementCollector, View, View3D, ViewPlan,
                               ViewSection, ViewFamilyType, ViewFamily, Level,
                               UnitUtils, UnitTypeId, XYZ, Element, ElementId,
                               BuiltInParameter, BuiltInCategory, BoundingBoxXYZ,
                               Transform, ViewDetailLevel, PlanViewPlane,
                               RevitLinkInstance, ImportInstance, OverrideGraphicSettings)
from RevitServices.Persistence import DocumentManager
from RevitServices.Transactions import TransactionManager

doc = DocumentManager.Instance.CurrentDBDocument

log = []

process_all = bool(IN[0])
filter_text = (IN[1] or '').strip()
recreate = bool(IN[2])
sec_type_text = (IN[3] or '').strip()
tpl_text_planta = (IN[4] or '').strip()
tpl_text_elevacion = (IN[5] or '').strip()
crop_margin_mm = float(IN[6])
escala = int(IN[7]) if IN[7] else 75
baja_corte = float(IN[8]) / 30.48 if IN[8] else 0.0    # cm -> pies
nombre_carpeta = (IN[9] or '').strip()
halftone_vinculos = bool(IN[10])

# El MISMO nombre de tipo sirve para planta y elevaciones: son ViewFamilyType
# distintos (Floor Plan vs Section) que en este proyecto se llaman igual.
plan_type_text = sec_type_text

# Holgura del plano Top por encima del plano de corte. NO puede ser cero: un View
# Range con Top == Cut es degenerado y colapsa el espesor del CropBox, dejando la
# vista sin dibujar (Revit ni siquiera la puede abrir). Heredado de T003, donde el
# sintoma se diagnostico el 2026-07-28.
HOLGURA_TOP = 10.0 / 30.48   # cm -> pies

# --- contrato de nombres (lo van a usar 01 y 02 para encontrar las vistas) ---
# El nombre del SECTOR es el nombre de la vista 3D tal cual ("SECTOR 01").
SUF_PLANTA = ' - PLANTA'
SUF_ELEV = ' - ELEV '        # + letra
TIT_PLANTA = ' - PLANTA'
TIT_ELEV = ' - ELEVACION {}'

# --- las cuatro elevaciones ---
# (letra, direccion hacia donde MIRA la camara). Los section box de este proyecto
# estan alineados a X e Y, asi que las cuatro direcciones son los ejes globales.
# Orden horario partiendo del observador al Sur:
#   A  observador al Sur   mira al Norte  (+Y)
#   B  observador al Oeste mira al Este   (+X)
#   C  observador al Norte mira al Sur    (-Y)
#   D  observador al Este  mira al Oeste  (-X)
# Cambiar la convencion de letras = reordenar esta tupla, nada mas.
ELEVACIONES = (('A', XYZ(0.0, 1.0, 0.0)),
               ('B', XYZ(1.0, 0.0, 0.0)),
               ('C', XYZ(0.0, -1.0, 0.0)),
               ('D', XYZ(-1.0, 0.0, 0.0)))

# En T003 las plantas salian SIN simbolos de corte: quince elevaciones de eje
# ensuciaban el dibujo del acero. Aca son cuatro y marcan de donde sale cada
# elevacion de la lamina, que es informacion util, asi que por defecto SE VEN.
# Poner en True para volver al comportamiento de acero.
OCULTAR_MARCAS_EN_PLANTA = False


def to_m(v):
    return UnitUtils.ConvertFromInternalUnits(v, UnitTypeId.Meters)


def fmt_cota(m):
    # formato chileno (punto de miles, coma decimal), igual que las vistas que ya
    # existen en el modelo
    s = '{:,.2f}'.format(m)
    return s.replace(',', '@').replace('.', ',').replace('@', '.')


def elem_name(e):
    try:
        return e.Name
    except Exception:
        return Element.Name.__get__(e)


def set_name(e, name):
    try:
        e.Name = name
    except Exception:
        Element.Name.__set__(e, name)


# --- tipo de vista para las elevaciones (debe ser ViewFamily.Section) ---
sec_vft = None
tipos_section = [t for t in FilteredElementCollector(doc).OfClass(ViewFamilyType)
                 if t.ViewFamily == ViewFamily.Section]
if sec_type_text:
    low = sec_type_text.lower()
    for t in tipos_section:
        if elem_name(t).lower() == low:
            sec_vft = t
            break
    if sec_vft is None:
        log.append('AVISO: no existe el tipo de vista de seccion {}; se usa el primero disponible.'.format(sec_type_text))
        log.append('Tipos de Section en este proyecto: ' + ', '.join(sorted(elem_name(t) for t in tipos_section)))
else:
    # Campo vacio: se elige el primero por orden alfabetico, pero se lista el
    # catalogo igual. La primera corrida del graph en un proyecto nuevo es
    # justamente donde nadie sabe todavia como se llaman los tipos; que el log lo
    # diga evita tener que ir a buscarlos al Project Browser.
    log.append('Tipo de vista sin especificar. Tipos de Section en este proyecto: '
               + ', '.join(sorted(elem_name(t) for t in tipos_section)))
if sec_vft is None:
    if tipos_section:
        sec_vft = sorted(tipos_section, key=lambda t: elem_name(t))[0]
        log.append('Elevaciones: se usa el tipo de seccion "{}".'.format(elem_name(sec_vft)))
    else:
        log.append('ERROR: no hay ningun ViewFamilyType de tipo Section en el proyecto; no se pueden crear elevaciones.')

# --- tipo de vista para la planta ---
# En acero se prefería StructuralPlan; aca la planta es de ILUMINACION y manda
# FloorPlan (decision de Javier, 2026-08-11). StructuralPlan queda como fallback
# solo si el proyecto no tuviera ningun tipo de Floor Plan.
plan_vft = None
FAMILIAS_PLAN = (ViewFamily.FloorPlan, ViewFamily.StructuralPlan)
tipos_plan = [t for t in FilteredElementCollector(doc).OfClass(ViewFamilyType)
              if t.ViewFamily in FAMILIAS_PLAN]
if plan_type_text:
    lowp = plan_type_text.lower()
    for t in tipos_plan:
        if elem_name(t).lower() == lowp and t.ViewFamily == ViewFamily.FloorPlan:
            plan_vft = t
            break
    if plan_vft is None:
        for t in tipos_plan:
            if elem_name(t).lower() == lowp:
                plan_vft = t
                break
    if plan_vft is None:
        log.append('AVISO: no existe el tipo de vista de planta {}; se usa el primero disponible.'.format(plan_type_text))
        log.append('Tipos de planta en este proyecto: ' + ', '.join(sorted(elem_name(t) for t in tipos_plan)))
else:
    log.append('Tipos de planta en este proyecto: '
               + ', '.join(sorted(elem_name(t) for t in tipos_plan)))
if plan_vft is None:
    de_piso = [t for t in tipos_plan if t.ViewFamily == ViewFamily.FloorPlan]
    fuente = de_piso if de_piso else tipos_plan
    if fuente:
        plan_vft = sorted(fuente, key=lambda t: elem_name(t))[0]
        log.append('Planta: se usa el tipo "{}".'.format(elem_name(plan_vft)))
    else:
        log.append('ERROR: no hay ningun ViewFamilyType de planta (FloorPlan/StructuralPlan) en el proyecto.')


def tipo_carpeta(base_vft, familias, etiqueta):
    # "Subcarpeta del Project Browser" = un TIPO DE VISTA propio.
    #
    # El Project Browser agrupa las vistas por "Family and Type", asi que la forma
    # de conseguir un nodo propio SIN depender de que alguien configure a mano un
    # esquema de Browser Organization es crear un ViewFamilyType con ese nombre y
    # asignarselo a todas las vistas. Se duplica del tipo base (input 03) para
    # heredar su grafismo.
    #
    # OJO: la ViewFamily (Floor Plans / Sections) es un nivel de agrupacion POR
    # ENCIMA del tipo, asi que esto da DOS nodos con el mismo nombre -uno con las
    # plantas y otro con las elevaciones-, no una carpeta unica con todo.
    #
    # Duplicate() necesita una transaccion abierta: se llama desde el bloque
    # principal, no aca arriba.
    if not nombre_carpeta or base_vft is None:
        return base_vft
    low = nombre_carpeta.lower()
    for t in FilteredElementCollector(doc).OfClass(ViewFamilyType):
        if t.ViewFamily in familias and elem_name(t).lower() == low:
            return t
    try:
        nuevo = base_vft.Duplicate(nombre_carpeta)
        log.append('Carpeta "{}": tipo de vista creado para {} (duplicado de "{}").'.format(
            nombre_carpeta, etiqueta, elem_name(base_vft)))
        return nuevo
    except Exception as e:
        log.append('ERROR creando el tipo de vista "{}" para {}: {}'.format(nombre_carpeta, etiqueta, e))
        return base_vft


# --- niveles: solo anclan el View Range de la planta ---
def elev_nivel(l):
    # SIEMPRE ProjectElevation, NUNCA Elevation.
    # Heredado de T003: ese modelo usa "Elevation Base = Shared" y los niveles
    # reportan la cota real del sitio mientras la geometria vive cerca del origen
    # del proyecto. Anclar el View Range con Elevation mandaba el plano de corte
    # miles de pies fuera del modelo y las plantas salian VACIAS. ProjectElevation
    # va siempre en coordenadas de proyecto, el mismo sistema en el que se mide la
    # geometria (y el mismo en el que viene el Section Box).
    try:
        return l.ProjectElevation
    except Exception:
        return l.Elevation


niveles = sorted(FilteredElementCollector(doc).OfClass(Level), key=elev_nivel)
if not niveles:
    log.append('ERROR: el proyecto no tiene ningun Level; ViewPlan.Create no puede crear plantas.')
else:
    try:
        _l0 = niveles[0]
        if abs(_l0.Elevation - _l0.ProjectElevation) > 0.01:
            log.append('NOTA: el modelo usa cota compartida (nivel {}: Elevation {} m vs ProjectElevation {} m).'.format(
                elem_name(_l0), fmt_cota(to_m(_l0.Elevation)), fmt_cota(to_m(_l0.ProjectElevation))))
            log.append('      El View Range se ancla con ProjectElevation, que es el sistema de la geometria.')
    except Exception:
        pass


def nivel_para(z):
    # El nivel mas alto que no pase de z. Con un solo nivel en el modelo devuelve
    # siempre ese; la busqueda existe para que agregar niveles no rompa nada.
    # NO define la cota de la planta: el corte y el fondo salen de la caja y aca
    # solo se elige el origen desde el que se miden los offsets del View Range.
    debajo = [l for l in niveles if elev_nivel(l) <= z + 1e-6]
    return debajo[-1] if debajo else niveles[0]


# --- view templates ---
templates = [t for t in FilteredElementCollector(doc).OfClass(View) if t.IsTemplate]


def resolver_template(nombre, etiqueta):
    if not nombre:
        log.append('Sin view template para {} (campo vacio).'.format(etiqueta))
        return None
    low = nombre.lower()
    for t in templates:
        if elem_name(t).lower() == low:
            return t
    cands = [t for t in templates if low in elem_name(t).lower()]
    if len(cands) == 1:
        return cands[0]
    log.append('AVISO: no existe un view template de {} que coincida con {}; esas vistas quedan sin template.'.format(etiqueta, nombre))
    return None


view_template_planta = resolver_template(tpl_text_planta, 'la planta')
view_template_elevacion = resolver_template(tpl_text_elevacion, 'las elevaciones')
if templates:
    log.append('Templates cargados en el proyecto: ' + ', '.join(sorted(elem_name(t) for t in templates)))
else:
    log.append('AVISO: no hay ningun view template cargado en este proyecto.')


# --- vinculos y CAD importado: siempre atenuados ---
def elementos_a_atenuar():
    # Los vinculos de Revit y los CAD -importados o vinculados; ImportInstance cubre los dos-.
    # Se juntan UNA VEZ para todo el documento y no vista por vista: el override se guarda
    # igual aunque el elemento no se vea en esa vista, asi que no hace falta regenerar el
    # modelo por cada vista nueva para que el collector los encuentre.
    if not halftone_vinculos:
        return []
    res = []
    for clase, etiqueta in ((RevitLinkInstance, 'vinculos de Revit'),
                            (ImportInstance, 'CAD importado o vinculado')):
        try:
            res.extend(FilteredElementCollector(doc).OfClass(clase)
                       .WhereElementIsNotElementType())
        except Exception as e:
            log.append('AVISO: no se pudieron listar los {} ({}).'.format(etiqueta, e))
    return res


def atenuar_vinculos(v, sname, label):
    # Halftone POR ELEMENTO, no por categoria ni por la pestana "Revit Links" de la V/G.
    #
    # Por elemento porque es lo unico que sirve para las dos cosas a la vez y no pelea con el
    # view template: un DWG importado no tiene UNA categoria sino las suyas propias -cada
    # importacion crea su juego, y habria que enumerarlas- y la pestana de vinculos es
    # justamente de las que un view template controla, asi que 1P_ILU o 1C_ILU le ganarian.
    # El override por elemento no lo maneja el template: se aplica DESPUES y queda.
    #
    # El precio es que es una foto: un vinculo que se agregue despues de correr este paso no
    # sale atenuado hasta que se vuelva a correr.
    if not ATENUAR:
        return
    ogs = OverrideGraphicSettings()
    ogs.SetHalftone(True)
    puestos = 0
    for el in ATENUAR:
        try:
            v.SetElementOverrides(el.Id, ogs)
            puestos += 1
        except Exception:
            pass
    if puestos < len(ATENUAR):
        log.append('AVISO {}: en {} solo {} de {} vinculo(s)/importacion(es) aceptaron el '
                   'halftone.'.format(sname, label, puestos, len(ATENUAR)))

ATENUAR = elementos_a_atenuar()
if ATENUAR:
    log.append('{} vinculo(s) de Revit y CAD importado van a quedar en halftone en cada '
               'vista creada.'.format(len(ATENUAR)))


# ------------------------------------------------------------ sectores = vistas 3D
TOL_ROT = 1e-6


def caja_del_sector(v3d, sname):
    # Devuelve (min, max) en coordenadas de MUNDO, o None.
    #
    # GetSectionBox() entrega Min/Max en el sistema LOCAL de su propio Transform,
    # no en coordenadas de mundo: leerlos directo funciona solo mientras el
    # Transform sea la identidad. Se transforman las 8 esquinas siempre, aunque en
    # este proyecto las cajas esten alineadas, porque el dia que alguien rote una
    # el error seria silencioso -la vista saldria con el crop corrido, no con un
    # mensaje- y ese es el peor tipo de falla.
    try:
        bb = v3d.GetSectionBox()
    except Exception as e:
        log.append('ERROR {}: no se pudo leer el Section Box: {}'.format(sname, e))
        return None
    if bb is None:
        return None
    t = bb.Transform
    rotada = (abs(t.BasisX.X - 1.0) > TOL_ROT or abs(t.BasisY.Y - 1.0) > TOL_ROT
              or abs(t.BasisZ.Z - 1.0) > TOL_ROT)
    if rotada:
        log.append('AVISO {}: el Section Box esta ROTADO respecto de X/Y.'.format(sname))
        log.append('       Las vistas se generan contra su envolvente alineada a los ejes, o sea')
        log.append('       abarcando MAS que la caja. Para que el recorte sea exacto habria que')
        log.append('       orientar las elevaciones a la caja y darle al crop de la planta una')
        log.append('       forma rotada (SetCropShape). Hoy el graph no lo hace.')
    xs, ys, zs = [], [], []
    for x in (bb.Min.X, bb.Max.X):
        for y in (bb.Min.Y, bb.Max.Y):
            for z in (bb.Min.Z, bb.Max.Z):
                p = t.OfPoint(XYZ(x, y, z))
                xs.append(p.X)
                ys.append(p.Y)
                zs.append(p.Z)
    return (XYZ(min(xs), min(ys), min(zs)), XYZ(max(xs), max(ys), max(zs)))


sectores = []
for v3d in FilteredElementCollector(doc).OfClass(View3D):
    if v3d.IsTemplate:
        continue
    try:
        if not v3d.IsSectionBoxActive:
            continue
    except Exception:
        continue
    sectores.append(v3d)
sectores.sort(key=elem_name)

if not sectores:
    log.append('AVISO: no hay ninguna vista 3D con el Section Box ACTIVO.')
    log.append('       El sector se define ahi: crear una vista 3D por sector, activarle el')
    log.append('       Section Box y ajustarlo al sector. El nombre de esa vista es el nombre')
    log.append('       del sector y lo heredan todas las vistas que crea este graph.')

targets = sectores
if not process_all:
    tokens = [t.strip().lower() for t in filter_text.split(',') if t.strip()]
    if tokens:
        targets = [v for v in sectores if any(tok in elem_name(v).lower() for tok in tokens)]
        if not targets:
            log.append('AVISO: ningun sector coincide con "{}".'.format(filter_text))
            log.append('Sectores disponibles: ' + ', '.join(elem_name(v) for v in sectores))
    else:
        targets = []
        log.append('ERROR: "Todos" esta en False y el filtro esta vacio.')


# ---------------------------------------------------------------- indice de vistas
view_ids = {}
for v in FilteredElementCollector(doc).OfClass(View):
    if not v.IsTemplate:
        view_ids[elem_name(v)] = v.Id


# ---------------------------------------------------------------- ajustes de vista

def fijar_far_clip(v, profundidad, sname, label):
    # La profundidad de una elevacion la manda la CAJA, no un input.
    #
    # ViewSection.CreateSection ya nace con el far clip a la medida del
    # BoundingBoxXYZ que se le paso, pero hay que reafirmarlo DESPUES del template:
    # si el template trae su propio Far Clip Offset, pisa el de la caja y la
    # elevacion empieza a mostrar (o a comerse) sectores vecinos.
    # 0 = No clip, 1 = Clip without line, 2 = Clip with line.
    try:
        pa = v.get_Parameter(BuiltInParameter.VIEWER_BOUND_ACTIVE_FAR)
        if pa is not None and not pa.IsReadOnly and pa.AsInteger() == 0:
            pa.Set(1)
    except Exception:
        pass
    try:
        p = v.get_Parameter(BuiltInParameter.VIEWER_BOUND_OFFSET_FAR)
        if p is not None and not p.IsReadOnly:
            p.Set(profundidad)
    except Exception as e:
        log.append('AVISO {}: no se pudo fijar el Far Clip de {}: {}'.format(sname, label, e))


def fijar_view_range(vplan, z_corte, z_fondo, level, sname, label):
    # En una ViewPlan la profundidad no la controla el Far Clip Offset sino el
    # View Range. Todos los planos se anclan al MISMO nivel y se expresan como
    # offset respecto de su elevacion, asi que el nivel elegido es indiferente:
    # es solo el origen de coordenadas del rango.
    #   Top    = Cut + HOLGURA_TOP
    #   Cut    = tope de la caja (menos lo que pida el input 08)
    #   Bottom = View Depth = piso de la caja
    #
    # ORDEN ESTRICTO: Revit exige Top >= Cut >= Bottom >= ViewDepth. Con Top == Cut
    # el rango de altura colapsa a cero, el CropBox hereda espesor nulo y la planta
    # no dibuja NADA -Revit ni siquiera la puede abrir- aunque un
    # FilteredElementCollector(doc, view.Id) siga contando elementos visibles.
    e = elev_nivel(level)
    corte = z_corte - e
    fondo = z_fondo - e
    if fondo > corte - HOLGURA_TOP:
        # caja demasiado chata (o corte bajado de mas): se fuerza un rango sano
        log.append('AVISO {}: la caja de {} es mas baja que la holgura minima; se abre el rango.'.format(sname, label))
        fondo = corte - HOLGURA_TOP
    top = corte + HOLGURA_TOP
    try:
        vr = vplan.GetViewRange()
        for plano, off in ((PlanViewPlane.TopClipPlane, top),
                           (PlanViewPlane.CutPlane, corte),
                           (PlanViewPlane.BottomClipPlane, fondo),
                           (PlanViewPlane.ViewDepthPlane, fondo)):
            vr.SetLevelId(plano, level.Id)
            vr.SetOffset(plano, off)
        vplan.SetViewRange(vr)
        log.append('{}: {} cortada en EL. {}, fondo en EL. {} ({:.2f} m de profundidad).'.format(
            sname, label, fmt_cota(to_m(z_corte)), fmt_cota(to_m(z_fondo)),
            to_m(z_corte - z_fondo)))
    except Exception as ex:
        log.append('ERROR {}: no se pudo fijar el View Range de {}: {}'.format(sname, label, ex))


def ajustar_crop_a_caja(v, pmin, pmax, sname, label):
    # Recorta el crop de la PLANTA a la huella de la caja + margen de papel.
    # Se trabaja en los ejes propios de la vista (via el Transform del CropBox
    # actual) en vez de asumir que coinciden con X/Y del proyecto.
    bb = v.CropBox
    inv = bb.Transform.Inverse
    minx = miny = float('inf')
    maxx = maxy = float('-inf')
    for x in (pmin.X, pmax.X):
        for y in (pmin.Y, pmax.Y):
            for z in (pmin.Z, pmax.Z):
                p = inv.OfPoint(XYZ(x, y, z))
                if p.X < minx: minx = p.X
                if p.X > maxx: maxx = p.X
                if p.Y < miny: miny = p.Y
                if p.Y > maxy: maxy = p.Y
    margen = crop_margin_mm / 304.8 * (v.Scale if v.Scale > 0 else 1)
    # El espesor en Z se hereda del crop actual, pero NUNCA puede quedar en cero:
    # un BoundingBoxXYZ degenerado deja la vista sin dibujar. En una planta el Z
    # del crop lo deriva Revit del View Range, asi que si el rango venia colapsado
    # esto es la ultima linea de defensa.
    zmin_c = bb.Min.Z
    zmax_c = bb.Max.Z
    if zmax_c - zmin_c < 1e-6:
        zmin_c = zmin_c - 1.0
        zmax_c = zmax_c + 1.0
        log.append('AVISO {}: el crop de {} venia con espesor cero; se le dio 2 m.'.format(sname, label))
    nuevo = BoundingBoxXYZ()
    nuevo.Transform = bb.Transform
    nuevo.Min = XYZ(minx - margen, miny - margen, zmin_c)
    nuevo.Max = XYZ(maxx + margen, maxy + margen, zmax_c)
    v.CropBox = nuevo
    desactivar_annotation_crop(v)
    log.append('   crop de {}: {:.2f} x {:.2f} m.'.format(
        label, to_m(maxx - minx + 2 * margen), to_m(maxy - miny + 2 * margen)))


def desactivar_annotation_crop(v):
    # El Annotation Crop se deja INACTIVO a proposito: asi cotas, tags y leaders,
    # que viven por fuera del borde del sector, no quedan cortados. El precio es
    # que Revit lo auto-expande hasta abarcar toda la anotacion -por eso el
    # recuadro punteado queda lejos del dibujo-, pero el marco que regula el
    # tamaño en lamina es el CropBox, no este.
    try:
        v.GetCropRegionShapeManager().IsAnnotationCropActive = False
    except Exception:
        pass


_aviso_secc = [False]


def ocultar_simbolos_corte(v, sname=None, label=None):
    # Apaga la categoria Sections: el SIMBOLO de corte (linea, cabeza, cola y
    # burbuja). No borra ni afecta a las elevaciones en si, solo su marca.
    # En las ELEVACIONES evita que las otras tres del mismo sector las crucen.
    try:
        cat = ElementId(BuiltInCategory.OST_Sections)
        if v.CanCategoryBeHidden(cat):
            v.SetCategoryHidden(cat, True)
        elif sname is not None and not _aviso_secc[0]:
            _aviso_secc[0] = True
            log.append('AVISO {}: la categoria Sections no se puede ocultar en {};'.format(sname, label))
            log.append('       la controla el view template, hay que apagarla ahi.')
    except Exception as e:
        if sname is not None and not _aviso_secc[0]:
            _aviso_secc[0] = True
            log.append('AVISO {}: no se pudo ocultar el simbolo de seccion en {}: {}'.format(sname, label, e))


def preparar_vista(v, sname, label, profundidad=None):
    # ajustes comunes a toda vista creada por este graph.
    # El tipo de vista es lo que define la carpeta del Project Browser, y se
    # reaplica tambien a las vistas que YA existian: asi cambiar el nombre de la
    # carpeta no obliga a recrearlas. Va primero, porque cambiar el tipo puede
    # arrastrar propiedades que los ajustes de mas abajo vuelven a fijar.
    try:
        objetivo = plan_vft if isinstance(v, ViewPlan) else sec_vft
        if objetivo is not None and v.GetTypeId() != objetivo.Id:
            v.ChangeTypeId(objetivo.Id)
    except Exception as e:
        log.append('AVISO {}: no se pudo cambiar el tipo de vista de {}: {}'.format(sname, label, e))
    try:
        v.Scale = escala
    except Exception:
        pass
    try:
        v.DetailLevel = ViewDetailLevel.Fine
    except Exception:
        pass
    try:
        # "Crop View" activo, pero SIN dibujar el rectangulo: sin el recorte la
        # vista ocupa su extension completa y 01/02 calculan bloques mucho mas
        # grandes de lo real.
        if not v.CropBoxActive:
            v.CropBoxActive = True
        if v.CropBoxVisible:
            v.CropBoxVisible = False
    except Exception as e:
        log.append('ERROR {} activando Crop View en {}: {}'.format(sname, label, e))
    objetivo_tpl = view_template_planta if isinstance(v, ViewPlan) else view_template_elevacion
    if objetivo_tpl is not None:
        try:
            if v.ViewTemplateId != objetivo_tpl.Id:
                v.ViewTemplateId = objetivo_tpl.Id
            # la escala la manda el input, no el template
            if v.Scale != escala:
                v.Scale = escala
        except Exception as e:
            log.append('ERROR {} aplicando template a {}: {}'.format(sname, label, e))
    # El halftone va DESPUES del template a proposito: ver atenuar_vinculos.
    atenuar_vinculos(v, sname, label)
    # Far Clip despues del template: si el template trae su propio valor, gana la caja.
    if profundidad is not None:
        fijar_far_clip(v, profundidad, sname, label)
    if isinstance(v, ViewPlan):
        if OCULTAR_MARCAS_EN_PLANTA:
            ocultar_simbolos_corte(v, sname, label)
    else:
        ocultar_simbolos_corte(v)


def set_titulo(v, texto):
    # titulo mostrado en lamina (Title on Sheet), sin tocar el nombre interno
    p = v.get_Parameter(BuiltInParameter.VIEW_DESCRIPTION)
    if p is None or p.IsReadOnly:
        return
    if p.AsString() != texto:
        p.Set(texto)


# ---------------------------------------------------------------- creacion

def borrar_si_toca(vname, sname, label):
    # devuelve (vista existente o None, hay_que_conservarla)
    if vname not in view_ids:
        return None, False
    if recreate:
        try:
            doc.Delete(view_ids[vname])
        except Exception:
            # Revit NO deja borrar la vista activa ni una abierta en pestaña.
            # Heredado de T003: con la vista abierta en pantalla, doc.Delete tiraba
            # "ElementId cannot be deleted", la excepcion subia y el sector entero
            # se quedaba sin ninguna vista. Ahora se reutiliza y la corrida sigue.
            log.append('AVISO {}: no se pudo borrar {}; probablemente esta abierta en Revit.'.format(sname, label))
            log.append('       Cerrar esa vista y volver a correr si se quiere rehacerla desde cero.')
            log.append('       Por ahora se reutiliza la existente y se le reaplican los ajustes.')
            return doc.GetElement(view_ids[vname]), True
        del view_ids[vname]
        log.append('{}: {} anterior eliminada (tambien su viewport si estaba en un sheet).'.format(sname, label))
        return None, False
    return doc.GetElement(view_ids[vname]), True


def limpiar_sobrantes(sname):
    # Con "recrear" activo se borran TODAS las elevaciones previas del sector, no
    # solo las cuatro que esta corrida va a rehacer: si alguna vez se cambia la
    # convencion de letras, las viejas quedarian huerfanas con un nombre que ya no
    # aplica y 02 las seguiria colocando en lamina.
    pref = sname + SUF_ELEV
    for vname in list(view_ids.keys()):
        if vname.startswith(pref):
            try:
                doc.Delete(view_ids[vname])
                del view_ids[vname]
            except Exception:
                pass


def crear_planta(sname, pmin, pmax):
    global plantas_creadas, saltadas
    label = 'planta'
    if plan_vft is None or not niveles:
        log.append('ERROR {}: no se puede crear la planta (falta tipo de vista o nivel).'.format(sname))
        return None
    vname = sname + SUF_PLANTA
    z_corte = pmax.Z - baja_corte
    level = nivel_para(z_corte)
    v, saltar = borrar_si_toca(vname, sname, label)
    if saltar:
        saltadas += 1
    else:
        v = ViewPlan.Create(doc, plan_vft.Id, level.Id)
        set_name(v, vname)
        view_ids[vname] = v.Id
        plantas_creadas += 1
        log.append('OK {}: planta creada sobre el nivel {}, escala 1:{}.'.format(
            sname, elem_name(level), escala))
    if v is None:
        return None
    # Una planta ya existente NO se salta entera: se le vuelven a aplicar escala,
    # template, view range, crop y titulo. Con "continue" las vistas de corridas
    # viejas quedarian congeladas con los defaults de entonces.
    preparar_vista(v, sname, label)
    fijar_view_range(v, z_corte, pmin.Z, level, sname, label)
    ajustar_crop_a_caja(v, pmin, pmax, sname, label)
    set_titulo(v, sname + TIT_PLANTA)
    return v


def crear_elevacion(sname, letra, mirada, pmin, pmax):
    # Seccion real del modelo, orientada a una cara de la caja.
    #
    # El BoundingBoxXYZ que recibe CreateSection define las TRES dimensiones de la
    # vista: ancho y alto del crop en X/Y locales, y profundidad en Z local. Por eso
    # la elevacion queda recortada al sector sin filtrar un solo elemento: la caja
    # que delimita el sector y la caja que delimita la vista son la misma.
    label = 'elevacion ' + letra
    if sec_vft is None:
        # se comprueba ANTES de borrar_si_toca: si no hay tipo de seccion no se va a
        # poder recrear nada, y borrar la elevacion vieja dejaria al sector peor que
        # como estaba.
        return None, False, 0.0
    vname = sname + SUF_ELEV + letra
    existente, saltar = borrar_si_toca(vname, sname, label)

    # sistema local de la vista: BasisZ apunta HACIA el observador (contrario a la
    # mirada), BasisY es la vertical y BasisX se deriva para que quede derecho
    # (BasisX x BasisY = BasisZ).
    bz = mirada.Negate().Normalize()
    by = XYZ.BasisZ
    bx = by.CrossProduct(bz).Normalize()
    centro = XYZ((pmin.X + pmax.X) / 2.0, (pmin.Y + pmax.Y) / 2.0, (pmin.Z + pmax.Z) / 2.0)

    lxmin = lymin = lzmin = float('inf')
    lxmax = lymax = lzmax = float('-inf')
    for x in (pmin.X, pmax.X):
        for y in (pmin.Y, pmax.Y):
            for z in (pmin.Z, pmax.Z):
                rel = XYZ(x, y, z) - centro
                lx = rel.DotProduct(bx)
                ly = rel.DotProduct(by)
                lz = rel.DotProduct(bz)
                if lx < lxmin: lxmin = lx
                if lx > lxmax: lxmax = lx
                if ly < lymin: lymin = ly
                if ly > lymax: lymax = ly
                if lz < lzmin: lzmin = lz
                if lz > lzmax: lzmax = lz

    profundidad = lzmax - lzmin
    # El margen se aplica SOLO en X/Y (las dos direcciones de papel). En Z seria
    # profundidad de mas, o sea sector vecino colandose en la elevacion.
    m = crop_margin_mm / 304.8 * escala
    t = Transform.Identity
    t.BasisX = bx
    t.BasisY = by
    t.BasisZ = bz
    t.Origin = centro
    caja = BoundingBoxXYZ()
    caja.Transform = t
    caja.Min = XYZ(lxmin - m, lymin - m, lzmin)
    caja.Max = XYZ(lxmax + m, lymax + m, lzmax)

    if saltar:
        return existente, True, profundidad
    v = ViewSection.CreateSection(doc, sec_vft.Id, caja)
    set_name(v, vname)
    view_ids[vname] = v.Id
    return v, False, profundidad


# ---------------------------------------------------------------- main

plantas_creadas = 0
elevs_creadas = 0
saltadas = 0
resumen = []

TransactionManager.Instance.EnsureInTransaction(doc)
try:
    # La subcarpeta del Project Browser se materializa como un tipo de vista propio
    # (ver tipo_carpeta). Tiene que resolverse DENTRO de la transaccion porque
    # duplica un ViewFamilyType, y antes del bucle para que todas las vistas de esta
    # corrida nazcan ya con el tipo correcto.
    if nombre_carpeta:
        plan_vft = tipo_carpeta(plan_vft, FAMILIAS_PLAN, 'las plantas')
        sec_vft = tipo_carpeta(sec_vft, (ViewFamily.Section,), 'las elevaciones')
        # Regenerate obligatorio: sin esto, las vistas creadas en ESTA MISMA corrida
        # nacian con el tipo BASE en vez del nuevo -Revit no deja el tipo recien
        # duplicado listo para usarse en otras creaciones de la misma transaccion
        # hasta que se regenera- y habia que correr el graph dos veces.
        doc.Regenerate()

    for v3d in targets:
        sname = elem_name(v3d)
        try:
            caja = caja_del_sector(v3d, sname)
            if caja is None:
                log.append('ERROR {}: la vista 3D no devolvio Section Box; se omite.'.format(sname))
                continue
            pmin, pmax = caja
            if (pmax.X - pmin.X) < 1e-6 or (pmax.Y - pmin.Y) < 1e-6 or (pmax.Z - pmin.Z) < 1e-6:
                log.append('ERROR {}: el Section Box es degenerado (alguna dimension en cero); se omite.'.format(sname))
                continue
            log.append('{}: caja de {:.2f} x {:.2f} x {:.2f} m, entre EL. {} y EL. {}.'.format(
                sname, to_m(pmax.X - pmin.X), to_m(pmax.Y - pmin.Y), to_m(pmax.Z - pmin.Z),
                fmt_cota(to_m(pmin.Z)), fmt_cota(to_m(pmax.Z))))

            if recreate:
                limpiar_sobrantes(sname)

            # ---------- 1. la planta ----------
            v_pl = crear_planta(sname, pmin, pmax)

            # ---------- 2. las cuatro elevaciones ----------
            n_elev = 0
            for letra, mirada in ELEVACIONES:
                label = 'elevacion ' + letra
                try:
                    velev, saltar, profundidad = crear_elevacion(sname, letra, mirada, pmin, pmax)
                    if velev is None:
                        continue
                    # Una elevacion ya existente NO se salta entera: se le vuelven a
                    # aplicar escala, template, far clip y titulo, por lo mismo que
                    # la planta.
                    if saltar:
                        saltadas += 1
                    else:
                        elevs_creadas += 1
                    n_elev += 1
                    preparar_vista(velev, sname, label, profundidad)
                    desactivar_annotation_crop(velev)
                    set_titulo(velev, sname + TIT_ELEV.format(letra))
                    log.append('{} {}: {}.'.format(
                        'OK' if not saltar else '  ', sname,
                        label + (' creada' if not saltar else ' ya existia, ajustes reaplicados')))
                except Exception as e:
                    log.append('ERROR {} creando {}: {}'.format(sname, label, e))

            resumen.append('{}: {} planta + {} elevacion(es) = {} vista(s).'.format(
                sname, 1 if v_pl is not None else 0, n_elev,
                (1 if v_pl is not None else 0) + n_elev))
        except Exception as e:
            log.append('ERROR {}: {}'.format(sname, e))
finally:
    TransactionManager.Instance.TransactionTaskDone()

log.insert(0, 'Sectores procesados: {} | plantas creadas: {} | elevaciones creadas: {} | saltadas: {}'.format(
    len(targets), plantas_creadas, elevs_creadas, saltadas))
for i, linea in enumerate(resumen):
    log.insert(1 + i, '  ' + linea)
OUT = log
# ----------------------------------------
log = Watch(py_planta_4_elevaciones_por)  # graph output
