# Dynamo graph 01_Calcular y crear laminas.dyn (Dynamo 4.0.2.3852)
# Cuenta las vistas de sector pendientes y crea las laminas necesarias.

n01_vineta_title_block_elegir_del = FamilyTypes()  # "01. Vineta (Title Block) - elegir del dropdown"; nothing selected; graph input
n02_numero_del_primer_sheet = StringInput("A1")  # "02. Numero del primer sheet"; graph input
n03_nombre_del_primer_sheet = StringInput("A1")  # "03. Nombre del primer sheet"; graph input
n04_procesar_todos_los_sectores = BoolSelector(true)  # "04. Procesar TODOS los sectores"; graph input
n05_filtro_de_sectores_si_todos = StringInput("")  # "05. Filtro de sectores (si TODOS = False)"; graph input
n06_margen_y_separacion_mm = IntegerSlider(5, range=0..50 step 1)  # "06. Margen y separacion (mm)"; graph input
py_cuenta_vistas_pendientes_y = Python(IN[0]=n01_vineta_title_block_elegir_del, IN[1]=n02_numero_del_primer_sheet, IN[2]=n03_nombre_del_primer_sheet, IN[3]=n04_procesar_todos_los_sectores, IN[4]=n05_filtro_de_sectores_si_todos, IN[5]=n06_margen_y_separacion_mm)  # "PY | cuenta vistas pendientes y crea las laminas"; PythonNet3
# ---------- py_cuenta_vistas_pendientes_y.python (318 lines) ----------
# 01_Calcular y crear laminas - ILUMINACION
# Calcula cuantas laminas hacen falta para las vistas de sector pendientes,
# simulando EXACTAMENTE el mismo empaquetado que 02_Colocar vistas en laminas, y
# crea esa cantidad con la numeracion incremental de siempre.
#
# Regla de aislamiento (estandar del proyecto): cada lamina contiene vistas de UN
# SOLO sector. Las vistas de un sector fluyen por tantas laminas como haga falta,
# pero el sector siguiente SIEMPRE empieza en una lamina nueva.
#
# Revit 2027 / Dynamo 4 / CPython3
# IN[0] = tipo de vineta (dropdown Family Types)
# IN[1] = numero del primer sheet
# IN[2] = nombre del primer sheet
# IN[3] = procesar todos los sectores (bool)
# IN[4] = filtro de sectores si IN[3] es False (parcial, comas)
# IN[5] = margen y separacion entre vistas (mm) - debe coincidir con el mismo
#         input de 02_Colocar vistas en laminas para que el calculo sea exacto
#
# QUE DESAPARECIO RESPECTO DEL 01 DE ACERO (T003), Y POR QUE
#
# La reserva del lado derecho. En acero, 06_Tabla de assemblies estampaba una tabla
# de cantidades en la PRIMERA lamina de cada assembly, asi que esa lamina -y solo
# esa- perdia 150 mm de ancho. Eso obligaba a manejar DOS rectangulos utiles
# (rect_1 y rect_n) y a que empaquetar() supiera cual usar segun la lamina.
#
# Aca no hay tabla: las vistas usan el lienzo COMPLETO de la vineta en todas las
# laminas. Con un solo rectangulo, empaquetar() pierde el parametro rect_n y la
# rama que cambiaba de rectangulo al saltar de lamina.
#
# OJO: empaquetar() TIENE que ser identica a la de 02_Colocar vistas en laminas. Si
# las dos versiones se separan, 01 calcula una cantidad de laminas que no coincide
# con lo que 02 termina colocando, y el error aparece recien al final, con laminas
# de mas o vistas sin colocar.

import clr
import re
clr.AddReference('RevitAPI')
clr.AddReference('RevitServices')
from Autodesk.Revit.DB import (FilteredElementCollector, ViewSheet,
                               Viewport, View, BuiltInCategory, Element, ElementId)
from RevitServices.Persistence import DocumentManager
from RevitServices.Transactions import TransactionManager

doc = DocumentManager.Instance.CurrentDBDocument

tb_type = UnwrapElement(IN[0])
first_number = (IN[1] or '').strip()
first_name = (IN[2] or '').strip()
process_all = bool(IN[3])
filter_text = (IN[4] or '').strip()
margin = float(IN[5]) / 304.8

log = []

# --- contrato de nombres con 00_Vistas de sector ---
SUF_PLANTA = ' - PLANTA'
SUF_ELEV = ' - ELEV '

# Orden de las elevaciones en la lamina. Es el MISMO orden que fija la tupla
# ELEVACIONES de 00 (A Norte, B Este, C Sur, D Oeste): cambiarlo alla y no aca
# dejaria las elevaciones colocadas en un orden que no corresponde con el de sus
# marcas de corte en la planta.
LETRAS = ('A', 'B', 'C', 'D')

# alto reservado bajo cada vista para su titulo (mm de papel)
label_h_planta = 12.0 / 304.8
label_h_elev = (12.0 + 14.0) / 304.8


def elem_name(e):
    try:
        return e.Name
    except Exception:
        return Element.Name.__get__(e)


def es_elevacion(nombre):
    return SUF_ELEV in nombre


def tb_label(t):
    try:
        return '{} : {}'.format(t.FamilyName, elem_name(t))
    except Exception:
        return 'Id ' + str(t.Id)


def list_titleblocks():
    col = (FilteredElementCollector(doc)
           .OfCategory(BuiltInCategory.OST_TitleBlocks)
           .WhereElementIsElementType())
    return list(col)


def paper_size(v):
    # tamaño en papel (pies) = crop del modelo / escala
    cb = v.CropBox
    s = v.Scale if v.Scale > 0 else 1
    return ((cb.Max.X - cb.Min.X) / s, (cb.Max.Y - cb.Min.Y) / s)


def tamano_con_titulo(v):
    w, h = paper_size(v)
    return (w, h + (label_h_elev if es_elevacion(elem_name(v)) else label_h_planta))


def usable_rect(sheet):
    # area util = bbox de la vineta menos margenes, sin reservar nada: las vistas
    # ocupan el lienzo completo.
    col = FilteredElementCollector(doc, sheet.Id).OfCategory(BuiltInCategory.OST_TitleBlocks)
    tb = col.FirstElement()
    if tb is not None:
        bb = tb.get_BoundingBox(sheet)
        if bb is not None:
            return (bb.Min.X + margin, bb.Min.Y + margin,
                    bb.Max.X - margin, bb.Max.Y - margin)
    o = sheet.Outline
    return (o.Min.U + margin, o.Min.V + margin,
            o.Max.U - margin, o.Max.V - margin)


def empaquetar(tamanos, rect, margin):
    # Flujo izquierda->derecha, arriba->abajo. Cuando una vista no cabe a lo ancho
    # salta de fila; cuando no cabe a lo alto salta a la lamina siguiente DEL MISMO
    # sector.
    # Devuelve (posiciones, n_laminas, avisos) con posiciones = [(idx, x_izq, y_sup)].
    pos = []
    avisos = []
    idx = 0
    x0, y0, x1, y1 = rect
    cx, cy, row_h = x0, y1, 0.0
    for w, h in tamanos:
        if cx > x0 and cx + w > x1:
            cx = x0
            cy -= row_h + margin
            row_h = 0.0
        fresco = (abs(cx - x0) < 1e-9 and abs(cy - y1) < 1e-9)
        if cy - h < y0 and not fresco:
            idx += 1
            cx, cy, row_h = x0, y1, 0.0
            fresco = True
        if fresco and (w > (x1 - x0) or h > (y1 - y0)):
            avisos.append((w, h))
        pos.append((idx, cx, cy))
        cx += w + margin
        if h > row_h:
            row_h = h
    return pos, idx + 1, avisos


def bump(text, steps):
    # incrementa el ULTIMO bloque numerico conservando el ancho (ceros a la izquierda)
    last = None
    for m in re.finditer('\\d+', text):
        last = m
    if last is None:
        return '{} {:02d}'.format(text, steps + 1)
    width = len(last.group(0))
    val = int(last.group(0)) + steps
    return text[:last.start()] + str(val).zfill(width) + text[last.end():]


# --- validar la vineta seleccionada ---
tb_cat_id = ElementId(BuiltInCategory.OST_TitleBlocks)
is_tb = (tb_type is not None
         and tb_type.Category is not None
         and tb_type.Category.Id == tb_cat_id)

if not is_tb:
    log.append('ERROR: el tipo seleccionado en el dropdown NO es una vineta (Title Block).')
    log.append('Selecciona una de estas vinetas cargadas en el proyecto:')
    tbs = list_titleblocks()
    if not tbs:
        log.append('  (no hay vinetas cargadas en el proyecto)')
    for t in tbs:
        log.append('  - ' + tb_label(t))
    OUT = log
else:
    view_by_name = {}
    for v in FilteredElementCollector(doc).OfClass(View):
        if not v.IsTemplate:
            view_by_name[elem_name(v)] = v

    # --- sectores = los que 00 EFECTIVAMENTE documento ---
    #
    # La lista sale de las VISTAS que existen, no de recorrer las vistas 3D con
    # Section Box. La diferencia importa: 00 es quien decide que es un sector, y
    # puede haber corrido con un filtro. Si 01 volviera a mirar las vistas 3D por su
    # cuenta, las dos respuestas se pueden separar.
    #
    # Y se separan de la peor manera. El 2026-08-11 este graph conto 9 laminas en vez
    # de 1: habia SIETE vistas 3D de trabajo (DETALLE 1, DET 2 LAM-004, "detalle
    # nuevo fe"...) con el Section Box encendido, y tener el Section Box encendido no
    # significa ser un sector. La cuenta era correcta para lo que se le dio de comer;
    # el problema era de donde salia la lista.
    #
    # Leyendo las vistas ya creadas, 01 no puede inventar un sector que 00 no
    # documento: si no hay "<algo> - PLANTA", ese sector no existe para este graph.
    nombres = []
    for n in view_by_name:
        if n.endswith(SUF_PLANTA):
            nombres.append(n[:-len(SUF_PLANTA)])
    nombres.sort()

    if not nombres:
        log.append('AVISO: no hay ninguna vista "<sector> - PLANTA" en el modelo; corre antes 00_Vistas de sector.')
    if not process_all:
        tokens = [t.strip().lower() for t in filter_text.split(',') if t.strip()]
        if tokens:
            nombres = [n for n in nombres if any(tok in n.lower() for tok in tokens)]
        else:
            nombres = []
            log.append('ERROR: "Todos" esta en False y el filtro esta vacio.')
    log.append('Sectores documentados por 00: ' + (', '.join(nombres) if nombres else '(ninguno)'))

    placed_ids = set()
    for vp in FilteredElementCollector(doc).OfClass(Viewport):
        placed_ids.add(vp.ViewId.Value)

    def vistas_pendientes(sname):
        # orden de lamina: la planta primero, despues las cuatro elevaciones A->D
        res = []
        v = view_by_name.get(sname + SUF_PLANTA)
        if v is None:
            log.append('AVISO: no existe la vista "{}" (corre 00_Vistas de sector).'.format(sname + SUF_PLANTA))
        elif v.Id.Value not in placed_ids:
            res.append(v)
        for letra in LETRAS:
            n = sname + SUF_ELEV + letra
            v = view_by_name.get(n)
            if v is None:
                log.append('AVISO: no existe la vista "{}" (corre 00_Vistas de sector).'.format(n))
            elif v.Id.Value not in placed_ids:
                res.append(v)
        return res

    pendientes = {}
    for n in nombres:
        vs = vistas_pendientes(n)
        if vs:
            pendientes[n] = vs

    if not pendientes:
        log.append('No hay vistas pendientes de colocar; no se creo ninguna lamina.')
        OUT = log
    else:
        created = 0
        sheets_needed = 0
        TransactionManager.Instance.EnsureInTransaction(doc)
        try:
            if hasattr(tb_type, 'IsActive') and not tb_type.IsActive:
                tb_type.Activate()

            # --- medir el area util real de esta vineta con una lamina de prueba ---
            probe = ViewSheet.Create(doc, tb_type.Id)
            doc.Regenerate()
            rect = usable_rect(probe)
            doc.Delete(probe.Id)
            log.append('Area util de la vineta: {:.0f} x {:.0f} mm (margen {:.0f} mm).'.format(
                (rect[2] - rect[0]) * 304.8, (rect[3] - rect[1]) * 304.8, margin * 304.8))

            # --- simulacion en seco, sector por sector ---
            for n in sorted(pendientes.keys()):
                vistas = pendientes[n]
                tamanos = [tamano_con_titulo(v) for v in vistas]
                pos, n_lam, avisos = empaquetar(tamanos, rect, margin)
                sheets_needed += n_lam
                for w, h in avisos:
                    log.append('AVISO {}: una vista de {:.0f} x {:.0f} mm en papel excede el area util de una lamina completa; ocupara una lamina para si sola.'.format(
                        n, w * 304.8, h * 304.8))
                log.append('{}: {} vista(s) -> {} lamina(s).'.format(n, len(vistas), n_lam))

            # --- crear esa cantidad de laminas, con la numeracion de siempre ---
            if not first_number:
                first_number = 'A-001'
                log.append('AVISO: numero inicial vacio, se usa A-001.')
            if not first_name:
                first_name = 'SIN NOMBRE 01'
                log.append('AVISO: nombre inicial vacio, se usa SIN NOMBRE 01.')

            existing = set()
            for vs in FilteredElementCollector(doc).OfClass(ViewSheet):
                existing.add(vs.SheetNumber)

            plan = []
            produced = 0
            offset = 0
            while produced < sheets_needed and offset < sheets_needed + 1000:
                num = first_number if offset == 0 else bump(first_number, offset)
                offset += 1
                if num in existing:
                    log.append('AVISO: el numero {} ya existe en el proyecto, se salta.'.format(num))
                    continue
                name = first_name if produced == 0 else bump(first_name, produced)
                plan.append((num, name))
                existing.add(num)
                produced += 1

            for num, name in plan:
                try:
                    sheet = ViewSheet.Create(doc, tb_type.Id)
                    sheet.SheetNumber = num
                    try:
                        sheet.Name = name
                    except Exception:
                        Element.Name.__set__(sheet, name)
                    created += 1
                    log.append('OK: {}  |  {}'.format(num, name))
                except Exception as e:
                    log.append('ERROR creando {}: {}'.format(num, e))
        finally:
            TransactionManager.Instance.TransactionTaskDone()

        log.insert(0, 'Vineta usada: ' + tb_label(tb_type))
        log.insert(1, 'Sectores con vistas pendientes: {} | laminas necesarias: {} | creadas: {}'.format(
            len(pendientes), sheets_needed, created))
        log.append('Listo. Ahora corre 02_Colocar vistas en laminas para distribuir las vistas.')
        OUT = log
# ----------------------------------------
log = Watch(py_cuenta_vistas_pendientes_y)  # graph output
