# Dynamo graph 02_Colocar vistas en laminas.dyn (Dynamo 4.0.2.3852)
# Coloca la planta y las cuatro elevaciones de cada sector en las laminas destino.

n01_sheets_destino_numeros_con = StringInput("A1")  # "01. Sheets destino - numeros con coma, o prefijo"; graph input
n02_procesar_todos_los_sectores = BoolSelector(true)  # "02. Procesar TODOS los sectores"; graph input
n03_filtro_de_sectores_si_todos = StringInput("")  # "03. Filtro de sectores si TODOS = False"; graph input
n04_margen_y_separacion_en_mm = IntegerSlider(5, range=0..50 step 1)  # "04. Margen y separacion en mm"; graph input
n05_tipo_de_viewport_para_plantas = StringInput("C_Titulo_General")  # "05. Tipo de viewport para PLANTAS"; graph input
n06_tipo_de_viewport_para = StringInput("C_Titulo_Seccion")  # "06. Tipo de viewport para ELEVACIONES"; graph input
n07_separacion_del_titulo_bajo = IntegerSlider(19, range=0..60 step 1)  # "07. Separacion del titulo bajo elevaciones en mm"; graph input
py_coloca_las_vistas_de_cada = Python(IN[0]=n01_sheets_destino_numeros_con, IN[1]=n02_procesar_todos_los_sectores, IN[2]=n03_filtro_de_sectores_si_todos, IN[3]=n04_margen_y_separacion_en_mm, IN[4]=n05_tipo_de_viewport_para_plantas, IN[5]=n06_tipo_de_viewport_para, IN[6]=n07_separacion_del_titulo_bajo)  # "PY | coloca las vistas de cada sector en sus laminas"; PythonNet3
# ---------- py_coloca_las_vistas_de_cada.python (412 lines) ----------
# 02_Colocar vistas en laminas - ILUMINACION
#
# Regla de aislamiento (estandar del proyecto): cada lamina lleva vistas de UN SOLO
# sector. Por sector se colocan, en este orden y fluyendo de izquierda a derecha y de
# arriba hacia abajo: la PLANTA y despues las cuatro elevaciones A, B, C y D. Cuando
# se llena la lamina se sigue en la siguiente, y el sector SIGUIENTE siempre arranca
# en una lamina nueva.
#
# Revit 2027 / Dynamo 4 / CPython3
# IN[0] = sheets destino: numeros separados por coma, o un prefijo comun
# IN[1] = procesar todos los sectores (bool)
# IN[2] = filtro de sectores si IN[1] es False (parcial, comas)
# IN[3] = margen y separacion entre vistas (mm) - debe coincidir con el mismo input
#         de 01_Calcular y crear laminas para que el calculo sea exacto
# IN[4] = tipo de viewport para las PLANTAS
# IN[5] = tipo de viewport para las ELEVACIONES
# IN[6] = separacion del titulo bajo las elevaciones (mm)
#
# QUE DESAPARECIO RESPECTO DEL 02 DE ACERO (T003), Y POR QUE
#
# 1. La reserva del lado derecho, por lo mismo que en 01: no hay tabla de cantidades,
#    las vistas usan el lienzo COMPLETO. empaquetar() trabaja con un solo rectangulo.
#
# 2. TODA la maquinaria de leyendas: familias_recursivas, duplicado_leyenda,
#    assemblies_en_sheet y colocar_leyendas. No es que las leyendas no sirvan aca -el
#    modelo tiene varias (ILU-SIMBOLOGIA, ILU-NOMENCLATURA, ILU-TABLAS DE RIELES)-,
#    es que la REGLA DE MATCHEO no sobrevive: en acero una leyenda se colocaba cuando
#    su nombre coincidia con el nombre de TIPO de familia de algun MIEMBRO del
#    assembly, y eso se resolvia con ai.GetMemberIds(). Sin assemblies no hay lista de
#    miembros, y "que elementos pertenecen al sector" pasa a ser una pregunta
#    geometrica contra la caja. Se elimina en vez de dejarse a medias: codigo que no
#    puede funcionar pero sigue ahi es lo que hace que un desfase pase desapercibido.
#    Cuando definas que leyendas van en las laminas de iluminacion y con que criterio,
#    se vuelve a agregar con una regla que si se sostenga.
#
# Lo que SI se hereda es el Detail Number: en acero la elevacion se identificaba por
# su eje y aca por su letra, pero la idea es la misma -que la marca de corte en la
# planta y el titulo de la elevacion digan lo mismo-.

import clr
clr.AddReference('RevitAPI')
clr.AddReference('RevitServices')
from Autodesk.Revit.DB import (FilteredElementCollector, ViewSheet, Viewport,
                               View, BuiltInCategory, XYZ, Element, ElementType,
                               BuiltInParameter, FamilySymbol)
from RevitServices.Persistence import DocumentManager
from RevitServices.Transactions import TransactionManager

doc = DocumentManager.Instance.CurrentDBDocument

sheets_text = (IN[0] or '').strip()
process_all = bool(IN[1])
filter_text = (IN[2] or '').strip()
margin = float(IN[3]) / 304.8
vp_type_text = (IN[4] or '').strip()
vp_type_text_elev = (IN[5] or '').strip()
gap_elev = float(IN[6]) / 304.8       # separacion del titulo bajo las elevaciones
gap_planta = 5.0 / 304.8

label_h_planta = 12.0 / 304.8
label_h_elev = (12.0 + 14.0) / 304.8

log = []

# --- contrato de nombres con 00_Vistas de sector ---
SUF_PLANTA = ' - PLANTA'
SUF_ELEV = ' - ELEV '

# Mismo orden que LETRAS en 01 y que la tupla ELEVACIONES en 00.
LETRAS = ('A', 'B', 'C', 'D')


def elem_name(e):
    try:
        return e.Name
    except Exception:
        return Element.Name.__get__(e)


def es_elevacion(nombre):
    return SUF_ELEV in nombre


def letra_de_elevacion(nombre):
    i = nombre.find(SUF_ELEV)
    if i < 0:
        return None
    return nombre[i + len(SUF_ELEV):]


def sector_de_vista(nombre):
    if nombre.endswith(SUF_PLANTA):
        return nombre[:-len(SUF_PLANTA)]
    i = nombre.find(SUF_ELEV)
    if i > 0:
        return nombre[:i]
    return nombre


# --- tipos de viewport (plantas y elevaciones) ---
vp_types = [t for t in FilteredElementCollector(doc).OfClass(ElementType)
            if t.FamilyName == 'Viewport']


def crear_tipo_viewport(nombre):
    # bootstrap: el tipo no existe todavia en el proyecto -> se crea duplicando uno
    # existente y se configura para que muestre titulo (Show Title + familia de
    # View Title). Asi el graph queda autosuficiente en un proyecto nuevo.
    base = vp_types[0]
    nuevo = base.Duplicate(nombre)
    vp_types.append(nuevo)
    log.append('Tipo de viewport {} creado (duplicado de {}).'.format(nombre, elem_name(base)))
    p = nuevo.get_Parameter(BuiltInParameter.VIEWPORT_ATTR_SHOW_LABEL)
    if p is not None and not p.IsReadOnly and p.AsInteger() != 1:
        p.Set(1)
    pt = nuevo.get_Parameter(BuiltInParameter.VIEWPORT_ATTR_LABEL_TAG)
    if pt is not None and (pt.AsElementId() is None or pt.AsElementId().Value < 0):
        labels = list(FilteredElementCollector(doc).OfClass(FamilySymbol)
                      .OfCategory(BuiltInCategory.OST_ViewportLabel))
        if labels:
            pt.Set(labels[0].Id)
        else:
            log.append('AVISO: no hay ninguna familia View Title cargada en el proyecto; el tipo {} mostrara la linea pero no el texto.'.format(nombre))
            log.append('Carga una (Insertar > Cargar familia > Anotaciones > titulo de vista) y re-corre.')
    return nuevo


def buscar_tipo_viewport(texto, uso):
    if not texto:
        return None
    low = texto.lower()
    for t in vp_types:
        if elem_name(t).lower() == low:
            return t
    cands = [t for t in vp_types if low in elem_name(t).lower()]
    if len(cands) == 1:
        return cands[0]
    if len(cands) > 1:
        log.append('AVISO: hay {} tipos de viewport que coinciden parcialmente con "{}" (para {}); se usa el tipo por defecto.'.format(len(cands), texto, uso))
        log.append('Tipos disponibles: ' + ', '.join(sorted(elem_name(t) for t in vp_types)))
        return None
    return crear_tipo_viewport(texto)


vp_type = None
vp_type_elev = None

# --- sheets destino, ordenados por numero ---
all_sheets = {}
for s in FilteredElementCollector(doc).OfClass(ViewSheet):
    all_sheets[s.SheetNumber] = s

target_sheets = []
seen = set()
for tok in [t.strip() for t in sheets_text.split(',') if t.strip()]:
    if tok in all_sheets:
        matches = [all_sheets[tok]]
    else:
        matches = [s for n, s in all_sheets.items() if n.startswith(tok)]
    for s in matches:
        if s.SheetNumber not in seen:
            seen.add(s.SheetNumber)
            target_sheets.append(s)
target_sheets.sort(key=lambda s: s.SheetNumber)

if not target_sheets:
    log.append('ERROR: ningun sheet coincide con "{}".'.format(sheets_text))
    log.append('Sheets del proyecto: ' + ', '.join(sorted(all_sheets.keys())[:30]))
    OUT = log
else:
    view_by_name = {}
    for v in FilteredElementCollector(doc).OfClass(View):
        if not v.IsTemplate:
            view_by_name[elem_name(v)] = v

    # --- sectores = los que 00 EFECTIVAMENTE documento ---
    # Mismo criterio que 01, y por la misma razon: la lista sale de las vistas que
    # existen, no de recorrer las vistas 3D con Section Box. Tener el Section Box
    # encendido no convierte a una vista 3D de trabajo en un sector. Ver la nota
    # larga en 01_Calcular y crear laminas.
    nombres = []
    for n in view_by_name:
        if n.endswith(SUF_PLANTA):
            nombres.append(n[:-len(SUF_PLANTA)])
    nombres.sort()

    if not nombres:
        log.append('AVISO: no hay ninguna vista "<sector> - PLANTA" en el modelo; corre antes 00_Vistas de sector.')
    if not process_all:
        tokens = [t.strip().lower() for t in filter_text.split(',') if t.strip()]
        if tokens:
            nombres = [n for n in nombres if any(tok in n.lower() for tok in tokens)]
        else:
            nombres = []
            log.append('ERROR: "Todos" esta en False y el filtro esta vacio.')
    log.append('Sectores documentados por 00: ' + (', '.join(nombres) if nombres else '(ninguno)'))

    placed_ids = set()
    for vp in FilteredElementCollector(doc).OfClass(Viewport):
        placed_ids.add(vp.ViewId.Value)

    def paper_size(v):
        # tamaño en papel (pies) = crop del modelo / escala
        cb = v.CropBox
        s = v.Scale if v.Scale > 0 else 1
        return ((cb.Max.X - cb.Min.X) / s, (cb.Max.Y - cb.Min.Y) / s)

    def tamano_con_titulo(v):
        w, h = paper_size(v)
        return (w, h + (label_h_elev if es_elevacion(elem_name(v)) else label_h_planta))

    def usable_rect(sheet):
        # area util = bbox de la vineta menos margenes, sin reservar nada
        col = FilteredElementCollector(doc, sheet.Id).OfCategory(BuiltInCategory.OST_TitleBlocks)
        tb = col.FirstElement()
        if tb is not None:
            bb = tb.get_BoundingBox(sheet)
            if bb is not None:
                return (bb.Min.X + margin, bb.Min.Y + margin,
                        bb.Max.X - margin, bb.Max.Y - margin)
        o = sheet.Outline
        return (o.Min.U + margin, o.Min.V + margin,
                o.Max.U - margin, o.Max.V - margin)

    def empaquetar(tamanos, rect, margin):
        # IDENTICA a la de 01_Calcular y crear laminas. Si las dos se separan, 01
        # calcula una cantidad de laminas que no coincide con lo que 02 coloca.
        pos = []
        avisos = []
        idx = 0
        x0, y0, x1, y1 = rect
        cx, cy, row_h = x0, y1, 0.0
        for w, h in tamanos:
            if cx > x0 and cx + w > x1:
                cx = x0
                cy -= row_h + margin
                row_h = 0.0
            fresco = (abs(cx - x0) < 1e-9 and abs(cy - y1) < 1e-9)
            if cy - h < y0 and not fresco:
                idx += 1
                cx, cy, row_h = x0, y1, 0.0
                fresco = True
            if fresco and (w > (x1 - x0) or h > (y1 - y0)):
                avisos.append((w, h))
            pos.append((idx, cx, cy))
            cx += w + margin
            if h > row_h:
                row_h = h
        return pos, idx + 1, avisos

    def vistas_pendientes(sname):
        # orden de lamina: la planta primero, despues las cuatro elevaciones A->D
        res = []
        v = view_by_name.get(sname + SUF_PLANTA)
        if v is None:
            log.append('AVISO: no existe la vista "{}" (corre 00_Vistas de sector).'.format(sname + SUF_PLANTA))
        elif v.Id.Value in placed_ids:
            log.append('AVISO: "{}" ya esta en un sheet, se salta.'.format(sname + SUF_PLANTA))
        else:
            res.append(v)
        for letra in LETRAS:
            n = sname + SUF_ELEV + letra
            v = view_by_name.get(n)
            if v is None:
                log.append('AVISO: no existe la vista "{}" (corre 00_Vistas de sector).'.format(n))
            elif v.Id.Value in placed_ids:
                log.append('AVISO: "{}" ya esta en un sheet, se salta.'.format(n))
            else:
                res.append(v)
        return res

    def numero_detalle(vp, v, sheet):
        # El Detail Number es lo que muestra la marca de corte en la planta, asi que
        # ponerle la LETRA deja la marca y el titulo de la elevacion diciendo lo mismo
        # ("A"). Si la letra ya esta usada en ese sheet se cae a un correlativo para
        # no romper la unicidad que exige Revit.
        letra = letra_de_elevacion(elem_name(v))
        if not letra:
            return
        usados = set()
        for vpid in sheet.GetAllViewports():
            if vpid.Value == vp.Id.Value:
                continue
            ovp = doc.GetElement(vpid)
            try:
                dn = ovp.get_Parameter(BuiltInParameter.VIEWPORT_DETAIL_NUMBER).AsString()
                if dn:
                    usados.add(dn)
            except Exception:
                pass
        destino = letra
        k = 2
        while destino in usados:
            destino = '{}({})'.format(letra, k)
            k += 1
        try:
            p = vp.get_Parameter(BuiltInParameter.VIEWPORT_DETAIL_NUMBER)
            if p is not None and not p.IsReadOnly:
                p.Set(destino)
        except Exception:
            pass

    def colocar_vista(v, x_izq, y_sup, sheet):
        # coloca la vista y la reposiciona con su tamaño REAL ya colocado
        # (Viewport.GetBoxOutline(), que SI incluye anotaciones fuera del CropBox
        # porque el Annotation Crop esta desactivado), alineando su esquina superior
        # izquierda con (x_izq, y_sup).
        w_v = paper_size(v)[0]
        h_v = paper_size(v)[1]
        centro = XYZ(x_izq + w_v / 2.0, y_sup - h_v / 2.0, 0.0)
        try:
            vp = Viewport.Create(doc, sheet.Id, v.Id, centro)
        except Exception as e:
            log.append('ERROR colocando "{}": {}'.format(elem_name(v), e))
            return 0
        if vp is None:
            log.append('ERROR: Revit no permitio colocar "{}" en {}.'.format(elem_name(v), sheet.SheetNumber))
            return 0
        elev = es_elevacion(elem_name(v))
        t_apl = vp_type_elev if elev else vp_type
        if t_apl is not None:
            try:
                if vp.GetTypeId() != t_apl.Id:
                    vp.ChangeTypeId(t_apl.Id)
                vp.LabelOffset = XYZ(0.0, -(gap_elev if elev else gap_planta), 0.0)
                vp.LabelLineLength = w_v
            except Exception:
                pass
        if elev:
            numero_detalle(vp, v, sheet)
        try:
            ob = vp.GetBoxOutline()
            centro_actual = vp.GetBoxCenter()
            dx = x_izq - ob.MinimumPoint.X
            dy = y_sup - ob.MaximumPoint.Y
            vp.SetBoxCenter(XYZ(centro_actual.X + dx, centro_actual.Y + dy, 0.0))
        except Exception:
            pass
        log.append('OK: "{}" -> sheet {}'.format(elem_name(v), sheet.SheetNumber))
        return 1

    pendientes = {}
    for n in nombres:
        vs = vistas_pendientes(n)
        if vs:
            pendientes[n] = vs

    total_vistas = sum(len(v) for v in pendientes.values())
    placed = 0
    overflow = []

    TransactionManager.Instance.EnsureInTransaction(doc)
    try:
        vp_type = buscar_tipo_viewport(vp_type_text, 'plantas')
        vp_type_elev = buscar_tipo_viewport(vp_type_text_elev, 'elevaciones')

        # laminas disponibles = las del filtro que todavia no tienen ningun viewport.
        # Un sector nunca se mezcla con otro, asi que solo se usan laminas vacias.
        libres = []
        for sh in target_sheets:
            if len(list(sh.GetAllViewports())) > 0:
                log.append('AVISO: sheet {} ya tiene vistas colocadas, se omite.'.format(sh.SheetNumber))
            else:
                libres.append(sh)

        if libres:
            rx0, ry0, rx1, ry1 = usable_rect(libres[0])
            log.append('Area util de la vineta: {:.0f} x {:.0f} mm (margen {:.0f} mm).'.format(
                (rx1 - rx0) * 304.8, (ry1 - ry0) * 304.8, margin * 304.8))

        si = 0
        for n in sorted(pendientes.keys()):
            vistas = pendientes[n]
            if si >= len(libres):
                for v in vistas:
                    overflow.append(elem_name(v))
                continue
            rect = usable_rect(libres[si])
            tamanos = [tamano_con_titulo(v) for v in vistas]
            # DIAGNOSTICO: el tamaño en papel de cada vista es lo unico que decide
            # cuantas laminas salen. Si el numero de laminas sorprende, la respuesta
            # esta en estas lineas comparadas con el area util de arriba.
            for v, (w, h) in zip(vistas, tamanos):
                log.append('   {} -> {:.0f} x {:.0f} mm en papel (escala 1:{}).'.format(
                    elem_name(v), w * 304.8, h * 304.8, v.Scale))
            pos, n_lam, avisos = empaquetar(tamanos, rect, margin)
            for w, h in avisos:
                log.append('AVISO {}: una vista de {:.0f} x {:.0f} mm en papel excede el area util de la lamina; se coloca igual.'.format(
                    n, w * 304.8, h * 304.8))
            if si + n_lam > len(libres):
                faltan = si + n_lam - len(libres)
                log.append('AVISO {}: faltan {} lamina(s) libres para este sector.'.format(n, faltan))
            usadas = []
            for k in range(n_lam):
                if si + k < len(libres):
                    usadas.append(libres[si + k])
            for (idx, x, y), v in zip(pos, vistas):
                if idx >= len(usadas):
                    overflow.append(elem_name(v))
                    continue
                placed += colocar_vista(v, x, y, usadas[idx])
            log.append('{}: {} vista(s) en {}.'.format(
                n, len(vistas), ', '.join(s.SheetNumber for s in usadas) if usadas else '(sin lamina)'))
            si += n_lam
    finally:
        TransactionManager.Instance.TransactionTaskDone()

    if overflow:
        log.append('SIN ESPACIO para {} vistas: {}'.format(len(overflow), ', '.join(overflow)))
        log.append('Corre 01_Calcular y crear laminas para agregar las que falten y vuelve a correr este graph (lo ya colocado se respeta).')
    log.insert(0, 'Vistas colocadas: {} de {}'.format(placed, total_vistas))
    OUT = log
# ----------------------------------------
log = Watch(py_coloca_las_vistas_de_cada)  # graph output
