# Dynamo graph 03_Rieles RUC - cotas y tags.dyn (Dynamo 4.0.2.3852)
# Anota las plantas de sector: cadenas de cotas exteriores entre los rieles RUC de suelo, y un texto con el TIPO (R-01, R-02...) con una flecha a cada riel RUC de la planta, de suelo y de muro.

n01_procesar_todos_los_sectores = BoolSelector(false)  # "01. Procesar TODOS los sectores"; graph input
n02_filtro_de_sectores_si_todos = StringInput("SECTOR A")  # "02. Filtro de sectores (si TODOS = False)"; graph input
n03_la_familia_del_riel_empieza = StringInput("RIEL RUC")  # "03. La familia del riel EMPIEZA con"; graph input
n04_y_ademas_contiene_solo_para = StringInput("SUELO")  # "04. ...y ademas CONTIENE (solo para las cotas; vacio = no filtra mas)"; graph input
n05_separacion_de_la_cadena_al = IntegerSlider(9, range=0..60 step 1)  # "05. Separacion de la cadena al borde del marco (mm de papel)"; graph input
n06_separacion_minima_entre_dos = IntegerSlider(1, range=0..20 step 1)  # "06. Separacion minima entre dos cotas de la cadena (mm de papel)"; graph input
n07_tipo_de_cota_vacio_el_por = StringInput("")  # "07. Tipo de cota (vacio = el por defecto)"; graph input
n08_rehacer_las_cotas_y_los_tags = BoolSelector(true)  # "08. Rehacer las cotas y los tags de riel existentes"; graph input
n09_margen_extra_del_annotation = IntegerSlider(10, range=0..60 step 1)  # "09. Margen extra del annotation crop (mm de papel)"; graph input
n10_parametro_con_el_largo_del = StringInput("Longitud")  # "10. Parametro con el largo del riel"; graph input
n11_parametro_donde_se_escribe_el = StringInput("TEXTO PARA TAG")  # "11. Parametro donde se escribe el codigo de tipo"; graph input
n12_tipo_de_texto_del_tag_vacio = StringInput("2mm wf 0.85 RomanD")  # "12. Tipo de texto del tag (vacio = el por defecto)"; graph input
n13_radio_para_agrupar_rieles = IntegerSlider(30, range=0..200 step 1)  # "13. Radio para agrupar rieles bajo un mismo texto (mm de papel)"; graph input
n14_separacion_del_texto_al_grupo = IntegerSlider(4, range=0..60 step 1)  # "14. Separacion del texto al grupo (mm de papel)"; graph input
n15_maximo_de_rieles_por_texto_0 = IntegerSlider(4, range=0..20 step 1)  # "15. Maximo de rieles por texto (0 = sin tope)"; graph input
py_cotas_entre_rieles_de_suelo = Python(IN[0]=n01_procesar_todos_los_sectores, IN[1]=n02_filtro_de_sectores_si_todos, IN[2]=n03_la_familia_del_riel_empieza, IN[3]=n04_y_ademas_contiene_solo_para, IN[4]=n05_separacion_de_la_cadena_al, IN[5]=n06_separacion_minima_entre_dos, IN[6]=n07_tipo_de_cota_vacio_el_por, IN[7]=n08_rehacer_las_cotas_y_los_tags, IN[8]=n09_margen_extra_del_annotation, IN[9]=n10_parametro_con_el_largo_del, IN[10]=n11_parametro_donde_se_escribe_el, IN[11]=n12_tipo_de_texto_del_tag_vacio, IN[12]=n13_radio_para_agrupar_rieles, IN[13]=n14_separacion_del_texto_al_grupo, IN[14]=n15_maximo_de_rieles_por_texto_0)  # "PY | Cotas entre rieles de suelo + tags de tipo de riel"; PythonNet3
# ---------- py_cotas_entre_rieles_de_suelo.python (815 lines) ----------
# 03_Rieles RUC - cotas y tags - ILUMINACION
#
# El primero de los DOS PASOS DEL RIEL RUC. Dibuja sobre las plantas de sector las cadenas
# de cotas entre rieles de suelo y los textos R-xx con multiflecha sobre todos los rieles.
# El segundo es 04_Rieles RUC - tabla de tipos, que imprime la TABLA N.1 en cada lamina.
#
# Todo lo que hace este paso sale del parametro Longitud de un riel: en una lamina sin
# rieles no haria nada. Lo que es de la HOJA y no del riel -la simbologia, la nomenclatura,
# el bloque de notas generales- vive en 05_Leyendas y notas.
#
# (AGRUPACION CONTINUA + MULTIFLECHAS + ANTICOLISION)
#
# Desde el 2026-08-20 este paso hace TRES cosas, no dos: ademas de las cadenas de cotas
# entre rieles y los tags R-xx, pone UNA COTA POR CONDUIT con su largo, usando el mismo
# tipo de cota que las cadenas de riel. Vive aca y no en un paso aparte porque es la misma
# operacion sobre la misma vista: acotar lo que hay en la planta de sector.

import clr
import math
import re
clr.AddReference('RevitAPI')
clr.AddReference('RevitServices')
from Autodesk.Revit.DB import (FilteredElementCollector, ViewPlan, XYZ, Line,
                               ReferenceArray, Dimension, DimensionType, Element,
                               BuiltInCategory, BuiltInParameter, StorageType, ElementId,
                               FamilyInstance, FamilyInstanceReferenceType, Category,
                               TextNote, TextNoteType, TextNoteLeaderTypes,
                               ElementTypeGroup)
from RevitServices.Persistence import DocumentManager
from RevitServices.Transactions import TransactionManager

doc = DocumentManager.Instance.CurrentDBDocument

process_all = bool(IN[0])
filter_text = (IN[1] or '').strip()
fam_prefijo = (IN[2] or '').strip()
fam_contiene = (IN[3] or '').strip()
off_mm = float(IN[4]) if IN[4] is not None else 25.0
sep_min_mm = float(IN[5]) if IN[5] is not None else 500.0
dim_type_name = (IN[6] or '').strip()
rehacer = bool(IN[7])
annot_extra_mm = float(IN[8]) if IN[8] is not None else 15.0
param_largo = (IN[9] or 'Longitud').strip()
param_codigo = (IN[10] or 'TEXTO PARA TAG').strip()
tipo_texto_nombre = (IN[11] or '').strip()
radio_tag_mm = float(IN[12]) if IN[12] is not None else 30.0
sep_tag_mm = float(IN[13]) if IN[13] is not None else 4.0
max_por_texto_in = int(IN[14]) if IN[14] is not None else 0

# Cotas de largo de conduit. Van como constantes y NO como inputs nuevos: los 15 puertos del
# nodo ya estan todos ocupados por la cadena de rieles y los tags, y agregar puertos a un
# paso que funciona es arriesgar lo que ya anda por dos numeros que casi nunca se tocan.
OFF_CONDUIT_MM = 6.0      # separacion de la cota al conduit, en mm de papel
UMBRAL_VERT_MM = 30.0     # si en planta proyecta menos que esto, es una BAJADA y no se acota

log = []
SUF_PLANTA = ' - PLANTA'
TOL_PARALELO = 1e-6
TOL_NORMAL = 1e-3
LADOS = ('arriba', 'abajo', 'izquierda', 'derecha')
PREFIJO_TIPO = 'R-'
RE_CODIGO = re.compile(r'^' + re.escape(PREFIJO_TIPO) + r'\d+$')


def elem_name(e):
    try:
        return Element.Name.GetValue(e)
    except Exception:
        try:
            return e.Name
        except Exception:
            return ''


def coincide(nombre, texto):
    if not texto:
        return True
    alto = (nombre or '').upper()
    for t in texto.split(','):
        t = t.strip().upper()
        if t and t in alto:
            return True
    return False


def fam_name(el):
    try:
        return el.Symbol.Family.Name or ''
    except Exception:
        return ''


def es_riel(el):
    f = fam_name(el).upper()
    if not f:
        return False
    return not fam_prefijo or f.startswith(fam_prefijo.upper())


def es_riel_de_cota(el):
    if not es_riel(el):
        return False
    f = fam_name(el).upper()
    return not fam_contiene or fam_contiene.upper() in f


def plantas_de_sector():
    res = []
    for v in FilteredElementCollector(doc).OfClass(ViewPlan):
        if v.IsTemplate:
            continue
        n = elem_name(v)
        if not n.endswith(SUF_PLANTA):
            continue
        sector = n[:-len(SUF_PLANTA)]
        if not process_all and not coincide(sector, filter_text):
            continue
        res.append((v, sector))
    res.sort(key=lambda p: p[1])
    return res


def extremos_en_ejes(el, ex, ey):
    bb = el.get_BoundingBox(None)
    if bb is None:
        return None
    us, ws = [], []
    for x in (bb.Min.X, bb.Max.X):
        for y in (bb.Min.Y, bb.Max.Y):
            for z in (bb.Min.Z, bb.Max.Z):
                p = XYZ(x, y, z)
                us.append(p.DotProduct(ex))
                ws.append(p.DotProduct(ey))
    return min(us), max(us), min(ws), max(ws)


def envolvente_de_elementos(elementos, ex, ey):
    us, ws = [], []
    for el in elementos:
        ext = extremos_en_ejes(el, ex, ey)
        if ext:
            us.extend([ext[0], ext[1]])
            ws.extend([ext[2], ext[3]])
    if not us:
        return 0, 0, 0, 0
    return min(us), max(us), min(ws), max(ws)


def referencia_de_eje(inst, eje_medida):
    try:
        tr = inst.GetTransform()
    except Exception:
        return None, None
    candidatos = ((FamilyInstanceReferenceType.CenterLeftRight, tr.BasisX),
                  (FamilyInstanceReferenceType.CenterFrontBack, tr.BasisY))
    for tipo, normal in candidatos:
        try:
            n = normal.Normalize()
        except Exception:
            continue
        if abs(abs(n.DotProduct(eje_medida)) - 1.0) > TOL_NORMAL:
            continue
        try:
            refs = list(inst.GetReferences(tipo))
        except Exception:
            refs = []
        if refs:
            return refs[0], n
    return None, None


def canonica(n):
    if n.X > 1e-12:
        return n
    if n.X < -1e-12:
        return n.Negate()
    return n if n.Y >= 0 else n.Negate()


def alinear(items):
    if not items:
        return [], 0, 0.0
    cubetas = {}
    for it in items:
        d = canonica(it[3])
        k = int(round(math.atan2(d.Y, d.X) / TOL_PARALELO))
        acc = cubetas.get(k)
        if acc is None:
            cubetas[k] = [1, d]
        else:
            acc[0] += 1
    dom = max(cubetas.values(), key=lambda a: a[0])[1]
    ok = []
    fuera = 0
    peor = 0.0
    for it in items:
        s = abs(it[3].X * dom.Y - it[3].Y * dom.X)
        if s <= TOL_PARALELO / 2.0:
            ok.append(it)
        else:
            fuera += 1
            if s > peor:
                peor = s
    return ok, fuera, peor


def tipo_de_cota(nombre):
    if not nombre:
        return None
    for dt in FilteredElementCollector(doc).OfClass(DimensionType):
        if elem_name(dt) == nombre:
            return dt
    return None


def cadenas_de_riel_existentes(v):
    res = []
    for dim in FilteredElementCollector(doc, v.Id).OfClass(Dimension):
        try:
            for ref in dim.References:
                el = doc.GetElement(ref.ElementId)
                if el is not None and isinstance(el, FamilyInstance) and es_riel(el):
                    res.append(dim.Id)
                    break
        except Exception:
            pass
    return res


def dibujar_cadena(v, items, eje_medida, eje_perp, valor_perp, sep_min, z_plano, dim_type):
    if len(items) < 2:
        return 0
    items, _, _ = alinear(items)
    if len(items) < 2:
        return 0
    items.sort(key=lambda it: it[0])
    filtrados = []
    ultimo = None
    for it in items:
        if ultimo is None or it[0] - ultimo > sep_min:
            filtrados.append(it)
            ultimo = it[0]
    if len(filtrados) < 2:
        return 0
    ra = ReferenceArray()
    for it in filtrados:
        ra.Append(it[1])

    p1 = eje_medida.Multiply(filtrados[0][0]).Add(eje_perp.Multiply(valor_perp))
    p2 = eje_medida.Multiply(filtrados[-1][0]).Add(eje_perp.Multiply(valor_perp))
    p1 = XYZ(p1.X, p1.Y, z_plano)
    p2 = XYZ(p2.X, p2.Y, z_plano)

    if p1.DistanceTo(p2) < 1e-6:
        return 0
    try:
        if dim_type is not None:
            doc.Create.NewDimension(v, Line.CreateBound(p1, p2), ra, dim_type)
        else:
            doc.Create.NewDimension(v, Line.CreateBound(p1, p2), ra)
        return 1
    except Exception:
        return 0


def anotar_planta(v, sector, dim_type):
    escala = v.Scale or 1
    papel = lambda mm: float(mm) / 304.8 * escala

    off = papel(off_mm)
    sep_min = papel(sep_min_mm)

    if rehacer:
        for did in cadenas_de_riel_existentes(v):
            try:
                doc.Delete(did)
            except Exception:
                pass

    rieles = [el for el in FilteredElementCollector(doc, v.Id)
              .OfCategory(BuiltInCategory.OST_ElectricalFixtures)
              .WhereElementIsNotElementType()
              if isinstance(el, FamilyInstance) and es_riel_de_cota(el)]
    if not rieles:
        return 0

    ex = v.RightDirection.Normalize()
    ey = v.UpDirection.Normalize()
    z_plano = v.Origin.Z

    u0_r, u1_r, w0_r, w1_r = envolvente_de_elementos(rieles, ex, ey)
    u_mid = (u0_r + u1_r) / 2.0
    w_mid = (w0_r + w1_r) / 2.0

    grupos = dict((lado, []) for lado in LADOS)
    for el in rieles:
        ext = extremos_en_ejes(el, ex, ey)
        if ext is None:
            continue
        au0, au1, aw0, aw1 = ext
        span_u, span_w = au1 - au0, aw1 - aw0
        uc, wc = (au0 + au1) / 2.0, (aw0 + aw1) / 2.0

        if max(span_u, span_w) < 1.2 * min(span_u, span_w):
            continue
        if span_u > span_w:
            lado = 'izquierda' if uc < u_mid else 'derecha'
            eje_medida, pos = ey, wc
        else:
            lado = 'abajo' if wc < w_mid else 'arriba'
            eje_medida, pos = ex, uc

        ref, normal = referencia_de_eje(el, eje_medida)
        if ref:
            grupos[lado].append((pos, ref, elem_name(el), normal))

    n = 0
    n += dibujar_cadena(v, grupos['arriba'], ex, ey, w1_r + off, sep_min, z_plano, dim_type)
    n += dibujar_cadena(v, grupos['abajo'], ex, ey, w0_r - off, sep_min, z_plano, dim_type)
    n += dibujar_cadena(v, grupos['izquierda'], ey, ex, u0_r - off, sep_min, z_plano, dim_type)
    n += dibujar_cadena(v, grupos['derecha'], ey, ex, u1_r + off, sep_min, z_plano, dim_type)
    return n


# ----------------------------- COTAS DE LARGO DE CONDUIT -----------------------------
#
# Una cota por conduit, con el MISMO tipo de cota que las cadenas de riel, tomada contra los
# FITTINGS de sus dos puntas.
#
# POR QUE CONTRA LOS FITTINGS Y NO CONTRA EL CONDUIT
# --------------------------------------------------
# Una cota mide entre referencias paralelas entre si y perpendiculares a la linea de cota.
# El conduit no ofrece ninguna que sirva para su propio largo, y se probaron las dos que
# parecian:
#   - Las CARAS DE EXTREMO de su solido: Revit las descarta al comitear, exactamente igual
#     que con los rieles.
#   - Las PUNTAS DEL EJE via Curve.GetEndPointReference: devuelve nulo para conduits. Se
#     midio sobre los 149 de SECTOR A y no salio ni una sola cota.
# Lo unico que el conduit expone es su EJE, y un eje es una linea A LO LARGO del recorrido:
# sirve para acotar la separacion ENTRE conduits paralelos, nunca el largo de uno.
#
# Los FITTINGS si sirven, y por el mismo motivo que los rieles: son FamilyInstance, asi que
# exponen los planos `Center (Left/Right)` y `Center (Front/Back)` de su familia. Son las
# mismas referencias que usa la cadena de rieles, probadas en este modelo. La cota entre los
# fittings de las dos puntas mide el tramo de eje a eje.
#
# Se reutiliza referencia_de_eje() sin tocarla: es la funcion que ya elige, de los dos
# planos Center de una familia, el que es perpendicular al eje de medida.

def id_entero(eid):
    # El numero pelado de un ElementId. NUNCA se comparan ElementId como objetos: bajo
    # PythonNet la igualdad depende de que se mapee Equals/GetHashCode, y cuando no se mapea
    # falla EN SILENCIO. Revit 2024 ademas cambio IntegerValue por Value.
    for attr in ('Value', 'IntegerValue'):
        try:
            n = getattr(eid, attr)
            if n is not None:
                return int(n)
        except Exception:
            pass
    return None


def largo_conduit_mm(el):
    p = el.get_Parameter(BuiltInParameter.CURVE_ELEM_LENGTH)
    if p is None:
        return None
    L = p.AsDouble()
    return L * 304.8 if L and L > 0 else None


def refs_en_las_puntas(conduit, direccion):
    # Para cada punta, la referencia perpendicular del fitting conectado ahi.
    # Devuelve [(posicion_sobre_direccion, ref), ...] con las dos puntas, o None.
    mi_id = id_entero(conduit.Id)
    try:
        conectores = list(conduit.ConnectorManager.Connectors)
    except Exception:
        return None
    encontrados = []
    for con in conectores:
        try:
            pos = con.Origin.DotProduct(direccion)
        except Exception:
            continue
        elegida = None
        try:
            vecinos = list(con.AllRefs)
        except Exception:
            vecinos = []
        for otro in vecinos:
            try:
                el = otro.Owner
            except Exception:
                continue
            if el is None or id_entero(el.Id) == mi_id:
                continue
            if not isinstance(el, FamilyInstance):
                continue
            r, _ = referencia_de_eje(el, direccion)
            if r:
                elegida = r
                break
        if elegida is not None:
            encontrados.append((pos, elegida))
    if len(encontrados) < 2:
        return None
    encontrados.sort(key=lambda t: t[0])
    return [encontrados[0], encontrados[-1]]


def cotas_de_conduit_existentes(v):
    # Una cota es de este bloque si sus DOS referencias apuntan a CONDUIT FITTINGS. Las
    # cadenas de riel apuntan a rieles, no cumplen, y rehacer no se las lleva.
    ids_fitting = set()
    for f in (FilteredElementCollector(doc, v.Id)
              .OfCategory(BuiltInCategory.OST_ConduitFitting)
              .WhereElementIsNotElementType()):
        ids_fitting.add(id_entero(f.Id))
    res = []
    for dim in FilteredElementCollector(doc, v.Id).OfClass(Dimension):
        try:
            refs = list(dim.References)
        except Exception:
            continue
        if len(refs) != 2:
            continue
        a = id_entero(refs[0].ElementId)
        b = id_entero(refs[1].ElementId)
        if a is not None and a in ids_fitting and b in ids_fitting:
            res.append(dim.Id)
    return res


def acotar_conduits(v, dim_type):
    escala = v.Scale or 1
    papel = lambda x: float(x) / 304.8 * escala
    off = papel(OFF_CONDUIT_MM)
    umbral = UMBRAL_VERT_MM / 304.8
    z_plano = v.Origin.Z

    if rehacer:
        for did in cotas_de_conduit_existentes(v):
            try:
                doc.Delete(did)
            except Exception:
                pass

    puestas = verticales = sin_fitting = sin_largo = 0
    for el in (FilteredElementCollector(doc, v.Id)
               .OfCategory(BuiltInCategory.OST_Conduit)
               .WhereElementIsNotElementType()):
        try:
            loc = el.Location
        except Exception:
            continue
        if loc is None or getattr(loc, 'Curve', None) is None:
            continue
        p0 = loc.Curve.GetEndPoint(0)
        p1 = loc.Curve.GetEndPoint(1)
        dp = XYZ(p1.X - p0.X, p1.Y - p0.Y, 0.0)
        # Solo se excluye lo que en planta es un PUNTO: las bajadas. Un conduit inclinado
        # -una rampa- si es un segmento en planta y se acota.
        if dp.GetLength() < umbral:
            verticales += 1
            continue
        if not largo_conduit_mm(el):
            sin_largo += 1
            continue

        dpn = dp.Normalize()
        puntas = refs_en_las_puntas(el, dpn)
        if puntas is None:
            sin_fitting += 1
            continue

        ra = ReferenceArray()
        for _, r in puntas:
            ra.Append(r)
        perp = XYZ(-dpn.Y, dpn.X, 0.0)
        base = XYZ((p0.X + p1.X) / 2.0, (p0.Y + p1.Y) / 2.0, z_plano).Add(perp.Multiply(off))
        a = base.Add(dpn.Multiply(puntas[0][0] - base.DotProduct(dpn)))
        b = base.Add(dpn.Multiply(puntas[1][0] - base.DotProduct(dpn)))
        if a.DistanceTo(b) < 1e-6:
            continue
        try:
            linea = Line.CreateBound(a, b)
            if dim_type is not None:
                doc.Create.NewDimension(v, linea, ra, dim_type)
            else:
                doc.Create.NewDimension(v, linea, ra)
            puestas += 1
        except Exception:
            pass

    if verticales or sin_fitting or sin_largo:
        log.append('  {}: sin cota -> {} bajadas verticales, {} sin fitting en alguna'
                   ' punta, {} sin Length.'.format(
                       elem_name(v), verticales, sin_fitting, sin_largo))
    return puestas


# ----------------------------- TAGS CON AGRUPACIÓN REAL Y ANTICOLISIÓN -----------------------------

def largo_mm(el):
    # IDENTICA a la de 04. Antes 03 no exigia ni que el parametro fuera Double ni que el
    # largo fuera positivo, asi que un riel con Longitud en 0 entraba aca como un largo mas y
    # no en 04. Con la regla vieja eso corria TODOS los codigos en uno entre el plano y la
    # tabla, en silencio.
    try:
        p = el.LookupParameter(param_largo)
    except Exception:
        return None
    if p is None or not p.HasValue or p.StorageType != StorageType.Double:
        return None
    mm = int(round(p.AsDouble() * 304.8))
    return mm if mm > 0 else None


def rieles_del_modelo():
    return [el for el in FilteredElementCollector(doc)
            .OfCategory(BuiltInCategory.OST_ElectricalFixtures)
            .WhereElementIsNotElementType()
            if isinstance(el, FamilyInstance) and es_riel(el)]


def numero_de_largo(mm):
    # EL NUMERO ES EL LARGO, NO UNA POSICION. El largo en mm con los ceros sobrantes sacados,
    # sin bajar de los cientos: 100 -> 1, 200 -> 2, 250 -> 25, 240 -> 24, 241 -> 241,
    # 1000 -> 10. Se saca hasta los cientos y no mas, porque sacar todos los ceros haria que
    # 1000 y 100 dieran los dos el 1.
    #
    # IDENTICA a la de 04_TABLAS y Listados: el texto que se dibuja en la planta y la fila que
    # imprime la tabla son el mismo dato. Pero ahora, ademas, el codigo de un riel depende
    # SOLO DE ESE RIEL -antes salia de su posicion en la lista de todos los largos del
    # modelo-, asi que aunque las dos implementaciones se separaran no podrian dar codigos
    # distintos para el mismo largo.
    #
    # De paso, un riel mal modelado se delata: el 100 mm que en realidad medía 108,05 salia
    # R-02, indistinguible de un tipo legitimo. Con esta regla sale R-108.
    if mm % 100 == 0:
        return mm // 100
    if mm % 10 == 0:
        return mm // 10
    return mm


def tabla_de_tipos(rieles):
    # Traduce cada largo por separado. No numera: no hay lista, no hay orden, no hay nada que
    # se corra cuando un largo aparece o desaparece.
    largos = sorted(set(l for l in (largo_mm(e) for e in rieles) if l is not None))
    mapa = {}
    visto = {}
    for l in largos:
        n = numero_de_largo(l)
        codigo = '{}{:02d}'.format(PREFIJO_TIPO, n)
        if n in visto:
            # 250 y 2500 dan los dos 25. Hoy no pasa -el riel mas largo mide 1000- pero si
            # pasara, dos tipos distintos compartirian codigo sin que nada fallara.
            log.append('ERROR: los largos {} mm y {} mm dan los dos el codigo {}. La regla '
                       'del codigo no los distingue: o uno esta mal medido, o hay que cambiar '
                       'la regla.'.format(visto[n], l, codigo))
        visto[n] = l
        mapa[l] = codigo
    return mapa


def tipo_de_texto(nombre):
    objetivo = (nombre or '').strip().upper()
    for tt in FilteredElementCollector(doc).OfClass(TextNoteType):
        if objetivo and elem_name(tt).upper() == objetivo:
            return tt.Id
    return doc.GetDefaultElementTypeId(ElementTypeGroup.TextNoteType)


def agrupar_rieles_contiguos(rieles_info, radio_gap_ft, max_tope, ex, ey):
    """
    Agrupa rieles por LÍNEA FÍSICA y por CÓDIGO de forma continua, generando 1 solo grupo por código por tramo.
    """
    if not rieles_info:
        return []

    TOL_EJE = 0.8  # Tolerancia alineación en pies (~25 cm)
    lineas_fisicas = []
    usados = set()
    n = len(rieles_info)

    # 1. Identificar tramos lineales
    for i in range(n):
        if i in usados:
            continue
        item_i = rieles_info[i]
        linea_actual = [item_i]
        usados.add(i)

        for j in range(i + 1, n):
            if j in usados:
                continue
            item_j = rieles_info[j]

            dx = abs(item_i[1].X - item_j[1].X)
            dy = abs(item_i[1].Y - item_j[1].Y)

            if dy < TOL_EJE or dx < TOL_EJE:
                linea_actual.append(item_j)
                usados.add(j)

        lineas_fisicas.append(linea_actual)

    # 2. Agrupar por CODIGO dentro de cada tramo
    grupos_finales = []
    for linea in lineas_fisicas:
        por_codigo = {}
        for item in linea:
            cod = item[3]
            if cod not in por_codigo:
                por_codigo[cod] = []
            por_codigo[cod].append(item)

        for cod, items_cod in por_codigo.items():
            us = [it[1].DotProduct(ex) for it in items_cod]
            ws = [it[1].DotProduct(ey) for it in items_cod]
            es_horiz = (max(us) - min(us)) >= (max(ws) - min(ws))

            if es_horiz:
                items_cod.sort(key=lambda it: it[1].DotProduct(ex))
            else:
                items_cod.sort(key=lambda it: it[1].DotProduct(ey))

            sub_grupo = [items_cod[0]]
            for it in items_cod[1:]:
                prev = sub_grupo[-1]
                dist = it[1].DistanceTo(prev[1])
                if dist <= radio_gap_ft:
                    sub_grupo.append(it)
                else:
                    grupos_finales.append(sub_grupo)
                    sub_grupo = [it]
            if sub_grupo:
                grupos_finales.append(sub_grupo)

    # 3. Aplicar tope máximo si está configurado (> 0)
    grupos_con_tope = []
    for g in grupos_finales:
        if max_tope > 0 and len(g) > max_tope:
            for sub_i in range(0, len(g), max_tope):
                grupos_con_tope.append(g[sub_i:sub_i + max_tope])
        else:
            grupos_con_tope.append(g)

    return grupos_con_tope


def resolver_posicion_tag(pt_base, ex, ey, dist_pegado, es_horiz, colocados, escala):
    """
    Desplaza la nota de texto si detecta un texto ya colocado en la misma coordenada.
    """
    if not colocados:
        return pt_base

    ft_a_mm_papel = lambda ft: (ft * 304.8) / escala
    u_b = pt_base.DotProduct(ex)
    w_b = pt_base.DotProduct(ey)
    z = pt_base.Z

    candidatos = [pt_base]

    if es_horiz:
        # Alternar lado (+dist / -dist)
        candidatos.append(XYZ(ex.Multiply(u_b).Add(ey.Multiply(w_b - 2.0 * dist_pegado)).X,
                              ex.Multiply(u_b).Add(ey.Multiply(w_b - 2.0 * dist_pegado)).Y, z))
        # Desplazamientos a lo largo del eje
        for shift_mm in [12.0, -12.0, 24.0, -24.0]:
            sh_ft = (shift_mm / 304.8) * escala
            candidatos.append(XYZ(ex.Multiply(u_b + sh_ft).Add(ey.Multiply(w_b)).X,
                                  ex.Multiply(u_b + sh_ft).Add(ey.Multiply(w_b)).Y, z))
    else:
        candidatos.append(XYZ(ex.Multiply(u_b - 2.0 * dist_pegado).Add(ey.Multiply(w_b)).X,
                              ex.Multiply(u_b - 2.0 * dist_pegado).Add(ey.Multiply(w_b)).Y, z))
        for shift_mm in [12.0, -12.0, 24.0, -24.0]:
            sh_ft = (shift_mm / 304.8) * escala
            candidatos.append(XYZ(ex.Multiply(u_b).Add(ey.Multiply(w_b + sh_ft)).X,
                                  ex.Multiply(u_b).Add(ey.Multiply(w_b + sh_ft)).Y, z))

    min_gap_mm = 10.0  # Distancia mínima entre etiquetas en espacio de papel

    for cand in candidatos:
        conflict = False
        for exist in colocados:
            if ft_a_mm_papel(cand.DistanceTo(exist)) < min_gap_mm:
                conflict = True
                break
        if not conflict:
            return cand

    return candidatos[0]


def crear_texto_etiqueta_multiflecha(v, texto, pt_texto, pts_destino, tt_id, ex):
    tn = TextNote.Create(doc, v.Id, pt_texto, texto, tt_id)
    u_texto = pt_texto.DotProduct(ex)

    for pt_dest in pts_destino:
        u_dest = pt_dest.DotProduct(ex)
        tipo = TextNoteLeaderTypes.TNLT_STRAIGHT_R if u_dest >= u_texto else TextNoteLeaderTypes.TNLT_STRAIGHT_L
        try:
            ld = tn.AddLeader(tipo)
            ld.End = pt_dest
        except Exception:
            pass
    return tn


def taggear_planta(v, sector, tt_id, mapa):
    escala = v.Scale or 1
    papel = lambda mm: float(mm) / 304.8 * escala

    rad_mm = radio_tag_mm if radio_tag_mm > 0 else 50.0
    radio_gap_ft = papel(rad_mm)
    dist_pegado = max(papel(sep_tag_mm), papel(5.0))

    if rehacer:
        for tn in FilteredElementCollector(doc, v.Id).OfClass(TextNote):
            if RE_CODIGO.match((tn.Text or '').strip()):
                try:
                    doc.Delete(tn.Id)
                except Exception:
                    pass

    rieles = [el for el in FilteredElementCollector(doc, v.Id)
              .OfCategory(BuiltInCategory.OST_ElectricalFixtures)
              .WhereElementIsNotElementType()
              if isinstance(el, FamilyInstance) and es_riel(el)]
    if not rieles:
        return 0

    ex = v.RightDirection.Normalize()
    ey = v.UpDirection.Normalize()
    z_plano = v.Origin.Z

    u0_r, u1_r, w0_r, w1_r = envolvente_de_elementos(rieles, ex, ey)
    u_mid = (u0_r + u1_r) / 2.0
    w_mid = (w0_r + w1_r) / 2.0

    rieles_info = []
    for el in rieles:
        l = largo_mm(el)
        if l and l in mapa:
            bb = el.get_BoundingBox(v) or el.get_BoundingBox(None)
            if bb:
                centro = XYZ((bb.Min.X + bb.Max.X) / 2.0, (bb.Min.Y + bb.Max.Y) / 2.0, z_plano)
                rieles_info.append((el, centro, bb, mapa[l]))

    grupos = agrupar_rieles_contiguos(rieles_info, radio_gap_ft, max_por_texto_in, ex, ey)
    puestos = 0
    textos_colocados = []

    for grupo in grupos:
        codigo = grupo[0][3]
        pts_destino = [m[1] for m in grupo]
        us = [p.DotProduct(ex) for p in pts_destino]
        ws = [p.DotProduct(ey) for p in pts_destino]

        span_u = max(us) - min(us)
        span_w = max(ws) - min(ws)
        es_horiz = span_u >= span_w

        u_centro = (min(us) + max(us)) / 2.0
        w_centro = (min(ws) + max(ws)) / 2.0

        if es_horiz:
            u_texto = u_centro
            w_texto = min(ws) - dist_pegado if w_centro > w_mid else max(ws) + dist_pegado
        else:
            w_texto = w_centro
            u_texto = min(us) - dist_pegado if u_centro > u_mid else max(us) + dist_pegado

        pt_base = ex.Multiply(u_texto).Add(ey.Multiply(w_texto))
        pt_base = XYZ(pt_base.X, pt_base.Y, z_plano)

        pt_texto = resolver_posicion_tag(pt_base, ex, ey, dist_pegado, es_horiz, textos_colocados, escala)
        textos_colocados.append(pt_texto)

        try:
            crear_texto_etiqueta_multiflecha(v, codigo, pt_texto, pts_destino, tt_id, ex)
            puestos += 1
        except Exception:
            pass

    return puestos


# --- EJECUCIÓN PRINCIPAL ---
plantas = plantas_de_sector()
if plantas:
    dim_type = tipo_de_cota(dim_type_name)
    tt_id = tipo_de_texto(tipo_texto_nombre)

    TransactionManager.Instance.EnsureInTransaction(doc)
    rieles_modelo = rieles_del_modelo()
    mapa = tabla_de_tipos(rieles_modelo)

    cotas, tags, cotas_cond = 0, 0, 0
    for v, sector in plantas:
        cotas += anotar_planta(v, sector, dim_type)
        cotas_cond += acotar_conduits(v, dim_type)
        if mapa:
            tags += taggear_planta(v, sector, tt_id, mapa)

    TransactionManager.Instance.ForceCloseTransaction()
    log.append('Cadenas de riel: {}   Cotas de largo de conduit: {}   Tags R-xx: {}'.format(
        cotas, cotas_cond, tags))
    log.append('Proceso completado: Etiquetas unificadas por tramo con multiflecha limpias.')

OUT = log
# ----------------------------------------
log = Watch(py_cotas_entre_rieles_de_suelo)
