# Dynamo graph 03_Taggear plantas y cortes.dyn (Dynamo 4.0.2.3852)
# Cadena de cotas exteriores entre los rieles RUC de suelo, en las plantas de sector: una cadena arriba, una abajo, una a la izquierda y una a la derecha, por fuera del marco de la vista.

n01_procesar_todos_los_sectores = BoolSelector(false)  # "01. Procesar TODOS los sectores"; graph input
n02_filtro_de_sectores_si_todos = StringInput("SECTOR")  # "02. Filtro de sectores (si TODOS = False)"; graph input
n03_la_familia_del_riel_empieza = StringInput("RIEL RUC")  # "03. La familia del riel EMPIEZA con"; graph input
n04_y_ademas_contiene_vacio_no = StringInput("SUELO")  # "04. ...y ademas CONTIENE (vacio = no filtra mas)"; graph input
n05_separacion_de_la_cadena_al = IntegerSlider(15, range=0..60 step 1)  # "05. Separacion de la cadena al borde del marco (mm de papel)"; graph input
n06_separacion_minima_entre_dos = IntegerSlider(2, range=0..20 step 1)  # "06. Separacion minima entre dos cotas de la cadena (mm de papel)"; graph input
n07_tipo_de_cota_vacio_el_por = StringInput("")  # "07. Tipo de cota (vacio = el por defecto)"; graph input
n08_rehacer_las_cadenas_de_riel = BoolSelector(false)  # "08. Rehacer las cadenas de riel existentes"; graph input
n09_margen_extra_del_annotation = IntegerSlider(10, range=0..60 step 1)  # "09. Margen extra del annotation crop (mm de papel)"; graph input
py_cadenas_de_cotas_entre_rieles = Python(IN[0]=n01_procesar_todos_los_sectores, IN[1]=n02_filtro_de_sectores_si_todos, IN[2]=n03_la_familia_del_riel_empieza, IN[3]=n04_y_ademas_contiene_vacio_no, IN[4]=n05_separacion_de_la_cadena_al, IN[5]=n06_separacion_minima_entre_dos, IN[6]=n07_tipo_de_cota_vacio_el_por, IN[7]=n08_rehacer_las_cadenas_de_riel, IN[8]=n09_margen_extra_del_annotation)  # "PY | Cadenas de cotas entre rieles RUC de suelo"; PythonNet3
# ---------- py_cadenas_de_cotas_entre_rieles.python (572 lines) ----------
# 03_Taggear plantas y cortes - ILUMINACION
#
# Primera anotacion del paso: CADENAS DE COTAS EXTERIORES entre los RIELES RUC DE
# SUELO, en las PLANTAS de sector. Cuatro cadenas por planta -arriba, abajo,
# izquierda y derecha-, dibujadas por fuera del marco de la vista.
#
# Revit 2027 / Dynamo 4 / CPython3
# IN[0] = procesar todos los sectores (bool)
# IN[1] = filtro de sectores si IN[0] es False (parcial, comas)
# IN[2] = la familia del riel EMPIEZA con (string, ej. RIEL RUC)
# IN[3] = y ademas CONTIENE (string, ej. SUELO; vacio = no filtra mas)
# IN[4] = separacion de la cadena respecto al borde del crop, en mm de papel
# IN[5] = separacion minima entre dos cotas de la cadena, en mm de papel
# IN[6] = nombre del tipo de cota (vacio = el tipo por defecto del documento)
# IN[7] = rehacer: borra las cadenas de riel previas de la vista y las vuelve a hacer
# IN[8] = margen extra del annotation crop mas alla de la cadena, en mm de papel
#
#
# QUE VISTAS TOCA, Y POR QUE NO HACE FALTA UN SELLO NUEVO
#
# Solo las plantas que genero 00_Vistas de sector, reconocidas por el MISMO contrato de
# nombres que ya comparten 00, 01 y 02: la planta de un sector se llama
# "<sector> - PLANTA". El modelo tiene cientos de vistas de otras disciplinas, pero
# ninguna se llama asi, y las que 00 crea se llaman asi SIEMPRE porque 00 las nombra.
# Agregar un parametro-sello ademas del nombre seria describir dos veces la misma
# pertenencia, con el riesgo de que las dos descripciones se desincronicen -el mismo
# motivo por el que 00 dejo de aislar elemento por elemento y se quedo con la caja-.
#
# Las ELEVACIONES no se tocan: los rieles se acotan en planta y nada mas.
#
#
# QUE RIELES ENTRAN
#
# Familias que EMPIEZAN con "RIEL RUC", no que lo contengan. La diferencia no es
# cosmetica: el modelo tiene 294 Electrical Fixtures con "RIEL RUC" en el nombre de
# familia, pero 77 de esas son "MORDAZA PARA RIEL RUC 42x42 PARA PERNO 3-8''", que son
# abrazaderas y no rieles. Con "contiene" se acotarian las mordazas; con "empieza",
# no, y siguen entrando "RIEL RUC 01", "RIEL RUC GALVANIZADO" o "RIEL RUC NUEVO".
#
# Ademas, solo las de SUELO (IN[3]). Las de muro son otra cosa: "RIEL RUC GALVANIZADO
# MURO VERT." en planta es un cuadradito de 42x42 sin direccion util, y mezclarla en
# una cadena con rieles de suelo daria una cota que no significa nada.
#
# Los rieles se recolectan CONTRA LA VISTA -FilteredElementCollector(doc, v.Id)-, no
# contra el documento. Con eso el crop, el view range y lo que este oculto ya deciden
# que rieles pertenecen al sector, sin volver a describir la caja. Importa mas de lo
# que parece: los rieles de suelo de este modelo van de Z=0,5 m a Z=4,0 m, asi que
# "los del sector" NO es una propiedad del riel sino de que planta lo mira.
#
#
# COMO SE REPARTE CADA RIEL A SU CADENA: LA ORIENTACION ELIGE EL EJE, LA POSICION EL LADO
#
# Un riel se acota SIEMPRE perpendicular a su propio eje, que es lo normal en dibujo:
# un riel de 1000 mm no se localiza por el punto medio de su propio largo, se localiza
# por donde pasa su eje. Entonces:
#
#   riel que corre horizontal en la planta  -> se mide su Y -> cadena IZQUIERDA o DERECHA
#   riel que corre vertical   en la planta  -> se mide su X -> cadena ARRIBA o ABAJO
#
# Elegido el PAR de cadenas, la POSICION elige cual de las dos: la mas cercana. Para un
# riel horizontal, izquierda o derecha segun de que lado del centro del crop caiga; para
# uno vertical, arriba o abajo. Ese corte por el centro es exactamente la frontera entre
# los dos triangulos opuestos del reparto en diagonal, y es lo que evita el problema que
# motivo todo esto: que la cadena de la derecha se lleve elementos del lado izquierdo.
#
# Los ejes NO son X e Y del modelo sino RightDirection y UpDirection de la vista, asi
# que una planta rotada se comporta igual.
#
#
# CONTRA QUE SE ACOTA: EL PLANO DE EJE DE LA FAMILIA, NO SUS CARAS
#
# Eje a eje, siempre. Una Dimension necesita un Reference, no un punto, asi que el eje
# del riel tiene que existir como referencia de Revit: son los planos "Center
# (Left/Right)" y "Center (Front/Back)" que trae toda familia, vistos con
# FamilyInstance.GetReferences(FamilyInstanceReferenceType...).
#
# Cual de los dos se usa depende de en que direccion se mide, y eso se decide con la
# TRANSFORMADA DE LA INSTANCIA y no resolviendo la geometria de la referencia: la normal
# del plano Center (Left/Right) es el BasisX de la instancia, y la del Center
# (Front/Back) es su BasisY. Comparar esas dos normales contra el eje de medida es una
# cuenta exacta y barata; pedirle a Revit el GeometryObject de una referencia de plano
# es fragil y a veces devuelve nada.
#
# NO se acota contra las caras del solido. En T003 se intento y quedo documentado que
# Revit DESCARTA esas referencias al comitear: la cota se crea sin error y desaparece.
#
# Si una familia de riel no tiene sus planos de eje marcados como referencia, este graph
# NO inventa un plan B silencioso: salta ese riel y lo dice en el log con nombre y
# ElementId. Un plan B posible seria dibujar detail lines y acotar contra ellas, pero eso
# da cotas NO ASOCIATIVAS -si alguien mueve el riel la cota miente-, y una cota que
# miente es peor que una cota que falta.
#
#
# LAS DOS TRAMPAS QUE HACEN QUE UNA COTA SE CREE Y NO SE VEA
#
# 1. EL ANNOTATION CROP. La cadena va por fuera del marco, y el annotation crop recorta
#    todo lo que no entre en el. Una cota fuera de el se crea sin error y no se dibuja
#    -la misma trampa ya documentada en T003 para las categorias apagadas-. Por eso, si
#    la vista tiene el annotation crop activo, se agrandan sus cuatro offsets hasta pasar
#    la cadena. Si esta apagado no se toca nada: apagado no recorta, no hay que "arreglar"
#    lo que ya funciona.
#
# 2. EL PARALELISMO ENTRE REFERENCIAS. Revit exige que TODAS las referencias de una
#    cadena sean paralelas ENTRE SI, con un criterio muchisimo mas estricto que
#    Application.AngularTolerance. Un solo riel torcido no da una cota fea: hace fallar la
#    cadena COMPLETA. Por eso, igual que alinear_grupo() en T003, se calcula la direccion
#    dominante del grupo y se descartan los desviados, contandolos en el log. El desvio se
#    mide con el producto CRUZ y no el escalar porque cerca del paralelismo el coseno
#    pierde toda la precision, mientras que el seno vale el angulo.
#
#
# RIELES APILADOS
#
# Hay rieles con IDENTICA posicion en planta y distinto Z -por ejemplo 6721757 y 6721758,
# mismo X e Y, uno a 2519 mm y otro a 2019 mm-. En planta son el mismo punto y entre
# ellos saldria una cota de valor cero. La cadena los FUSIONA cuando quedan mas cerca que
# IN[5] y avisa cuantos fusiono; el log va a mostrar bastantes fusiones y es lo esperado.

import clr
import math
clr.AddReference('RevitAPI')
clr.AddReference('RevitServices')
from Autodesk.Revit.DB import (FilteredElementCollector, ViewPlan, XYZ, Line,
                               ReferenceArray, Dimension, DimensionType, Element,
                               BuiltInCategory, BuiltInParameter,
                               FamilyInstance, FamilyInstanceReferenceType)
from RevitServices.Persistence import DocumentManager
from RevitServices.Transactions import TransactionManager

doc = DocumentManager.Instance.CurrentDBDocument

process_all = bool(IN[0])
filter_text = (IN[1] or '').strip()
fam_prefijo = (IN[2] or '').strip()
fam_contiene = (IN[3] or '').strip()
off_mm = float(IN[4])
sep_min_mm = float(IN[5])
dim_type_name = (IN[6] or '').strip()
rehacer = bool(IN[7])
annot_extra_mm = float(IN[8])

log = []

# --- contrato de nombres con 00_Vistas de sector ---
SUF_PLANTA = ' - PLANTA'

# Tolerancia de paralelismo entre referencias de una misma cadena, medida como SENO del
# angulo. 1e-6 son unas 0.00006 grados: mucho mas fino que cualquier desalineacion que un
# modelador vea a ojo, y aun asi holgado frente a los rieles bien colocados, que coinciden
# entre si al orden de 1e-15. Lo que cae afuera esta genuinamente torcido.
TOL_PARALELO = 1e-6

# Cuanto tiene que separar la normal del plano de eje respecto del eje de medida para
# considerar que ese plano NO sirve para esta cadena.
TOL_NORMAL = 1e-3

LADOS = ('arriba', 'abajo', 'izquierda', 'derecha')


def elem_name(e):
    try:
        return Element.Name.GetValue(e)
    except Exception:
        try:
            return e.Name
        except Exception:
            return ''


def coincide(nombre, texto):
    # filtro parcial separado por comas, insensible a mayusculas. Mismo criterio que
    # usan 00, 01 y 02 para elegir sectores.
    if not texto:
        return True
    alto = (nombre or '').upper()
    for t in texto.split(','):
        t = t.strip().upper()
        if t and t in alto:
            return True
    return False


def fam_name(el):
    try:
        return el.Symbol.Family.Name or ''
    except Exception:
        return ''


def es_riel(el):
    f = fam_name(el).upper()
    if not f:
        return False
    if fam_prefijo and not f.startswith(fam_prefijo.upper()):
        return False
    if fam_contiene and fam_contiene.upper() not in f:
        return False
    return True


def plantas_de_sector():
    # Las vistas que creo 00, reconocidas por el sufijo del contrato de nombres.
    res = []
    for v in FilteredElementCollector(doc).OfClass(ViewPlan):
        if v.IsTemplate:
            continue
        n = elem_name(v)
        if not n.endswith(SUF_PLANTA):
            continue
        sector = n[:-len(SUF_PLANTA)]
        if not process_all and not coincide(sector, filter_text):
            continue
        res.append((v, sector))
    res.sort(key=lambda p: p[1])
    return res


def rectangulo_de_crop(v, ex, ey):
    # Extremos del crop proyectados sobre los ejes de la VISTA. Se toman las cuatro
    # esquinas y se transforman a modelo en vez de leer Min/Max directo, porque el
    # CropBox vive en el sistema de su propia Transform y no en el del modelo.
    cb = v.CropBox
    t = cb.Transform
    us = []
    ws = []
    for x in (cb.Min.X, cb.Max.X):
        for y in (cb.Min.Y, cb.Max.Y):
            p = t.OfPoint(XYZ(x, y, 0.0))
            us.append(p.DotProduct(ex))
            ws.append(p.DotProduct(ey))
    return min(us), max(us), min(ws), max(ws)


def extremos_en_ejes(el, ex, ey):
    # Proyeccion del bbox del riel sobre los dos ejes de la vista. El bbox viene en
    # coordenadas de modelo y se proyectan sus 8 vertices, que es exacto mientras el riel
    # este alineado con los ejes del proyecto -que es el caso de todos los RIEL RUC de
    # este modelo- y conservador si no lo estuviera.
    bb = el.get_BoundingBox(None)
    if bb is None:
        return None
    us = []
    ws = []
    for x in (bb.Min.X, bb.Max.X):
        for y in (bb.Min.Y, bb.Max.Y):
            for z in (bb.Min.Z, bb.Max.Z):
                p = XYZ(x, y, z)
                us.append(p.DotProduct(ex))
                ws.append(p.DotProduct(ey))
    return min(us), max(us), min(ws), max(ws)


def referencia_de_eje(inst, eje_medida):
    # El plano de eje de la familia cuya NORMAL es paralela al eje de medida. Devuelve
    # (Reference, normal) o (None, None).
    try:
        tr = inst.GetTransform()
    except Exception:
        return None, None
    candidatos = ((FamilyInstanceReferenceType.CenterLeftRight, tr.BasisX),
                  (FamilyInstanceReferenceType.CenterFrontBack, tr.BasisY))
    for tipo, normal in candidatos:
        try:
            n = normal.Normalize()
        except Exception:
            continue
        if abs(abs(n.DotProduct(eje_medida)) - 1.0) > TOL_NORMAL:
            continue
        try:
            refs = list(inst.GetReferences(tipo))
        except Exception:
            refs = []
        if refs:
            return refs[0], n
    return None, None


def desvio(d, dom):
    # seno del angulo entre dos direcciones unitarias en planta. Producto CRUZ y no
    # escalar: cerca del paralelismo el coseno pierde toda la precision.
    return abs(d.X * dom.Y - d.Y * dom.X)


def canonica(n):
    # Un plano no tiene "sentido": su normal y la opuesta describen el mismo plano. Para
    # poder comparar normales hay que elegir siempre el mismo representante de cada par.
    #
    # El umbral NO puede ser cero. Dos rieles paralelos al eje Y tienen normal (0, 1, 0)
    # nominal, pero en doubles reales una sale (+1e-17, 1, 0) y la otra (-1e-17, 1, 0);
    # con "n.X > 0" la primera se conserva y la segunda se invierte a (1e-17, -1, 0), o
    # sea la MISMA direccion clasificada como opuesta. Terminan en cubetas distintas y la
    # cadena se parte en dos por un error de redondeo. Con la banda muerta, cuando X es
    # ruido decide el signo de Y, que ahi si vale 1.
    if n.X > 1e-12:
        return n
    if n.X < -1e-12:
        return n.Negate()
    return n if n.Y >= 0 else n.Negate()


def alinear(items):
    # Deja solo las referencias paralelas a la normal dominante del grupo. El corte es a
    # TOL_PARALELO/2 y no a TOL_PARALELO a proposito: la condicion que le importa a Revit
    # es entre CADA PAR de referencias, no contra un promedio. Dos rieles desviados +tol y
    # -tol pasarian los dos y estarian 2*tol uno de otro; con medio umbral, cualquier par
    # queda dentro de TOL_PARALELO.
    if not items:
        return [], 0, 0.0
    cubetas = {}
    for it in items:
        d = canonica(it[3])
        k = int(round(math.atan2(d.Y, d.X) / TOL_PARALELO))
        acc = cubetas.get(k)
        if acc is None:
            cubetas[k] = [1, d]
        else:
            acc[0] += 1
    dom = max(cubetas.values(), key=lambda a: a[0])[1]
    ok = []
    fuera = 0
    peor = 0.0
    for it in items:
        s = desvio(canonica(it[3]), dom)
        if s <= TOL_PARALELO / 2.0:
            ok.append(it)
        else:
            fuera += 1
            if s > peor:
                peor = s
    return ok, fuera, peor


def tipo_de_cota(nombre):
    if not nombre:
        return None
    for dt in FilteredElementCollector(doc).OfClass(DimensionType):
        if elem_name(dt) == nombre:
            return dt
    return None


def cadenas_de_riel_existentes(v, ex, ey, u0, u1, w0, w1):
    # Que cadenas de riel ya tiene la vista, y con que Dimension. Se reconoce por LA
    # REFERENCIA: si la primera referencia de la cota apunta a un riel, la cota es de este
    # graph. Con eso se puede convivir con las cotas que ponga cualquier otro paso o
    # cualquier persona a mano, sin pisarlas ni contarlas.
    res = {}
    for dim in FilteredElementCollector(doc, v.Id).OfClass(Dimension):
        try:
            primera = None
            for ref in dim.References:
                primera = ref
                break
            if primera is None:
                continue
            el = doc.GetElement(primera.ElementId)
            if el is None or not isinstance(el, FamilyInstance) or not es_riel(el):
                continue
            c = dim.Curve
            p = c.Evaluate(0.5, True)
            u = p.DotProduct(ex)
            w = p.DotProduct(ey)
            d = c.Direction
            if abs(d.DotProduct(ey)) < abs(d.DotProduct(ex)):
                lado = 'arriba' if w > w1 else ('abajo' if w < w0 else None)
            else:
                lado = 'derecha' if u > u1 else ('izquierda' if u < u0 else None)
            if lado:
                res.setdefault(lado, []).append(dim.Id)
        except Exception:
            pass
    return res


def dibujar_cadena(v, items, eje_medida, eje_perp, valor_perp, sector, etiqueta,
                   sep_min, z_plano, dim_type):
    # items = [(posicion sobre eje_medida, Reference, nombre, normal)]. La linea de cota
    # corre a lo largo de eje_medida y se dibuja a "valor_perp" sobre eje_perp, ya
    # desplazada por fuera del borde del crop. Los dos ejes son unitarios, perpendiculares
    # entre si y horizontales, asi que generan el plano de la planta.
    if len(items) < 2:
        log.append('AVISO {}: menos de 2 rieles para la cadena {}; no se acota.'.format(
            sector, etiqueta))
        return 0
    items, fuera, peor = alinear(items)
    if fuera:
        log.append('AVISO {}: cadena {}, {} riel(es) descartados por no ser paralelos al '
                   'grupo (peor desvio {:.2e} rad). Con ellos adentro Revit rechazaria la '
                   'cadena entera.'.format(sector, etiqueta, fuera, peor))
    if len(items) < 2:
        log.append('AVISO {}: cadena {} sin referencias suficientes tras alinear.'.format(
            sector, etiqueta))
        return 0
    items.sort(key=lambda it: it[0])
    filtrados = []
    ultimo = None
    for it in items:
        if ultimo is None or it[0] - ultimo > sep_min:
            filtrados.append(it)
            ultimo = it[0]
    fusionadas = len(items) - len(filtrados)
    if len(filtrados) < 2:
        log.append('AVISO {}: los rieles de la cadena {} caen todos en el mismo punto de '
                   'planta; no se acota.'.format(sector, etiqueta))
        return 0
    ra = ReferenceArray()
    for it in filtrados:
        ra.Append(it[1])

    def punto(pos, perp):
        p = eje_medida.Multiply(pos).Add(eje_perp.Multiply(perp))
        return XYZ(p.X, p.Y, z_plano)

    p1 = punto(filtrados[0][0], valor_perp)
    p2 = punto(filtrados[-1][0], valor_perp)
    if p1.DistanceTo(p2) < 1e-6:
        log.append('AVISO {}: la cadena {} quedaria de largo cero.'.format(sector, etiqueta))
        return 0
    try:
        if dim_type is not None:
            dim = doc.Create.NewDimension(v, Line.CreateBound(p1, p2), ra, dim_type)
        else:
            dim = doc.Create.NewDimension(v, Line.CreateBound(p1, p2), ra)
    except Exception as e:
        log.append('AVISO {}: Revit rechazo la cadena {}: {}'.format(sector, etiqueta, e))
        return 0
    menor = min(filtrados[i + 1][0] - filtrados[i][0] for i in range(len(filtrados) - 1))
    log.append('OK {}: cadena {} con {} rieles, largo {:.2f} m, menor tramo {:.0f} mm{}.'.format(
        sector, etiqueta, len(filtrados), p1.DistanceTo(p2) * 0.3048, menor * 304.8,
        ', {} fusionados por caer en el mismo punto'.format(fusionadas) if fusionadas else ''))
    return 1


def ajustar_annotation_crop(v, extra, sector):
    # Solo si el annotation crop esta ACTIVO. Apagado no recorta nada y no hay que tocarlo.
    p = v.get_Parameter(BuiltInParameter.VIEWER_ANNOTATION_CROP_ACTIVE)
    if p is None or p.AsInteger() == 0:
        return
    try:
        m = v.GetCropRegionShapeManager()
        for attr in ('LeftAnnotationCropOffset', 'RightAnnotationCropOffset',
                     'TopAnnotationCropOffset', 'BottomAnnotationCropOffset'):
            if getattr(m, attr) < extra:
                setattr(m, attr, extra)
    except Exception as e:
        log.append('AVISO {}: no se pudo agrandar el annotation crop ({}). Si las cotas no '
                   'se ven, apagalo a mano en la vista.'.format(sector, e))


def anotar_planta(v, sector, dim_type):
    escala = v.Scale or 1

    def papel(mm):
        return float(mm) / 304.8 * escala

    off = papel(off_mm)
    sep_min = papel(sep_min_mm)

    if not v.CropBoxActive:
        log.append('AVISO {}: la planta no tiene el crop activo, asi que no hay marco por '
                   'fuera del cual dibujar. Se salta.'.format(sector))
        return 0

    ex = v.RightDirection.Normalize()
    ey = v.UpDirection.Normalize()
    u0, u1, w0, w1 = rectangulo_de_crop(v, ex, ey)
    u_mid = (u0 + u1) / 2.0
    w_mid = (w0 + w1) / 2.0
    z_plano = v.Origin.Z

    ya = cadenas_de_riel_existentes(v, ex, ey, u0, u1, w0, w1)
    if ya and not rehacer:
        log.append('{}: ya tiene cadena de rieles ({}), se salta. Corre con rehacer para '
                   'volver a hacerlas.'.format(sector, ', '.join(sorted(ya.keys()))))
        return 0
    if ya and rehacer:
        borradas = 0
        for lado in ya:
            for did in ya[lado]:
                try:
                    doc.Delete(did)
                    borradas += 1
                except Exception:
                    pass
        log.append('{}: rehacer, se borraron {} cadena(s) de riel previas.'.format(
            sector, borradas))

    rieles = [el for el in FilteredElementCollector(doc, v.Id)
              .OfCategory(BuiltInCategory.OST_ElectricalFixtures)
              .WhereElementIsNotElementType()
              if isinstance(el, FamilyInstance) and es_riel(el)]
    if not rieles:
        log.append('{}: no hay rieles visibles en la planta.'.format(sector))
        return 0

    grupos = dict((lado, []) for lado in LADOS)
    sin_ref = []
    sin_orientacion = 0
    for el in rieles:
        ext = extremos_en_ejes(el, ex, ey)
        if ext is None:
            continue
        au0, au1, aw0, aw1 = ext
        span_u = au1 - au0
        span_w = aw1 - aw0
        uc = (au0 + au1) / 2.0
        wc = (aw0 + aw1) / 2.0
        # El riel tiene que ser claramente mas largo en un eje que en el otro: si es casi
        # cuadrado en planta no tiene direccion y no hay un "eje" que acotar.
        if max(span_u, span_w) < 1.2 * min(span_u, span_w):
            sin_orientacion += 1
            continue
        if span_u > span_w:
            # corre horizontal -> se mide su posicion sobre ey -> cadena vertical
            lado = 'izquierda' if uc < u_mid else 'derecha'
            eje_medida, pos = ey, wc
        else:
            # corre vertical -> se mide su posicion sobre ex -> cadena horizontal
            lado = 'abajo' if wc < w_mid else 'arriba'
            eje_medida, pos = ex, uc
        ref, normal = referencia_de_eje(el, eje_medida)
        if ref is None:
            sin_ref.append(el)
            continue
        grupos[lado].append((pos, ref, elem_name(el), normal))

    if sin_orientacion:
        log.append('{}: {} riel(es) casi cuadrados en planta, sin eje que acotar; se '
                   'omiten.'.format(sector, sin_orientacion))
    if sin_ref:
        familias = sorted(set(fam_name(e) for e in sin_ref))
        log.append('AVISO {}: {} riel(es) sin plano de eje utilizable como referencia; se '
                   'omiten. Familias: {}. Ejemplo de ElementId: {}. Hay que marcar como '
                   '"Is Reference" los planos Center (Left/Right) y Center (Front/Back) de '
                   'esas familias.'.format(sector, len(sin_ref), ', '.join(familias),
                                           sin_ref[0].Id))

    n = 0
    n += dibujar_cadena(v, grupos['arriba'], ex, ey, w1 + off, sector, 'arriba',
                        sep_min, z_plano, dim_type)
    n += dibujar_cadena(v, grupos['abajo'], ex, ey, w0 - off, sector, 'abajo',
                        sep_min, z_plano, dim_type)
    n += dibujar_cadena(v, grupos['izquierda'], ey, ex, u0 - off, sector, 'izquierda',
                        sep_min, z_plano, dim_type)
    n += dibujar_cadena(v, grupos['derecha'], ey, ex, u1 + off, sector, 'derecha',
                        sep_min, z_plano, dim_type)
    if n:
        ajustar_annotation_crop(v, off + papel(annot_extra_mm), sector)
    return n


plantas = plantas_de_sector()
if not plantas:
    log.append('No hay plantas de sector que coincidan con el filtro. Se esperan vistas '
               'llamadas "<sector>{}", creadas por 00_Vistas de sector.'.format(SUF_PLANTA))
else:
    dim_type = tipo_de_cota(dim_type_name)
    if dim_type_name and dim_type is None:
        log.append('AVISO: no existe el tipo de cota "{}"; se usa el tipo por defecto.'.format(
            dim_type_name))
    TransactionManager.Instance.EnsureInTransaction(doc)
    total = 0
    for v, sector in plantas:
        try:
            total += anotar_planta(v, sector, dim_type)
        except Exception as e:
            log.append('ERROR {}: {}'.format(sector, e))
    TransactionManager.Instance.ForceCloseTransaction()
    log.insert(0, '{} cadena(s) de cotas en {} planta(s) de sector.'.format(
        total, len(plantas)))

OUT = log
# ----------------------------------------
log = Watch(py_cadenas_de_cotas_entre_rieles)
