# Dynamo graph 04_Rieles RUC - tabla de tipos.dyn (Dynamo 4.0.2.3852)
# La TABLA N.1 de tipos de riel RUC, una por lamina de sector.

n01_procesar_todos_los_sectores = BoolSelector(false)  # "01. Procesar TODOS los sectores"; graph input
n02_filtro_de_sectores_si_todos = StringInput("SECTOR A")  # "02. Filtro de sectores (si TODOS = False)"; graph input
n03_la_familia_del_riel_empieza = StringInput("RIEL RUC")  # "03. La familia del riel EMPIEZA con"; graph input
n04_parametro_de_donde_se_lee_el = StringInput("Longitud")  # "04. Parametro de donde se LEE el largo del riel"; graph input
n05_parametro_numerico_donde_se = StringInput("LARGO_TBL")  # "05. Parametro numerico donde se COPIA el largo (se crea si no existe)"; graph input
n06_parametro_donde_se_escribe_el = StringInput("TEXTO PARA TAG")  # "06. Parametro donde se escribe el codigo de tipo"; graph input
n07_parametro_donde_se_marca_el = StringInput("En plano")  # "07. Parametro donde se marca el sector"; graph input
n08_parametro_del_item_se_crea = StringInput("ITEM_TBL")  # "08. Parametro del ITEM (se crea solo; vacio = sin esa columna)"; graph input
n09_titulo_de_la_tabla = StringInput("TABLA N°1 (NOTA 9)")  # "09. Titulo de la tabla"; graph input
n10_margen_de_la_lamina_mm_el = IntegerSlider(5, range=0..60 step 1)  # "10. Margen de la lamina (mm) - el mismo que 01 y 02"; graph input
n11_franja_inferior_reservada_de = IntegerSlider(55, range=0..200 step 1)  # "11. Franja inferior reservada de la vineta (mm)"; graph input
n12_ancho_del_cajetin_desde_el = IntegerSlider(290, range=0..600 step 1)  # "12. Ancho del cajetin desde el borde derecho (mm)"; graph input
n13_alto_del_cajetin_mm = IntegerSlider(105, range=0..400 step 1)  # "13. Alto del cajetin (mm)"; graph input
n14_esquina_desde_donde_buscar = StringInput("abajo-derecha")  # "14. Esquina desde donde buscar hueco"; graph input
n15_rehacer_las_tablas_existentes = BoolSelector(false)  # "15. Rehacer las tablas existentes"; graph input
py_tabla_de_tipos_de_riel_por = Python(IN[0]=n01_procesar_todos_los_sectores, IN[1]=n02_filtro_de_sectores_si_todos, IN[2]=n03_la_familia_del_riel_empieza, IN[3]=n04_parametro_de_donde_se_lee_el, IN[4]=n05_parametro_numerico_donde_se, IN[5]=n06_parametro_donde_se_escribe_el, IN[6]=n07_parametro_donde_se_marca_el, IN[7]=n08_parametro_del_item_se_crea, IN[8]=n09_titulo_de_la_tabla, IN[9]=n10_margen_de_la_lamina_mm_el, IN[10]=n11_franja_inferior_reservada_de, IN[11]=n12_ancho_del_cajetin_desde_el, IN[12]=n13_alto_del_cajetin_mm, IN[13]=n14_esquina_desde_donde_buscar, IN[14]=n15_rehacer_las_tablas_existentes)  # "PY | Tabla de tipos de riel por lamina"; PythonNet3
# ---------- py_tabla_de_tipos_de_riel_por.python (1068 lines) ----------
# 04_Rieles RUC - tabla de tipos - ILUMINACION
#
# Estampa la TABLA N.1 -la tabla de tipos de RIEL RUC- en las laminas de sector, una por
# lamina, con las filas de los tipos que aparecen EN ESA LAMINA.
#
#   +-------------------------------------+
#   |        TABLA N.1 (NOTA 9)           |
#   +--------+----------+-----------------+
#   |  ITEM  |   TIPO   |   LARGO (mm)    |
#   +--------+----------+-----------------+
#   |    1   |   R-01   |       100       |
#   |   25   |   R-25   |       250       |
#   |    3   |   R-03   |       300       |
#   +--------+----------+-----------------+
#
# Revit 2027 / Dynamo 4 / CPython3
# IN[0]  = procesar todos los sectores (bool)
# IN[1]  = filtro de sectores si IN[0] es False (parcial, comas)
# IN[2]  = la familia del riel EMPIEZA con (string, ej. RIEL RUC)
# IN[3]  = parametro de donde se LEE el largo del riel (string, ej. Longitud)
# IN[4]  = parametro numerico donde se COPIA el largo para que el schedule pueda usarlo
#          (string, ej. LARGO_TBL); lo crea este paso si no existe
# IN[5]  = parametro donde se escribe el codigo de tipo (string, ej. TEXTO PARA TAG)
# IN[6]  = parametro donde se marca en que sector aparece (string, ej. En plano)
# IN[7]  = parametro donde se escribe el ITEM (string, ej. ITEM_TBL; lo crea este paso si
#          no existe. Vacio = tabla sin columna ITEM)
# IN[8]  = titulo de la tabla (string)
# IN[9]  = margen de la lamina, en mm - el mismo que usan 01 y 02
# IN[10] = alto de la franja inferior reservada de la vineta, en mm
# IN[11] = ancho del cajetin medido desde el borde derecho, en mm
# IN[12] = alto del cajetin medido desde el borde inferior, en mm
# IN[13] = esquina por la que se empieza a buscar hueco (abajo-derecha, abajo-izquierda,
#          arriba-derecha, arriba-izquierda)
# IN[14] = rehacer: reconfigura las tablas existentes y las vuelve a colocar, y reubica
#          las leyendas que ya estan en la lamina
#
#
# QUE HACE HOY Y QUE NO
#
# Solo la tabla de rieles RUC. Este paso y 03 son los DOS PASOS DEL RIEL: todo lo que hacen
# sale del parametro Longitud de un riel, y en una lamina sin rieles no harian nada.
#
# Se llamo un tiempo "TABLAS y Listados" y ademas de la tabla estampaba las leyendas de la
# hoja y el bloque de notas generales. Eso no habla de rieles -estaria igual en una lamina
# sin uno solo- y se fue a 05_Leyendas y notas. Lo que quedaba era un paso con tres temas que
# no se tocaban entre si y diecinueve inputs.
#
# Antes de eso reemplazo por completo a "04_Tabla de materiales", la tabla de acero heredada
# de T003, que no se adapto sino que se tiro. Esta en el historial de git.
#
#
# QUE LAMINAS TOCA
#
# Las que tienen vistas del pipeline, reconocidas por el MISMO contrato de nombres que
# comparten 00, 01, 02 y 03: "<sector> - PLANTA" y "<sector> - ELEV X". No hay parametro
# sello ni lista de laminas que mantener: si una lamina tiene una vista de sector, es del
# pipeline. Vale ademas la regla de aislamiento que fija 01 -cada lamina lleva vistas de UN
# SOLO sector-, asi que "el sector de esta lamina" nunca es ambiguo.
#
#
# QUE FILAS LLEVA CADA TABLA, Y POR QUE NO ES LA MISMA EN TODAS LAS LAMINAS
#
# Las de los tipos que se ven en LAS VISTAS DE ESA LAMINA, no las del sector entero. Un
# sector puede ocupar varias laminas, y una tabla que liste tipos que no estan dibujados en
# la hoja que uno tiene delante obliga a buscarlos en otra hoja: es informacion equivocada,
# no informacion de mas.
#
# "Se ve en la lamina" es la union de lo que se ve en cada viewport: la planta y las cuatro
# elevaciones. No solo la planta, porque cuando un sector se derrama a una segunda lamina
# esa lamina puede llevar solo elevaciones, y su tabla tiene que decir algo igual.
#
#
# EL CODIGO R-xx: EL LARGO, NO UNA POSICION
#
# El numero del codigo ES el largo en mm con los ceros sobrantes sacados, sin bajar de los
# cientos: 100 -> R-01, 200 -> R-02, 250 -> R-25, 240 -> R-24, 241 -> R-241, 1000 -> R-10.
# El largo sale del parametro de instancia de IN[3], redondeado al milimetro entero.
#
# Hasta el 2026-08-18 el numero era la POSICION del largo en la lista ordenada de todos los
# largos del modelo. Se cambio por dos motivos, y ninguno es comodidad:
#
# 1. La posicion no es estable. Borrar o agregar un largo corria a todos los de arriba, asi
#    que un plano ya emitido dejaba de coincidir con el modelo sin que nadie lo notara. Paso
#    de verdad: al corregir un riel de 108 mm que en realidad era un 100, desaparecio un
#    codigo y todo lo que estaba encima se desplazo.
#
# 2. La posicion depende del CONJUNTO. Como el numero salia de la lista completa, cualquier
#    diferencia entre lo que recolectaba 03 y lo que recolectaba 04 desplazaba la numeracion
#    entera, en silencio. Ahora el codigo de un riel depende SOLO DE ESE RIEL: los dos pasos
#    no pueden discrepar ni queriendo, y no hace falta correrlos en ningun orden.
#
# El regalo: un riel mal modelado se delata. El 108 salia R-02, indistinguible de un tipo
# legitimo, y se encontro de casualidad. Con esta regla sale R-108, y un codigo que no es una
# medida redonda canta solo en el plano. Es una herramienta de revision, no solo una etiqueta.
#
# LO QUE LA REGLA NO PUEDE HACER: distinguir X de X*10. 50 y 500 dan los dos R-05; 60 y 600,
# R-06; 250 y 2500, R-25. Es inherente a sacar ceros, no un descuido de la implementacion, y
# no es teorico: el modelo ya tiene 500, 600, 700 y 900, asi que un riel corto de 50 o 60 mm
# chocaria. Por eso tabla_de_tipos compara y escribe un ERROR en el log con los dos largos.
# Sin ese aviso, dos tipos distintos compartirian codigo en el plano y en la tabla sin que
# nada fallara.
#
# La regla sigue escrita en 03 y en 04 -se recalcula aca para que este paso funcione solo, sin
# depender de si 03 corrio ni en que orden-, pero ya no es la deuda que era: al ser una
# funcion de un solo largo, dos implementaciones que se separen dan distinto solo si alguien
# cambia la formula, no por el estado del modelo.
#
#
# POR QUE HAY DOS PARAMETROS DE LARGO
#
# Porque el largo de verdad no se puede poner en un schedule. "Longitud" es un parametro
# DE FAMILIA de las familias de riel -no es compartido ni de proyecto-, y Revit no ofrece
# los parametros de familia como campos de schedule: no aparecen en la lista y no hay API
# que los agregue. Se comprueba en un minuto y conviene saberlo antes de disenar nada:
# una MORDAZA, que es otra familia de la misma categoria, NO tiene "Longitud", mientras que
# "En plano" si aparece en la mordaza y hasta en las vistas, que es la firma de un
# parametro de PROYECTO.
#
# Asi que el largo se lee de "Longitud" (IN[3]) y se COPIA a un parametro numerico de
# proyecto (IN[4]) que si es schedulable, y la columna LARGO imprime esa copia. Si ese
# parametro no existe en el modelo, el graph lo crea -parametro compartido con un GUID
# derivado de su nombre, para que sea el mismo en todos los modelos de la oficina, y
# vinculado como parametro de instancia de Electrical Fixtures-. Es la misma maquinaria
# que usaba la tabla de acero de T003 por el mismo motivo.
#
# El valor copiado son MILIMETROS como numero pelado, no una longitud de Revit. Un
# parametro de tipo Number no convierte unidades, asi que 100 se guarda 100 y se imprime
# 100, sin depender de si el proyecto trabaja en metros o en pies.
#
# La copia es un dato derivado, y los datos derivados se desactualizan: si alguien cambia
# el largo de un riel, la columna miente hasta que se vuelva a correr este paso. No hay
# manera de evitarlo con un schedule nativo -esa es la parte del trato-.
#
#
# COMO SABE UN SCHEDULE QUE RIELES SON DE SU SECTOR
#
# No lo sabe: un schedule de Revit no puede filtrar por "esta dibujado en tal lamina". Hay
# que decirselo con un dato del modelo, y ese dato es el parametro de IN[6] -por defecto
# "En plano", que las familias de riel ya traen vacio-. El graph escribe ahi el SECTOR donde
# el riel aparece, y el schedule filtra por "contiene".
#
# El valor va con punto y coma alrededor -";SECTOR A;"- y el filtro busca ";SECTOR A;" y no
# "SECTOR A". Sin los delimitadores, SECTOR A se llevaria tambien los rieles de SECTOR A2,
# que es el clasico error de filtrar nombres por substring.
#
# El campo del filtro se agrega OCULTO al schedule: hace falta que este entre los campos
# para poder filtrar por el, pero no tiene que salir impreso en la tabla.
#
#
# LO QUE HAY QUE MIRAR EN EL PRIMER RUN: SI LAS FILAS COLAPSAN
#
# La tabla tiene que mostrar una fila POR TIPO, no una por riel, y eso se consigue apagando
# "Itemize every instance". Revit colapsa las filas que tienen todos los campos iguales, y
# el campo oculto del filtro NO es igual entre rieles -uno puede estar en ";A1;" y otro en
# ";A1;A2;"-. Si Revit resultara considerar tambien los campos ocultos para colapsar, la
# tabla saldria con una fila por riel.
#
# En vez de afirmar que funciona, el graph se fija y lo dice: compara las filas que quedaron
# en el cuerpo del schedule contra la cantidad de tipos distintos que le corresponden a esa
# lamina, y si no coinciden lo avisa en el log con las dos cifras. Si aparece ese aviso, la
# salida es dejar de filtrar por parametro y dibujar la tabla con lineas y textos, que da
# control total a cambio de que no quede viva.
#
#
# LA COLUMNA ITEM: SU NOMBRE ES DE LA TABLA, SU NUMERO ES EL DEL CODIGO
#
# La columna se llama ITEM -asi esta en el plano tipo- pero el parametro donde vive NO se
# llama asi: es ITEM_TBL, y lo crea este paso. Son dos cosas distintas y conviene no
# confundirlas, porque confundirlas ya costo una corrida:
#
#   - El ENCABEZADO de la columna es texto de la tabla (H_ITEM) y dice ITEM.
#   - El PARAMETRO es de los rieles, y su nombre solo importa para que el schedule lo
#     encuentre.
#
# El 2026-08-19 el parametro "ITEM" del proyecto paso a llamarse NUM_CIRCUITO -que es un
# campo de datos electricos de verdad, vive al lado de E_Alimentado_Desde- y la tabla dejo de
# armarse. Por eso ahora el parametro lo crea el graph, igual que LARGO_TBL: un dato que es
# de la tabla tiene que vivir con la tabla y no tomarse prestado del proyecto.
#
#
# POR QUE EL NUMERO NO ES UN CORRELATIVO DE FILA
#
# Seria lo natural -1, 2, 3, 4 hacia abajo, como el plano tipo- y no se puede con un
# ViewSchedule. Por dos motivos, no uno:
#
#   1. Un schedule no tiene campo "numero de fila". La columna tiene que ser un parametro de
#      los rieles, y un riel que sale en dos laminas tendria que tener dos numeros a la vez.
#
#   2. Las filas colapsan solo cuando TODOS los campos coinciden. Si a dos rieles del mismo
#      largo se les escribe un ITEM distinto, la tabla imprime dos filas para el mismo tipo.
#
# Asi que el numero es el DEL CODIGO: la lamina que usa R-01, R-03 y R-04 imprime 1, 3 y 4.
# Desde que el codigo es el largo (ver arriba) eso significa que un riel de 250 mm imprime 25,
# y la columna deja de leerse como un correlativo. Es el precio de que la tabla siga siendo un
# ViewSchedule nativo y no un dibujo.
#
# Si algun dia hace falta el correlativo de verdad, la salida es la misma que para cualquier
# cosa que un schedule no pueda: dejar de filtrar por parametro y dibujar la tabla con lineas
# y textos. Da control total a cambio de que no quede viva, y saca de encima los tres
# parametros que este paso escribe hoy.
#
# Si IN[7] queda vacio, la tabla sale con dos columnas y sin ITEM.
#
#
# DONDE SE PARA LA TABLA
#
# En el hueco libre mas cercano a la esquina de IN[13]. Hace falta buscarlo porque 01 y 02
# reparten las vistas por el lienzo COMPLETO de la vineta: cuando se escribieron, este paso
# no existia, y el comentario de los dos dice "aca no hay tabla". Antes que reabrir esa
# decision y tocar tres graphs -mas laminas, otro empaquetado-, este paso se arregla solo
# con lo que sobra.
#
# Ocupado es: los viewports con su titulo, LAS NOTAS DE TEXTO, la franja inferior de la
# vineta (IN[10]) y el cajetin (IN[11] x IN[12]). Los dos ultimos no se pueden deducir de la
# geometria de la vineta -es una sola familia que ocupa toda la hoja- asi que son inputs, y
# son constantes del proyecto: se cargan una vez y no se tocan mas.
#
# Que cuente las notas de texto y los viewports de leyenda importa por el orden con 05: ese
# paso las pega a un lugar FIJO y no negocia, asi que al dibujo le conviene correr 05 y
# despues 04. Si se corre al reves sobre una lamina nueva, la tabla se para sin saber que
# despues van a llegar, y 05 lo avisa en el log. La salida es volver a correr este paso con
# rehacer: ahi si las ve.
#
# El tamano de la tabla no se estima: se coloca, se le mide el bounding box real y recien
# ahi se la mueve al hueco. Estimar el alto de un schedule por la cantidad de filas y el
# tipo de letra es adivinar, y un error de dos milimetros la deja pisando una vista.
#
# Si no hay hueco, la tabla se coloca igual en la esquina pedida y el log avisa: una tabla
# encimada se ve y se corrige a mano, una tabla que no se coloco pasa desapercibida.

import clr
import math
import os
import hashlib
import tempfile
clr.AddReference('RevitAPI')
clr.AddReference('RevitServices')
from Autodesk.Revit.DB import (FilteredElementCollector, ViewSheet, ViewSchedule,
                               ScheduleSheetInstance, ScheduleFilter, ScheduleFilterType,
                               ScheduleSortGroupField, Viewport, View, XYZ, Element,
                               ElementId, BuiltInCategory, BuiltInParameter, StorageType,
                               FamilyInstance, FormatOptions, UnitTypeId, SectionType,
                               CategorySet, CategoryType, GroupTypeId, SpecTypeId,
                               ExternalDefinitionCreationOptions)
from RevitServices.Persistence import DocumentManager
from RevitServices.Transactions import TransactionManager
from System import Guid

doc = DocumentManager.Instance.CurrentDBDocument
app = doc.Application

process_all = bool(IN[0])
filter_text = (IN[1] or '').strip()
fam_prefijo = (IN[2] or '').strip()
param_largo = (IN[3] or 'Longitud').strip()
param_largo_tbl = (IN[4] or 'LARGO_TBL').strip()
param_codigo = (IN[5] or 'TEXTO PARA TAG').strip()
param_lamina = (IN[6] or 'En plano').strip()
param_item = (IN[7] or '').strip()
titulo_tabla = (IN[8] or 'TABLA N1').strip()
margen = float(IN[9]) / 304.8
franja_inferior = float(IN[10]) / 304.8
cajetin_ancho = float(IN[11]) / 304.8
cajetin_alto = float(IN[12]) / 304.8
esquina = (IN[13] or 'abajo-derecha').strip().lower()
rehacer = bool(IN[14])

log = []

# --- contrato de nombres con 00_Vistas de sector ---
SUF_PLANTA = ' - PLANTA'
SUF_ELEV = ' - ELEV '

PREFIJO_TIPO = 'R-'
PREFIJO_SCHEDULE = 'TBL_RIELES_'

H_ITEM = 'ITEM'
H_TIPO = 'TIPO'
H_LARGO = 'LARGO (mm)'

# Paso de la grilla con que se barre la lamina buscando hueco, en mm de papel. 5 mm es mas
# fino que cualquier ajuste que alguien haga despues a mano y deja el barrido en unos pocos
# miles de posiciones por lamina.
PASO_BUSQUEDA = 5.0 / 304.8

def elem_name(e):
    try:
        return Element.Name.GetValue(e)
    except Exception:
        try:
            return e.Name
        except Exception:
            return ''


def coincide(nombre, texto):
    # filtro parcial separado por comas, insensible a mayusculas. Mismo criterio que usan
    # 00, 01, 02 y 03 para elegir sectores.
    if not texto:
        return True
    alto = (nombre or '').upper()
    for t in texto.split(','):
        t = t.strip().upper()
        if t and t in alto:
            return True
    return False


def fam_name(el):
    try:
        return el.Symbol.Family.Name or ''
    except Exception:
        return ''


def es_riel(el):
    f = fam_name(el).upper()
    if not f:
        return False
    return not fam_prefijo or f.startswith(fam_prefijo.upper())


def largo_mm(el):
    # El largo sale del parametro de INSTANCIA y de ningun otro lado, redondeado al
    # milimetro. Mismo criterio que 03: el nombre de tipo miente -hay un "150 mm" que mide
    # 600- y ademas no es consistente entre familias.
    try:
        p = el.LookupParameter(param_largo)
    except Exception:
        return None
    if p is None or not p.HasValue or p.StorageType != StorageType.Double:
        return None
    mm = int(round(p.AsDouble() * 304.8))
    return mm if mm > 0 else None


def rieles_del_modelo():
    return [el for el in FilteredElementCollector(doc)
            .OfCategory(BuiltInCategory.OST_ElectricalFixtures)
            .WhereElementIsNotElementType()
            if isinstance(el, FamilyInstance) and es_riel(el)]


def numero_de_largo(mm):
    # EL NUMERO ES EL LARGO, NO UNA POSICION. El largo en mm con los ceros sobrantes sacados,
    # sin bajar de los cientos: 100 -> 1, 200 -> 2, 250 -> 25, 240 -> 24, 241 -> 241,
    # 1000 -> 10. Se saca hasta los cientos y no mas, porque sacar todos los ceros haria que
    # 1000 y 100 dieran los dos el 1.
    #
    # Dos consecuencias que valen mas que la comodidad de leerlo:
    #
    # 1. El codigo de un riel depende SOLO DE ESE RIEL. Antes salia de la posicion del largo
    #    en la lista ordenada de todos los largos del modelo, asi que borrar un tipo corria
    #    todos los de arriba, y cualquier diferencia entre lo que recolecta 03 y lo que
    #    recolecta 04 desplazaba la numeracion entera. Ahora R-04 es 400 mm en este modelo, en
    #    el de al lado y el ano que viene.
    #
    # 2. Un riel mal modelado SE DELATA. El 100 mm que en realidad media 108,05 salia R-02,
    #    indistinguible de un tipo legitimo, y se encontro de casualidad. Con esta regla sale
    #    R-108: un codigo que no es una medida redonda canta solo en el plano.
    if mm % 100 == 0:
        return mm // 100
    if mm % 10 == 0:
        return mm // 10
    return mm


def tabla_de_tipos(rieles):
    # Traduce cada largo por separado. No numera: no hay lista, no hay orden, no hay nada que
    # se corra cuando un largo aparece o desaparece.
    largos = sorted(set(l for l in (largo_mm(e) for e in rieles) if l is not None))
    mapa = {}
    visto = {}
    for l in largos:
        n = numero_de_largo(l)
        if n in visto:
            # No es imposible: 250 y 2500 dan los dos 25. Hoy no pasa -el riel mas largo mide
            # 1000- pero si pasara, dos tipos distintos compartirian codigo en el plano y en
            # la tabla sin que nada fallara. Por eso se avisa.
            log.append('ERROR: los largos {} mm y {} mm dan los dos el codigo {}. La regla '
                       'del codigo no los distingue: o uno esta mal medido, o hay que cambiar '
                       'la regla.'.format(visto[n], l, codigo_de(n)))
        visto[n] = l
        mapa[l] = n
    return mapa


def codigo_de(numero):
    return '{}{:02d}'.format(PREFIJO_TIPO, numero)


def sector_de_vista(v):
    n = elem_name(v)
    if n.endswith(SUF_PLANTA):
        return n[:-len(SUF_PLANTA)]
    i = n.find(SUF_ELEV)
    if i > 0:
        return n[:i]
    return None


def laminas_de_sector():
    # Lamina -> (sector, [vistas]). Una lamina es del pipeline si tiene alguna vista que
    # cumple el contrato de nombres; por la regla de aislamiento de 01, todas sus vistas de
    # sector son del mismo sector.
    res = []
    for sh in FilteredElementCollector(doc).OfClass(ViewSheet):
        if sh.IsTemplate:
            continue
        vistas = []
        sectores = set()
        for vp in FilteredElementCollector(doc, sh.Id).OfClass(Viewport):
            v = doc.GetElement(vp.ViewId)
            if v is None:
                continue
            s = sector_de_vista(v)
            if s is None:
                continue
            vistas.append(v)
            sectores.add(s)
        if not vistas:
            continue
        sector = sorted(sectores)[0]
        if len(sectores) > 1:
            log.append('AVISO: la lamina {} tiene vistas de mas de un sector ({}). La tabla '
                       'igual lista lo que se ve en la lamina, pero eso rompe la regla de '
                       'aislamiento que fija 01.'.format(sh.SheetNumber,
                                                         ', '.join(sorted(sectores))))
        if not process_all and not coincide(sector, filter_text):
            continue
        res.append((sh, sector, vistas))
    res.sort(key=lambda t: t[0].SheetNumber)
    return res


def rieles_de_lamina(vistas):
    # Union de los rieles visibles en cada viewport de la lamina. Se recolecta CONTRA LA
    # VISTA, asi que el crop, el view range y lo oculto ya deciden que se ve y que no, sin
    # volver a describir la caja del sector.
    vistos = {}
    for v in vistas:
        for el in (FilteredElementCollector(doc, v.Id)
                   .OfCategory(BuiltInCategory.OST_ElectricalFixtures)
                   .WhereElementIsNotElementType()):
            if isinstance(el, FamilyInstance) and es_riel(el):
                vistos[el.Id.Value] = el
    return list(vistos.values())


def guid_para(nombre):
    # GUID derivado del nombre: el parametro creado es el MISMO en todos los modelos de la
    # oficina sin depender de un archivo de parametros compartidos versionado.
    h = hashlib.md5(('ELE01_TBL::' + nombre.upper()).encode('utf-8')).hexdigest()
    return Guid(h)


def existe_como_campo(nombre):
    # Una de las DOS pruebas: que Revit lo ofrezca como CAMPO DE SCHEDULE. Hace falta porque
    # un parametro de familia existe en el riel y no se puede poner en una tabla. Pero no
    # alcanza sola -ver existe_en_rieles-: lo contrario tambien pasa.
    try:
        probe = ViewSchedule.CreateSchedule(doc, ElementId(BuiltInCategory.OST_ElectricalFixtures))
    except Exception:
        return False
    try:
        for f in probe.Definition.GetSchedulableFields():
            try:
                if f.GetName(doc) == nombre:
                    return True
            except Exception:
                continue
        return False
    finally:
        try:
            doc.Delete(probe.Id)
        except Exception:
            pass


def existe_en_rieles(nombre):
    # La prueba que importa para ESCRIBIR: que un riel de verdad tenga el parametro.
    #
    # No alcanza con que Revit lo ofrezca como campo de schedule, y esto no es teorico: el
    # 2026-08-19 "ITEM_TBL" aparecia entre los campos schedulables -tanto que la columna se
    # creo y se vio en la tabla- y NINGUN elemento del modelo tenia el parametro, ni la
    # instancia ni el tipo. Como el guard de asegurar_param miraba los campos del schedule,
    # daba por hecho que ya existia y no lo creaba nunca: la columna salia vacia corrida tras
    # corrida, y el unico sintoma era un AVISO al final del log.
    #
    # Se mira un solo riel porque el parametro se vincula por CATEGORIA: o lo tienen todos o
    # no lo tiene ninguno.
    for el in rieles_del_modelo():
        try:
            return el.LookupParameter(nombre) is not None
        except Exception:
            return False
    return False


def asegurar_param(nombre, spec, etiqueta):
    # Crea el parametro como COMPARTIDO y lo vincula como parametro de proyecto de instancia
    # de Electrical Fixtures. Compartido y no de proyecto a secas porque asi ademas se puede
    # etiquetar y exportar, y porque el GUID derivado del nombre lo hace reproducible.
    #
    # Los dos parametros que necesita la tabla -el largo y el ITEM- los crea este paso y no
    # se toman prestados del proyecto. La razon esta en la seccion del ITEM del encabezado:
    # el 2026-08-19 el parametro "ITEM" del proyecto paso a llamarse NUM_CIRCUITO y la tabla
    # dejo de armarse. Un parametro que es de la tabla tiene que vivir con la tabla.
    # las dos condiciones: que el schedule lo ofrezca como campo Y que los rieles lo
    # tengan. Si falta cualquiera de las dos hay que (re)crear el vinculo.
    if existe_como_campo(nombre) and existe_en_rieles(nombre):
        return True
    log.append('El parametro "{}" falta o esta a medias; se (re)crea y se vincula a '
               'Electrical Fixtures.'.format(nombre))
    ruta = os.path.join(tempfile.gettempdir(), 'ELE01_params_tabla.txt')
    if not os.path.exists(ruta):
        # el archivo de parametros compartidos es un TSV con esta cabecera exacta; Revit no
        # lo crea solo y sin el OpenSharedParameterFile devuelve None
        tab = '\t'
        cab = ['# This is a Revit shared parameter file.',
               '*META' + tab + 'VERSION' + tab + 'MINVERSION',
               'META' + tab + '2' + tab + '1',
               '*GROUP' + tab + 'ID' + tab + 'NAME',
               '*PARAM' + tab + tab.join(['GUID', 'NAME', 'DATATYPE', 'DATACATEGORY',
                                          'GROUP', 'VISIBLE', 'DESCRIPTION',
                                          'USERMODIFIABLE', 'HIDEWHENNOVALUE'])]
        with open(ruta, 'w') as f:
            f.write('\n'.join(cab) + '\n')
    anterior = None
    try:
        anterior = app.SharedParametersFilename
    except Exception:
        pass
    try:
        app.SharedParametersFilename = ruta
        df = app.OpenSharedParameterFile()
        if df is None:
            log.append('ERROR: no se pudo abrir el archivo temporal de parametros compartidos.')
            return False
        grupo = None
        for g in df.Groups:
            if g.Name == 'TABLA_ILUMINACION':
                grupo = g
                break
        if grupo is None:
            grupo = df.Groups.Create('TABLA_ILUMINACION')
        defn = None
        for d in grupo.Definitions:
            if d.Name == nombre:
                defn = d
                break
        if defn is None:
            opts = ExternalDefinitionCreationOptions(nombre, spec)
            opts.GUID = guid_para(nombre)
            opts.Visible = True
            defn = grupo.Definitions.Create(opts)
        cats = CategorySet()
        cats.Insert(doc.Settings.Categories.get_Item(BuiltInCategory.OST_ElectricalFixtures))
        binding = app.Create.NewInstanceBinding(cats)
        ok = False
        try:
            ok = doc.ParameterBindings.Insert(defn, binding, GroupTypeId.Data)
        except Exception:
            try:
                ok = doc.ParameterBindings.Insert(defn, binding)
            except Exception:
                ok = False
        if not ok:
            try:
                ok = doc.ParameterBindings.ReInsert(defn, binding)
            except Exception:
                ok = False
        if ok:
            log.append('Se creo el parametro de proyecto "{}" (instancia, Electrical '
                       'Fixtures) para la columna {}.'.format(nombre, etiqueta))
        else:
            log.append('ERROR: no se pudo crear ni vincular el parametro "{}"; la tabla se '
                       'va a quedar sin la columna {}.'.format(nombre, etiqueta))
        return ok
    except Exception as e:
        log.append('ERROR creando el parametro "{}": {}'.format(nombre, e))
        return False
    finally:
        try:
            if anterior is not None:
                app.SharedParametersFilename = anterior
        except Exception:
            pass


def set_double(el, nombre, valor):
    if not nombre:
        return None
    try:
        p = el.LookupParameter(nombre)
    except Exception:
        return None
    if p is None or p.IsReadOnly or p.StorageType != StorageType.Double:
        return False
    try:
        if abs((p.AsDouble() or 0.0) - valor) > 1e-9:
            p.Set(valor)
        return True
    except Exception:
        return False


def set_string(el, nombre, valor):
    if not nombre:
        return None
    try:
        p = el.LookupParameter(nombre)
    except Exception:
        return None
    if p is None or p.IsReadOnly or p.StorageType != StorageType.String:
        return False
    try:
        if (p.AsString() or '') != valor:
            p.Set(valor)
        return True
    except Exception:
        return False


def largos_por_sector(laminas):
    # Los largos que se ven en cada SECTOR: la union de lo que se ve en las laminas del
    # sector. La tabla es por sector y no por lamina, y el motivo es el ITEM.
    #
    # El ITEM tiene que ser un correlativo -1, 2, 3, 4- porque en obra se usa para manejar
    # cantidades, y para eso tiene que significar lo mismo en todas las hojas. Como el ITEM
    # vive en un parametro del riel, un riel que sale en dos tablas distintas tendria que
    # tener dos numeros a la vez: por lamina eso pasa siempre -las hojas de un sector
    # comparten los rieles- y por sector no pasa nunca, porque un riel es de un solo sector.
    #
    # El precio: la tabla de A2 lista los tipos del sector y no solo los dibujados en A2. Se
    # cambio a proposito el criterio anterior -cada hoja listaba lo suyo- porque un numero que
    # cambia de significado de hoja en hoja no le sirve a nadie en obra.
    res = {}
    for sh, sector, vistas in laminas:
        acum = res.setdefault(sector, set())
        for el in rieles_de_lamina(vistas):
            l = largo_mm(el)
            if l is not None:
                acum.add(l)
    return dict((s, sorted(ls)) for s, ls in res.items())


def marcar_rieles(mapa, laminas, por_sector):
    # Escribe en cada riel su codigo, su ITEM y el sector donde aparece. Se escribe sobre
    # TODOS los rieles del modelo y no solo sobre los de los sectores procesados: el que ya no
    # aparece en ninguno tiene que quedar con la marca VACIA, o su tabla vieja lo seguiria
    # contando.
    donde = {}
    for sh, sector, vistas in laminas:
        for el in rieles_de_lamina(vistas):
            donde.setdefault(el.Id.Value, set()).add(sector)

    escritos = 0
    sin_largo = 0
    sin_param = set()
    en_dos_sectores = []
    for el in rieles_del_modelo():
        l = largo_mm(el)
        if l is None or l not in mapa:
            sin_largo += 1
            continue
        sectores = sorted(donde.get(el.Id.Value, []))
        marca = ';{};'.format(';'.join(sectores)) if sectores else ''
        # el ITEM es la posicion del largo en la lista del SECTOR, empezando en 1
        item = ''
        if sectores:
            if len(sectores) > 1:
                en_dos_sectores.append((el.Id.Value, sectores))
            largos = por_sector.get(sectores[0], [])
            if l in largos:
                item = str(largos.index(l) + 1)
        for nombre, valor in ((param_codigo, codigo_de(mapa[l])),
                              (param_item, item),
                              (param_lamina, marca)):
            r = set_string(el, nombre, valor)
            if r is False:
                sin_param.add(nombre)
        if set_double(el, param_largo_tbl, float(l)) is False:
            sin_param.add(param_largo_tbl)
        escritos += 1
    log.append('Marcados {} riel(es) del modelo: codigo en "{}", sector en "{}"{}.'.format(
        escritos, param_codigo, param_lamina,
        ', ITEM en "{}"'.format(param_item) if param_item else ''))
    if sin_largo:
        log.append('AVISO: {} riel(es) sin "{}" inicializado; no entran en ninguna '
                   'tabla.'.format(sin_largo, param_largo))
    for nombre in sorted(sin_param):
        log.append('AVISO: el parametro "{}" no existe en los rieles, o es de solo lectura. '
                   'La columna que depende de el va a salir vacia.'.format(nombre))
    if en_dos_sectores:
        # Es el unico caso que rompe el correlativo: el riel necesita un ITEM por sector y
        # solo puede tener uno, asi que en la tabla del otro sector su fila se va a partir en
        # dos. No deberia pasar -las cajas de sector no se pisan- y si pasa hay que verlo.
        log.append('ERROR: {} riel(es) se ven en mas de un sector y necesitarian un ITEM por '
                   'cada uno. Se les puso el del primero, asi que la tabla del otro sector va '
                   'a mostrar ese tipo en dos filas. Ids: {}.'.format(
                       len(en_dos_sectores),
                       ', '.join(str(i) for i, _ in en_dos_sectores[:10])))
    return donde


# ---------------------------- EL SCHEDULE ----------------------------

def campo_por_nombre(schedulable, nombre):
    for f in schedulable:
        try:
            if f.GetName(doc) == nombre:
                return f
        except Exception:
            continue
    return None


def limpiar_definicion(definition):
    # Deja la definicion en blanco para reconfigurarla desde cero, sin importar como haya
    # quedado en una corrida anterior. Mismo retrofit que usaba la tabla de acero.
    while definition.GetSortGroupFieldCount() > 0:
        definition.RemoveSortGroupField(0)
    while definition.GetFilterCount() > 0:
        definition.RemoveFilter(0)
    for i in range(definition.GetFieldCount() - 1, -1, -1):
        definition.RemoveField(definition.GetField(i).FieldId)


def formato_mm(campo):
    # La copia del largo es un Number sin unidades -guarda 100 y no 0,1 m-, asi que lo unico
    # que hay que decirle es que no ponga decimales ni separador de miles.
    try:
        fo = FormatOptions(UnitTypeId.General)
        fo.Accuracy = 1.0
        try:
            fo.UseGrouping = False
        except Exception:
            pass
        try:
            fo.SuppressTrailingZeros = True
        except Exception:
            pass
        campo.SetFormatOptions(fo)
        return True
    except Exception:
        return False


def poner_titulo(sched, titulo):
    # El titulo que se ve sobre la tabla es el nombre del schedule, y el nombre tiene que ser
    # unico en el documento -uno por lamina-. Asi que el nombre queda "TBL_RIELES_A1" para el
    # navegador y la celda de encabezado se sobreescribe con el titulo del plano tipo.
    try:
        sd = sched.GetTableData().GetSectionData(SectionType.Header)
        if sd is None or sd.NumberOfRows < 1:
            return False
        sd.SetCellText(0, 0, titulo)
        return True
    except Exception:
        return False


def configurar_schedule(sched, sector, numero_lamina):
    definition = sched.Definition
    limpiar_definicion(definition)
    definition.IsItemized = False

    schedulable = definition.GetSchedulableFields()
    faltan = []

    campo_lam = campo_por_nombre(schedulable, param_lamina)
    if campo_lam is None:
        faltan.append(param_lamina)
    campo_tipo = campo_por_nombre(schedulable, param_codigo)
    if campo_tipo is None:
        faltan.append(param_codigo)
    campo_largo = campo_por_nombre(schedulable, param_largo_tbl)
    if campo_largo is None:
        faltan.append(param_largo_tbl)
    campo_item = campo_por_nombre(schedulable, param_item) if param_item else None
    if param_item and campo_item is None:
        faltan.append(param_item)
    if faltan:
        return False, faltan

    # ITEM, TIPO y LARGO en ese orden; el campo del filtro va al final y oculto
    if campo_item is not None:
        f_item = definition.AddField(campo_item)
        f_item.ColumnHeading = H_ITEM
    f_tipo = definition.AddField(campo_tipo)
    f_tipo.ColumnHeading = H_TIPO
    f_largo = definition.AddField(campo_largo)
    f_largo.ColumnHeading = H_LARGO
    formato_mm(f_largo)

    f_lam = definition.AddField(campo_lam)
    try:
        f_lam.IsHidden = True
    except Exception:
        log.append('AVISO {}: no se pudo ocultar la columna "{}"; va a salir impresa en la '
                   'tabla.'.format(numero_lamina, param_lamina))

    # el filtro es por SECTOR, no por lamina: la tabla es la misma en todas las hojas del
    # sector para que el ITEM pueda ser un correlativo (ver largos_por_sector)
    definition.AddFilter(ScheduleFilter(f_lam.FieldId, ScheduleFilterType.Contains,
                                        ';{};'.format(sector)))
    try:
        definition.AddSortGroupField(ScheduleSortGroupField(f_largo.FieldId))
    except Exception:
        pass
    return True, []


def filas_del_cuerpo(sched):
    try:
        sd = sched.GetTableData().GetSectionData(SectionType.Body)
        return sd.NumberOfRows if sd is not None else -1
    except Exception:
        return -1


# ---------------------------- DONDE SE PARA ----------------------------

def rect_util(sheet):
    # area util = bbox de la vineta menos margenes. Identica a usable_rect() de 02, que es
    # la que decide donde caben las vistas.
    col = FilteredElementCollector(doc, sheet.Id).OfCategory(BuiltInCategory.OST_TitleBlocks)
    tb = col.FirstElement()
    if tb is not None:
        bb = tb.get_BoundingBox(sheet)
        if bb is not None:
            return (bb.Min.X + margen, bb.Min.Y + margen,
                    bb.Max.X - margen, bb.Max.Y - margen)
    o = sheet.Outline
    return (o.Min.U + margen, o.Min.V + margen, o.Max.U - margen, o.Max.V - margen)


def ocupado_en(sheet, excluir_id):
    # Rectangulos que la tabla no puede pisar: cada viewport con su titulo, las notas de
    # texto, LAS OTRAS TABLAS ya colocadas, la franja inferior de la vineta y el cajetin.
    #
    # Las otras tablas se sumaron cuando aparecio la TABLA N.2 de 07: mientras esta fue la
    # unica tabla del plano no hacia falta mirarlas, y en cuanto hubo dos se disputaban el
    # mismo hueco y quedaban encimadas. Se excluye la propia -excluir_id- porque se coloca
    # antes de medirla y si no, se bloquearia a si misma y siempre terminaria en la esquina
    # de ultimo recurso.
    rects = []
    for n in (FilteredElementCollector(doc, sheet.Id)
              .OfCategory(BuiltInCategory.OST_TextNotes)
              .WhereElementIsNotElementType()):
        try:
            bb = n.get_BoundingBox(sheet)
        except Exception:
            continue
        if bb is not None:
            rects.append((bb.Min.X, bb.Min.Y, bb.Max.X, bb.Max.Y))
    for vp in FilteredElementCollector(doc, sheet.Id).OfClass(Viewport):
        for getter in ('GetBoxOutline', 'GetLabelOutline'):
            try:
                o = getattr(vp, getter)()
            except Exception:
                continue
            if o is not None:
                rects.append((o.MinimumPoint.X, o.MinimumPoint.Y,
                              o.MaximumPoint.X, o.MaximumPoint.Y))
    for ssi in FilteredElementCollector(doc, sheet.Id).OfClass(ScheduleSheetInstance):
        if excluir_id is not None and ssi.Id.Value == excluir_id.Value:
            continue
        try:
            bb = ssi.get_BoundingBox(sheet)
        except Exception:
            continue
        if bb is not None:
            rects.append((bb.Min.X, bb.Min.Y, bb.Max.X, bb.Max.Y))
    x0, y0, x1, y1 = rect_util(sheet)
    if franja_inferior > 0:
        rects.append((x0 - margen, y0 - margen, x1 + margen, y0 + franja_inferior))
    if cajetin_ancho > 0 and cajetin_alto > 0:
        rects.append((x1 - cajetin_ancho, y0 - margen, x1 + margen, y0 + cajetin_alto))
    return rects


def se_pisan(a, b, holgura):
    return not (a[2] + holgura <= b[0] or b[2] + holgura <= a[0] or
                a[3] + holgura <= b[1] or b[3] + holgura <= a[1])


def buscar_hueco(sheet, ancho, alto, excluir_id):
    # Barrido en grilla sobre el area util: la primera posicion -de las que no pisan nada- que
    # quede mas cerca de la esquina pedida. Es fuerza bruta y esta bien que lo sea: son unos
    # miles de posiciones por lamina y evita toda la maquinaria de "mayor rectangulo vacio",
    # que aca no compra nada.
    x0, y0, x1, y1 = rect_util(sheet)
    if ancho > x1 - x0 or alto > y1 - y0:
        return None
    ocupados = ocupado_en(sheet, excluir_id)
    derecha = 'derecha' in esquina
    arriba = 'arriba' in esquina
    ref_x = x1 - ancho if derecha else x0
    ref_y = y1 - alto if arriba else y0

    mejor = None
    mejor_d = None
    n = int((x1 - x0 - ancho) / PASO_BUSQUEDA) + 1
    m = int((y1 - y0 - alto) / PASO_BUSQUEDA) + 1
    for i in range(max(n, 1)):
        for j in range(max(m, 1)):
            px = x0 + i * PASO_BUSQUEDA
            py = y0 + j * PASO_BUSQUEDA
            if px + ancho > x1 or py + alto > y1:
                continue
            cand = (px, py, px + ancho, py + alto)
            choca = False
            for r in ocupados:
                if se_pisan(cand, r, margen):
                    choca = True
                    break
            if choca:
                continue
            d = math.hypot(px - ref_x, py - ref_y)
            if mejor_d is None or d < mejor_d:
                mejor_d = d
                mejor = cand
    return mejor


def esquina_de_ultimo_recurso(sheet, ancho, alto):
    x0, y0, x1, y1 = rect_util(sheet)
    px = (x1 - ancho) if 'derecha' in esquina else x0
    py = (y1 - alto) if 'arriba' in esquina else y0
    return (px, py, px + ancho, py + alto)


def colocar(sheet, sched, numero_lamina):
    # Se coloca primero -en cualquier lado-, se le mide el bounding box real y recien
    # despues se la manda al hueco. El alto de un schedule depende del tipo de letra y de
    # cuantas filas quedaron: estimarlo es adivinar, y errarle por dos milimetros la deja
    # pisando una vista.
    x0, y0, x1, y1 = rect_util(sheet)
    try:
        ssi = ScheduleSheetInstance.Create(doc, sheet.Id, sched.Id, XYZ(x0, y1, 0.0))
    except Exception as e:
        log.append('ERROR {}: Revit no permitio colocar la tabla ({}).'.format(numero_lamina, e))
        return None
    doc.Regenerate()
    bb = ssi.get_BoundingBox(sheet)
    if bb is None:
        log.append('AVISO {}: no se pudo medir la tabla; queda en la esquina superior '
                   'izquierda.'.format(numero_lamina))
        return ssi
    ancho = bb.Max.X - bb.Min.X
    alto = bb.Max.Y - bb.Min.Y

    destino = buscar_hueco(sheet, ancho, alto, ssi.Id)
    if destino is None:
        destino = esquina_de_ultimo_recurso(sheet, ancho, alto)
        log.append('AVISO {}: no hay hueco libre de {:.0f}x{:.0f} mm en la lamina; la tabla '
                   'se coloca en la esquina {} y puede quedar montada sobre una vista o sobre '
                   'la TABLA N.2.'.format(
                       numero_lamina, ancho * 304.8, alto * 304.8, esquina))
    # el punto de insercion es la esquina SUPERIOR izquierda del schedule
    delta_x = destino[0] - bb.Min.X
    delta_y = destino[3] - bb.Max.Y
    try:
        ssi.Point = XYZ(ssi.Point.X + delta_x, ssi.Point.Y + delta_y, 0.0)
    except Exception as e:
        log.append('AVISO {}: no se pudo mover la tabla al hueco ({}).'.format(numero_lamina, e))
    return ssi


# ---------------------------- EJECUCION ----------------------------

laminas = laminas_de_sector()
if not laminas:
    log.append('No hay laminas con vistas de sector que coincidan con el filtro. Se esperan '
               'laminas con vistas "<sector>{}" o "<sector>{}X", creadas por 01 y 02.'.format(
                   SUF_PLANTA, SUF_ELEV))
else:
    TransactionManager.Instance.EnsureInTransaction(doc)

    mapa = tabla_de_tipos(rieles_del_modelo())
    if not mapa:
        log.append('AVISO: ningun riel del modelo tiene largo legible en "{}"; no hay tabla '
                   'que armar.'.format(param_largo))
    else:
        por_sector = largos_por_sector(laminas)
        asegurar_param(param_largo_tbl, SpecTypeId.Number, 'LARGO')
        if param_item:
            asegurar_param(param_item, SpecTypeId.String.Text, 'ITEM')
        # Regenerar entre crear los parametros y escribirlos NO es opcional: un parametro de
        # proyecto recien vinculado no aparece en los elementos hasta que el documento
        # regenera, asi que LookupParameter devuelve None y la columna sale vacia. El sintoma
        # es que a la SEGUNDA corrida funciona -porque ahi el parametro ya existia-.
        doc.Regenerate()
        marcar_rieles(mapa, laminas, por_sector)

        schedules = {}
        for v in FilteredElementCollector(doc).OfClass(ViewSchedule):
            schedules[elem_name(v)] = v
        instancias = {}
        for ssi in FilteredElementCollector(doc).OfClass(ScheduleSheetInstance):
            instancias.setdefault(ssi.ScheduleId.Value, []).append(ssi)

        puestas = 0
        for sh, sector, vistas in laminas:
            numero = sh.SheetNumber
            nombre_sched = PREFIJO_SCHEDULE + numero
            tipos = [l for l in por_sector.get(sector, []) if l in mapa]
            if not tipos:
                log.append('{} ({}): no se ve ningun riel en las vistas del sector; no se '
                           'pone tabla.'.format(numero, sector))
                continue

            sched = schedules.get(nombre_sched)
            if sched is not None and not rehacer:
                log.append('{} ({}): ya tiene tabla, se salta. Corre con rehacer para '
                           'reconfigurarla.'.format(numero, sector))
                continue
            if sched is None:
                sched = ViewSchedule.CreateSchedule(
                    doc, ElementId(BuiltInCategory.OST_ElectricalFixtures))
                try:
                    sched.Name = nombre_sched
                except Exception as e:
                    log.append('AVISO {}: no se pudo nombrar la tabla "{}" ({}); queda con '
                               'el nombre que le puso Revit.'.format(numero, nombre_sched, e))
                schedules[nombre_sched] = sched

            ok, faltan = configurar_schedule(sched, sector, numero)
            if not ok:
                log.append('ERROR {}: los rieles no tienen estos parametros como campo de '
                           'schedule: {}. Sin ellos la tabla no se puede armar.'.format(
                               numero, ', '.join(faltan)))
                continue
            doc.Regenerate()
            if not poner_titulo(sched, titulo_tabla):
                log.append('AVISO {}: no se pudo escribir el titulo "{}" en la tabla; queda '
                           'el nombre del schedule.'.format(numero, titulo_tabla))

            # una fila de mas es el encabezado de columnas; muchas mas significa que Revit
            # no colapso y esta imprimiendo un riel por fila
            # el cuerpo trae una fila de encabezado de columnas y una en blanco ademas de
            # los datos, asi que se tolera +2 antes de sospechar que no colapso
            filas = filas_del_cuerpo(sched)
            if filas > len(tipos) + 2:
                log.append('AVISO {}: la tabla quedo con {} fila(s) y en el sector hay {} '
                           'tipo(s). Si son muchas mas, Revit no esta colapsando las filas '
                           '-mira la nota del encabezado sobre "Itemize"-.'.format(
                               numero, filas, len(tipos)))

            for vieja in instancias.get(sched.Id.Value, []):
                try:
                    doc.Delete(vieja.Id)
                except Exception:
                    pass
            if colocar(sh, sched, numero) is not None:
                puestas += 1
                log.append('OK {} ({}): tabla con {} tipo(s): {}.'.format(
                    numero, sector, len(tipos),
                    ', '.join(codigo_de(mapa[l]) for l in tipos)))

        log.insert(0, '{} tabla(s) de rieles en {} lamina(s) de sector.'.format(
            puestas, len(laminas)))

    TransactionManager.Instance.ForceCloseTransaction()

OUT = log
# ----------------------------------------
log = Watch(py_tabla_de_tipos_de_riel_por)  # graph output
