# Dynamo graph 05_Leyendas y notas.dyn (Dynamo 4.0.2.3852)
# Leyendas de la hoja y bloque de notas generales en cada lamina de sector.

n01_procesar_todos_los_sectores = BoolSelector(false)  # "01. Procesar TODOS los sectores"; graph input
n02_filtro_de_sectores_si_todos = StringInput("SECTOR A")  # "02. Filtro de sectores (si TODOS = False)"; graph input
n03_margen_de_la_lamina_mm_el = IntegerSlider(5, range=0..60 step 1)  # "03. Margen de la lamina (mm) - el mismo que 01 y 02"; graph input
n04_leyendas_a_estampar_de_arriba = StringInput("ILU-SIMBOLOGIA ILUMINACION, ILU-NOMENCLATURA")  # "04. Leyendas a estampar, de arriba hacia abajo"; graph input
n05_esquina_donde_se_pega_la_pila = StringInput("arriba-derecha")  # "05. Esquina donde se pega la pila de leyendas"; graph input
n06_tipo_de_viewport_para_las = StringInput("Sin titulo")  # "06. Tipo de viewport para las leyendas"; graph input
n07_diagnostico_lamina_de_la_que = StringInput("")  # "07. DIAGNOSTICO: lamina de la que medir las notas (vacio = normal)"; graph input
n08_rehacer_leyendas_y_notas = BoolSelector(false)  # "08. Rehacer leyendas y notas existentes"; graph input
py_leyendas_y_notas_de_la_lamina = Python(IN[0]=n01_procesar_todos_los_sectores, IN[1]=n02_filtro_de_sectores_si_todos, IN[2]=n03_margen_de_la_lamina_mm_el, IN[3]=n04_leyendas_a_estampar_de_arriba, IN[4]=n05_esquina_donde_se_pega_la_pila, IN[5]=n06_tipo_de_viewport_para_las, IN[6]=n07_diagnostico_lamina_de_la_que, IN[7]=n08_rehacer_leyendas_y_notas)  # PythonNet3
# ---------- py_leyendas_y_notas_de_la_lamina.python (682 lines) ----------
# 05_Leyendas y notas - ILUMINACION
#
# Estampa en cada lamina de sector lo que NO depende de los rieles: las leyendas de la hoja
# y el bloque de notas generales.
#
#   +-----------------------------------------------+
#   |                              +--------------+ |
#   |     (vistas del sector)      | SIMBOLOGIA   | |
#   |                              +--------------+ |
#   |                              | NOMENCLATURA | |
#   |                              +--------------+ |
#   |                                               |
#   |            +-------------------+   +--------+ |
#   |            | 8. ... 13. notas  |   |        | |
#   |            | 1. ... 7.  notas  |   | CAJETIN| |
#   +------------+-------------------+---+--------+-+
#
# Revit 2027 / Dynamo 4 / CPython3
# IN[0] = procesar todos los sectores (bool)
# IN[1] = filtro de sectores si IN[0] es False (parcial, comas)
# IN[2] = margen de la lamina, en mm - el mismo que usan 01 y 02
# IN[3] = leyendas a estampar, por nombre y separadas por coma, en el orden en que se apilan
#         de arriba hacia abajo (vacio = no se estampa ninguna)
# IN[4] = esquina contra la que se pega la pila de leyendas (arriba-derecha,
#         arriba-izquierda, abajo-derecha, abajo-izquierda)
# IN[5] = nombre del tipo de viewport con que salen las leyendas (vacio = el primero que
#         tenga "Show Title" apagado)
# IN[6] = DIAGNOSTICO: numero de una lamina que ya tenga las notas puestas a mano. El log
#         escupe su posicion, ancho, tipo, alineacion y texto exactos con el formato de la
#         constante NOTAS, y si NOTAS ya esta cargado verifica que coincidan. Vacio = no
#         medir nada, que es el uso normal
# IN[7] = rehacer: reubica las leyendas que ya estan en la lamina y reescribe las notas
#
#
# POR QUE ES UN PASO APARTE
#
# Porque no habla de rieles. 03 y 04 son los dos pasos del RIEL RUC -las cotas y los tags en
# la planta, y la TABLA N.1 en cada lamina-, y todo lo que hacen sale del parametro Longitud
# de un riel. Esto no: la simbologia, la nomenclatura y las notas generales son de la HOJA, y
# estarian igual en una lamina sin un solo riel.
#
# Vivieron un tiempo dentro de 04, que se llamaba "TABLAS y Listados", y el resultado fue un
# paso con tres temas que no se tocaban entre si y diecinueve inputs. Separarlos no cambia lo
# que se dibuja: cambia que cada paso se pueda leer, correr y romper por separado.
#
#
# QUE LAMINAS TOCA
#
# Las mismas que 04: las que tienen vistas del pipeline, reconocidas por el contrato de
# nombres que comparten 00, 01, 02, 03 y 04 -"<sector> - PLANTA" y "<sector> - ELEV X"-. No
# hay parametro sello ni lista que mantener.
#
# Va en TODAS las laminas del sector, no solo en la primera. Es el mismo criterio que usa 04
# para las filas de su tabla: la hoja que uno tiene delante tiene que poder leerse sola, y
# una simbologia que esta en la otra hoja no sirve de nada.
#
#
# EL ORDEN CONTRA 04
#
# Las leyendas y las notas van a lugar FIJO -una esquina y unas coordenadas- y no buscan
# nada. La tabla de 04, en cambio, BUSCA HUECO, y cuenta como ocupado todo lo que ya este en
# la lamina: viewports y notas de texto incluidos.
#
# O sea que el orden que le conviene al dibujo es 05 y despues 04, aunque el numero diga lo
# contrario. Si se corre 04 primero sobre una lamina nueva, la tabla se para sin saber que
# despues van a llegar las leyendas y las notas, y puede quedar debajo de ellas. Este paso lo
# detecta y lo avisa en el log; la salida es volver a correr 04 con rehacer, que ahi si las
# ve. Los pasos son independientes y se pueden correr en cualquier orden: el numero ordena la
# lectura, no impone la secuencia.


import clr
clr.AddReference('RevitAPI')
clr.AddReference('RevitServices')
from Autodesk.Revit.DB import (FilteredElementCollector, ViewSheet, Viewport, View, XYZ,
                               Element, ElementId, BuiltInCategory, BuiltInParameter,
                               StorageType, ElementType, ViewType, ScheduleSheetInstance,
                               TextNote, TextNoteOptions, TextNoteType,
                               HorizontalTextAlignment, VerticalTextAlignment)
from RevitServices.Persistence import DocumentManager
from RevitServices.Transactions import TransactionManager

doc = DocumentManager.Instance.CurrentDBDocument

process_all = bool(IN[0])
filter_text = (IN[1] or '').strip()
margen = float(IN[2]) / 304.8
leyendas_pedidas = [t.strip() for t in (IN[3] or '').split(',') if t.strip()]
esquina_leyendas = (IN[4] or 'arriba-derecha').strip().lower()
tipo_vp_leyenda = (IN[5] or '').strip()
lamina_diagnostico = (IN[6] or '').strip()
rehacer = bool(IN[7])

log = []

# --- contrato de nombres con 00_Vistas de sector ---
SUF_PLANTA = ' - PLANTA'
SUF_ELEV = ' - ELEV '

# Correccion fina de la pila de leyendas contra la esquina, en mm de papel. El rectangulo
# util que usan 01 y 02 se apoya en el bounding box de la vineta, y el marco DIBUJADO no cae
# exactamente ahi: estos dos numeros son la diferencia medida sobre la lamina. Negativo es
# hacia la izquierda y hacia abajo.
AJUSTE_LEYENDAS_X = -3.2 / 304.8
AJUSTE_LEYENDAS_Y = -1.9 / 304.8

# El bloque de notas generales. Cada entrada es (texto, x_mm, y_mm, ancho_mm), con x e y
# medidos desde el VERTICE INFERIOR IZQUIERDO DE LA VINETA -no desde el origen de la lamina-,
# que es lo unico comun entre laminas distintas.
#
# Los cuatro datos salen del diagnostico, no de transcribir el plano a mano: Revit no deja
# leer la posicion de una nota desde fuera del modelo, y el texto copiado a ojo pierde
# justamente las tabulaciones con que estan alineados los numeros. Se corre el paso una vez
# con IN[18] apuntando a la lamina que ya tiene las notas, se pegan aca las lineas NOTA que
# salen en el log, y a partir de ahi las notas se escriben desde cero sin depender de
# ninguna otra lamina.
TIPO_TEXTO_NOTAS = '2mm wf 0.7 RomanD'
ALINEACION_NOTAS_H = HorizontalTextAlignment.Left
ALINEACION_NOTAS_V = VerticalTextAlignment.Top

NOTAS = [
    # Medidas sobre A1 el 2026-08-18. La segunda nota va ARRIBA de la primera -su y es mayor
    # y las dos se alinean por el borde superior-, que es como estan en el plano: no es un
    # error de transcripcion y no hay que "arreglarlo".
    ('1.\t\t\tDIMENSIONES Y ELEVACIONES EN mm. (S.I.C.)\r2.\t\t\tCOTAS PREVALECEN SOBRE EL DIBUJO.\r3.\t\t\tFUNDACIONES, SOPORTES, POR ESPECIALIDAD OO.CC.\r4.\t\t\tPARA DETALLES DE CIRCUITOS ELECTRICOS VER DOCUMENTO N° 1820-E-LIS-002.\r5.\t\t\tLAS LUMINARIAS QUE SE ENCUENTRAN EN EL PROYECTO, DEBEN INSTALARSE SEGUN ALTURA INDICADA EN LA TABLA N°2 Y N°3. ALTURA DEFINIDAS \t\t\t\t\tDESDE EL N.P.T. EN PLATAFORMA DE TRANSITO PEATONAL (GRATING).\r6.\t\t\tTODAS LAS LUMINARIAS EXTERIORES DEBERAN DAR CUMPLIMIENTO AL DS1/2022 DEL MMA QUE ESTABLECE LA NORMA DE EMISION PARA LA \t\t\t\t\t\t\t\t\t\t\tREGULACION DE LA CONTAMINACION LUMINICA.\r7.\t\t\tLAS CANALIZACIONES A LA VISTA DEBERAN SER EN PVC Sch.80 RESISTENTE A LOS RAYOS UV. SEGUN CARACTERISTICAS MINIMAS \t\t\t\t\t\t\t\t\t\t\t\t\t\t\t\t\t\t\tPRESENTADAS EN TABLA N°4.23 DEL PLIEGO TECNICO NORMATIVO RIC N°04.\r',
     372.239, 50.812, 174.441),
    ('CONTINUACION DE NOTAS:\r8.\t\t\tPARA VER CANALIZACIONES DE ELECTRICIDAD E INSTRUMENTACION IR A PLANOS MENCIONADOS EN RECUADRO DE REFERENCIAS.\r9.\t\t\tTODOS LOS RIELES SON DE DIMENSION 42x42x2,5mm, DONDE LA TABLA Nº1 INDICA EL LARGO DE CADA UNO DE ELLOS.\r10.\t\tEQUIPOS DE EMERGENCIA DEBEN CUMPLIR CON EL PLIEGO TECNICO RIC Nº8 PUNTO Nº10 DE ILUMINACION DE SEGURIDAD Y ANEXO 8.1,\r\t\t\t\tADEMAS DE CUMPLIR UNA AUTONOMIA DE A LO MENOS DOS HORAS.\r11.\t\tVER MEMORIA DE CALCULO DE ALUMBRADO EN DOCUMENTO Nº 1820-E-MC-002.\r12.\t\tVER DETALLES DE LUMINARIA EN HOJA DE DATOS DE LUMINARIA, DOCUMENTO Nº 1820-E-HDD-001.\r13. \tVER POTENCIA DE LUMINARIAS EN TABLA DE SIMBOLOGIA.\r',
     372.239, 83.312, 174.441),
]


def elem_name(e):
    try:
        return Element.Name.GetValue(e)
    except Exception:
        try:
            return e.Name
        except Exception:
            return ''


def coincide(nombre, texto):
    # filtro parcial separado por comas, insensible a mayusculas. Mismo criterio que usan
    # 00, 01, 02 y 03 para elegir sectores.
    if not texto:
        return True
    alto = (nombre or '').upper()
    for t in texto.split(','):
        t = t.strip().upper()
        if t and t in alto:
            return True
    return False


def sector_de_vista(v):
    n = elem_name(v)
    if n.endswith(SUF_PLANTA):
        return n[:-len(SUF_PLANTA)]
    i = n.find(SUF_ELEV)
    if i > 0:
        return n[:i]
    return None


def laminas_de_sector():
    # Lamina -> (sector, [vistas]). Una lamina es del pipeline si tiene alguna vista que
    # cumple el contrato de nombres; por la regla de aislamiento de 01, todas sus vistas de
    # sector son del mismo sector.
    res = []
    for sh in FilteredElementCollector(doc).OfClass(ViewSheet):
        if sh.IsTemplate:
            continue
        vistas = []
        sectores = set()
        for vp in FilteredElementCollector(doc, sh.Id).OfClass(Viewport):
            v = doc.GetElement(vp.ViewId)
            if v is None:
                continue
            s = sector_de_vista(v)
            if s is None:
                continue
            vistas.append(v)
            sectores.add(s)
        if not vistas:
            continue
        sector = sorted(sectores)[0]
        if len(sectores) > 1:
            log.append('AVISO: la lamina {} tiene vistas de mas de un sector ({}). La tabla '
                       'igual lista lo que se ve en la lamina, pero eso rompe la regla de '
                       'aislamiento que fija 01.'.format(sh.SheetNumber,
                                                         ', '.join(sorted(sectores))))
        if not process_all and not coincide(sector, filter_text):
            continue
        res.append((sh, sector, vistas))
    res.sort(key=lambda t: t[0].SheetNumber)
    return res


def rect_util(sheet):
    # area util = bbox de la vineta menos margenes. Identica a usable_rect() de 02, que es
    # la que decide donde caben las vistas.
    col = FilteredElementCollector(doc, sheet.Id).OfCategory(BuiltInCategory.OST_TitleBlocks)
    tb = col.FirstElement()
    if tb is not None:
        bb = tb.get_BoundingBox(sheet)
        if bb is not None:
            return (bb.Min.X + margen, bb.Min.Y + margen,
                    bb.Max.X - margen, bb.Max.Y - margen)
    o = sheet.Outline
    return (o.Min.U + margen, o.Min.V + margen, o.Max.U - margen, o.Max.V - margen)


def se_pisan(a, b, holgura):
    return not (a[2] + holgura <= b[0] or b[2] + holgura <= a[0] or
                a[3] + holgura <= b[1] or b[3] + holgura <= a[1])


# ---------------------------- LAS LEYENDAS ----------------------------

def leyendas_del_modelo():
    # nombre en MAYUSCULAS -> vista de leyenda. Se busca por nombre exacto y no por
    # prefijo: cual leyenda va en la lamina es una decision de dibujo, no algo deducible.
    res = {}
    for v in FilteredElementCollector(doc).OfClass(View):
        try:
            if v.IsTemplate or v.ViewType != ViewType.Legend:
                continue
        except Exception:
            continue
        res[elem_name(v).strip().upper()] = v
    return res


def sin_acentos(t):
    tabla = {'\u00e1': 'a', '\u00e9': 'e', '\u00ed': 'i', '\u00f3': 'o', '\u00fa': 'u',
             '\u00fc': 'u', '\u00f1': 'n'}
    return ''.join(tabla.get(c, c) for c in (t or '').lower()).strip()


def tipos_de_viewport():
    # OJO: los tipos de viewport NO TIENEN CATEGORIA -su parametro Category vale -1-, asi
    # que OfCategory(OST_Viewports).WhereElementIsElementType() devuelve CERO tipos y no un
    # error. El sintoma de haberlo hecho por categoria es que las leyendas salen con el tipo
    # por defecto y el log dice que no hay ningun tipo sin rotulo.
    #
    # Se buscan por ElementType con FamilyName "Viewport", y ademas se juntan los tipos que
    # YA usan los viewports del documento. Lo segundo cubre el caso de que ese FamilyName
    # venga traducido: los tipos en uso son tipos de viewport por construccion, sin depender
    # de como se llame la familia en el idioma de esta instalacion.
    res = {}
    for t in FilteredElementCollector(doc).OfClass(ElementType):
        try:
            if t.FamilyName != 'Viewport':
                continue
        except Exception:
            continue
        res[t.Id.Value] = t
    for vp in FilteredElementCollector(doc).OfClass(Viewport):
        try:
            t = doc.GetElement(vp.GetTypeId())
        except Exception:
            continue
        if t is not None:
            res[t.Id.Value] = t
    return list(res.values())


def sin_rotulo(t):
    try:
        p = t.get_Parameter(BuiltInParameter.VIEWPORT_ATTR_SHOW_LABEL)
    except Exception:
        return False
    return (p is not None and p.StorageType == StorageType.Integer and p.AsInteger() == 0)


def tipo_viewport_leyenda():
    # Con IN[17] escrito manda ese nombre y no se discute: es el tipo de la plantilla de la
    # oficina y el graph no tiene por que saber mas. Vacio, se busca cualquiera con
    # "Show Title" apagado -y si hay varios se avisa cual se uso, porque en ese caso el
    # resultado depende del modelo y no de una decision-.
    tipos = tipos_de_viewport()
    if not tipos:
        log.append('AVISO: no se encontro ningun tipo de viewport en el modelo; las leyendas '
                   'quedan con el tipo por defecto.')
        return None

    if tipo_vp_leyenda:
        buscado = sin_acentos(tipo_vp_leyenda)
        for t in tipos:
            if sin_acentos(elem_name(t)) != buscado:
                continue
            if not sin_rotulo(t):
                log.append('AVISO: el tipo de viewport "{}" tiene "Show Title" encendido; '
                           'las leyendas van a salir con su nombre de vista escrito '
                           'debajo.'.format(elem_name(t)))
            log.append('Las leyendas van con el tipo de viewport "{}".'.format(elem_name(t)))
            return t.Id
        log.append('ERROR: no hay ningun tipo de viewport llamado "{}". Los que tiene el '
                   'modelo son: {}.'.format(
                       tipo_vp_leyenda,
                       ', '.join(sorted('"{}"'.format(elem_name(t)) for t in tipos))))

    candidatos = sorted((elem_name(t), t.Id) for t in tipos if sin_rotulo(t))
    if not candidatos:
        log.append('AVISO: ningun tipo de viewport tiene "Show Title" apagado; las leyendas '
                   'quedan con el tipo por defecto y salen con su nombre de vista debajo.')
        return None
    log.append('Las leyendas van con el tipo de viewport "{}"{}.'.format(
        candidatos[0][0],
        ' (habia {} sin rotulo)'.format(len(candidatos)) if len(candidatos) > 1 else ''))
    return candidatos[0][1]


def rects_ocupados(sheet, excluir):
    # Lo que ya hay dibujado en la lamina. Los viewports -vistas y leyendas- y ADEMAS la
    # tabla de 04, que no es un Viewport sino un ScheduleSheetInstance y por eso hay que
    # buscarla aparte. Sirve para avisar cuando lo que este paso pega a la esquina cae
    # encima de algo que ya estaba.
    rects = []
    for vp in FilteredElementCollector(doc, sheet.Id).OfClass(Viewport):
        if vp.Id.Value in excluir:
            continue
        try:
            o = vp.GetBoxOutline()
        except Exception:
            continue
        if o is not None:
            rects.append((o.MinimumPoint.X, o.MinimumPoint.Y,
                          o.MaximumPoint.X, o.MaximumPoint.Y))
    for ssi in FilteredElementCollector(doc, sheet.Id).OfClass(ScheduleSheetInstance):
        try:
            bb = ssi.get_BoundingBox(sheet)
        except Exception:
            continue
        if bb is not None:
            rects.append((bb.Min.X, bb.Min.Y, bb.Max.X, bb.Max.Y))
    return rects


def colocar_leyendas(sheet, catalogo, tipo_sin_titulo, numero_lamina):
    # La pila se pega a la esquina y crece hacia adentro, sin separacion entre leyendas. No
    # busca hueco: la esquina es lo que se pidio, y el alto de cada leyenda se mide despues
    # de colocarla porque un dibujo de leyenda no tiene tamano previsible.
    x0, y0, x1, y1 = rect_util(sheet)
    # el ajuste corre el rectangulo entero, asi que la correccion es la misma sea cual sea
    # la esquina contra la que se apoye la pila
    x0 += AJUSTE_LEYENDAS_X
    x1 += AJUSTE_LEYENDAS_X
    y0 += AJUSTE_LEYENDAS_Y
    y1 += AJUSTE_LEYENDAS_Y
    derecha = 'derecha' in esquina_leyendas
    arriba = 'abajo' not in esquina_leyendas

    puestos = {}
    for vp in FilteredElementCollector(doc, sheet.Id).OfClass(Viewport):
        puestos.setdefault(vp.ViewId.Value, []).append(vp)

    pila = []
    for nombre in leyendas_pedidas:
        v = catalogo.get(nombre.upper())
        if v is None:
            log.append('AVISO {}: no hay ninguna leyenda llamada "{}" en el modelo; las '
                       'demas se colocan igual.'.format(numero_lamina, nombre))
            continue
        pila.append(v)
    if not pila:
        return 0

    ya = [v for v in pila if puestos.get(v.Id.Value)]
    if len(ya) == len(pila) and not rehacer:
        log.append('{}: ya tiene las {} leyenda(s), se dejan donde estan. Corre con rehacer '
                   'para volver a pegarlas a la esquina.'.format(numero_lamina, len(ya)))
        return 0

    nuestros = set()
    colocadas = []
    # la lista viene en orden visual de arriba hacia abajo; anclada abajo se apila al reves
    cursor = y1 if arriba else y0
    for v in (pila if arriba else list(reversed(pila))):
        vps = puestos.get(v.Id.Value) or []
        if len(vps) > 1:
            log.append('AVISO {}: la leyenda "{}" esta puesta {} veces en la lamina; se '
                       'reubica una sola y las otras quedan donde estan.'.format(
                           numero_lamina, elem_name(v), len(vps)))
        vp = vps[0] if vps else None
        if vp is None:
            try:
                if not Viewport.CanAddViewToSheet(doc, sheet.Id, v.Id):
                    log.append('AVISO {}: Revit no deja poner la leyenda "{}" en esta '
                               'lamina.'.format(numero_lamina, elem_name(v)))
                    continue
                vp = Viewport.Create(doc, sheet.Id, v.Id, XYZ(x0, y1, 0.0))
            except Exception as e:
                log.append('ERROR {}: no se pudo colocar la leyenda "{}" ({}).'.format(
                    numero_lamina, elem_name(v), e))
                continue
        if tipo_sin_titulo is not None:
            try:
                if vp.GetTypeId().Value != tipo_sin_titulo.Value:
                    vp.ChangeTypeId(tipo_sin_titulo)
            except Exception:
                log.append('AVISO {}: la leyenda "{}" no acepto el tipo de viewport sin '
                           'rotulo; puede salir con su nombre debajo.'.format(
                               numero_lamina, elem_name(v)))
        nuestros.add(vp.Id.Value)
        doc.Regenerate()
        try:
            o = vp.GetBoxOutline()
            ancho = o.MaximumPoint.X - o.MinimumPoint.X
            alto = o.MaximumPoint.Y - o.MinimumPoint.Y
        except Exception:
            log.append('AVISO {}: no se pudo medir la leyenda "{}"; queda donde cayo.'.format(
                numero_lamina, elem_name(v)))
            continue
        px = (x1 - ancho) if derecha else x0
        if arriba:
            py = cursor - alto
            cursor = py
        else:
            py = cursor
            cursor = py + alto
        try:
            vp.SetBoxCenter(XYZ(px + ancho / 2.0, py + alto / 2.0, 0.0))
        except Exception as e:
            log.append('AVISO {}: no se pudo mover la leyenda "{}" a la esquina ({}).'.format(
                numero_lamina, elem_name(v), e))
            continue
        colocadas.append((elem_name(v), (px, py, px + ancho, py + alto)))

    if not colocadas:
        return 0

    ajenos = rects_ocupados(sheet, nuestros)
    pisadas = [n for n, r in colocadas if any(se_pisan(r, a, 0.0) for a in ajenos)]
    if pisadas:
        log.append('AVISO {}: {} queda(n) montada(s) sobre una vista o sobre la tabla. La '
                   'lamina reparte las vistas por el lienzo completo, asi que la esquina '
                   'puede estar ocupada.'.format(numero_lamina, ', '.join(pisadas)))
    log.append('OK {}: {} leyenda(s) pegadas a la esquina {}: {}.'.format(
        numero_lamina, len(colocadas), esquina_leyendas,
        ', '.join(n for n, _ in colocadas)))
    return len(colocadas)


# ---------------------------- LAS NOTAS ----------------------------

def notas_de(sheet):
    return list(FilteredElementCollector(doc, sheet.Id)
                .OfCategory(BuiltInCategory.OST_TextNotes)
                .WhereElementIsNotElementType())


def origen_vineta(sheet):
    # Vertice inferior izquierdo de la vineta. Las coordenadas de las notas se guardan
    # RELATIVAS a este punto y no en coordenadas de lamina: asi la misma constante sirve en
    # cualquier lamina, sin depender de donde haya quedado insertada la vineta.
    col = FilteredElementCollector(doc, sheet.Id).OfCategory(BuiltInCategory.OST_TitleBlocks)
    tb = col.FirstElement()
    if tb is not None:
        bb = tb.get_BoundingBox(sheet)
        if bb is not None:
            return (bb.Min.X, bb.Min.Y)
    o = sheet.Outline
    return (o.Min.U, o.Min.V)


def escapar(t):
    # Sin literales con barra invertida a proposito: esta cadena viaja del log a un archivo
    # de codigo y cada capa que la toca puede comerse un nivel de escape. Con chr() no hay
    # nada que escapar.
    barra = chr(92)
    salida = []
    for c in (t or ''):
        if c == barra:
            salida.append(barra + barra)
        elif c == chr(9):
            salida.append(barra + 't')
        elif c == chr(13):
            salida.append(barra + 'r')
        elif c == chr(10):
            salida.append(barra + 'n')
        else:
            salida.append(c)
    return ''.join(salida)


def diagnostico_notas(numero_lamina):
    # Revit no deja leer la posicion de una nota de texto desde fuera del modelo, asi que
    # esta es la unica forma de conocerla: preguntarsela al propio documento y escribirla en
    # el log con el formato exacto que espera NOTAS. Se corre una vez, se pegan las lineas en
    # la constante y no se vuelve a necesitar. Tambien vuelca el texto con los tabs y saltos
    # escapados: copiado a mano desde el plano, el texto pierde justamente eso.
    sheet = None
    buscado = numero_lamina.strip().upper()
    for sh in FilteredElementCollector(doc).OfClass(ViewSheet):
        if not sh.IsTemplate and (sh.SheetNumber or '').strip().upper() == buscado:
            sheet = sh
            break
    if sheet is None:
        log.append('DIAGNOSTICO: no hay ninguna lamina numerada "{}".'.format(numero_lamina))
        return
    notas = notas_de(sheet)
    if not notas:
        log.append('DIAGNOSTICO: la lamina {} no tiene notas de texto.'.format(
            sheet.SheetNumber))
        return
    ox, oy = origen_vineta(sheet)
    log.append('DIAGNOSTICO de {}: {} nota(s). Pegar las lineas NOTA de abajo dentro de '
               'NOTAS, en este mismo orden.'.format(sheet.SheetNumber, len(notas)))
    for n in notas:
        try:
            p = n.Coord
            tipo = elem_name(doc.GetElement(n.GetTypeId()))
            ancho = n.Width
            ha = str(n.HorizontalAlignment)
            va = str(n.VerticalAlignment)
        except Exception as e:
            log.append('DIAGNOSTICO: no se pudo leer la nota {} ({}).'.format(n.Id.Value, e))
            continue
        log.append('NOTA  x={:.3f}  y={:.3f}  ancho={:.3f}  tipo="{}"  hAlign={}  '
                   'vAlign={}  texto="{}"'.format(
                       (p.X - ox) * 304.8, (p.Y - oy) * 304.8, ancho * 304.8,
                       tipo, ha, va, escapar(n.Text)))
    if NOTAS:
        verificar_notas(notas, ox, oy)


def verificar_notas(notas, ox, oy):
    # El diagnostico ademas VERIFICA. Con NOTAS ya cargado, compara lo que dice el modelo
    # contra lo que dice este archivo: es la unica forma de saber que la transcripcion es
    # exacta, porque un tab de mas o un \r convertido en \n no se ven en el plano pero son
    # texto distinto. Se emparejan por TEXTO y no por orden: si el emparejamiento falla, el
    # problema es la transcripcion, y si funciona pero la posicion no, el problema es otro.
    libres = list(range(len(NOTAS)))
    for n in notas:
        try:
            texto_real = n.Text
            p = n.Coord
            ancho_real = n.Width * 304.8
        except Exception as e:
            log.append('VERIFICACION: no se pudo leer una nota ({}).'.format(e))
            continue
        k = None
        for idx in libres:
            if NOTAS[idx][0] == texto_real:
                k = idx
                break
        if k is None:
            log.append('VERIFICACION: hay una nota en la lamina cuyo texto NO coincide con '
                       'ninguna entrada de NOTAS. Empieza con "{}".'.format(
                           escapar(texto_real[:60])))
            continue
        libres.remove(k)
        dx = (p.X - ox) * 304.8 - NOTAS[k][1]
        dy = (p.Y - oy) * 304.8 - NOTAS[k][2]
        da = ancho_real - NOTAS[k][3]
        if abs(dx) > 0.001 or abs(dy) > 0.001 or abs(da) > 0.001:
            log.append('VERIFICACION nota {} de NOTAS: el texto coincide exacto, pero la '
                       'posicion difiere en {:.3f} x {:.3f} mm y el ancho en {:.3f} '
                       'mm.'.format(k + 1, dx, dy, da))
        else:
            log.append('VERIFICACION nota {} de NOTAS: identica en texto, posicion y '
                       'ancho.'.format(k + 1))
    for idx in libres:
        log.append('VERIFICACION: la entrada {} de NOTAS no aparece en la lamina.'.format(
            idx + 1))


def tipo_de_texto(nombre):
    for t in FilteredElementCollector(doc).OfClass(TextNoteType):
        if elem_name(t) == nombre:
            return t.Id
    for t in FilteredElementCollector(doc).OfClass(TextNoteType):
        if sin_acentos(elem_name(t)) == sin_acentos(nombre):
            return t.Id
    return None


def crear_notas(laminas):
    # Se crean DESDE CERO en cada lamina de sector: el texto, el tipo, el ancho y la posicion
    # son constantes de este archivo y no se leen de ninguna otra lamina. La posicion va
    # relativa al vertice inferior izquierdo de la vineta, que es lo unico comun entre
    # laminas distintas.
    if not NOTAS:
        log.append('AVISO: NOTAS esta vacio, asi que no se escribe ninguna nota. Corre el '
                   'paso con el input de diagnostico apuntando a la lamina que ya las tiene '
                   'y pega en NOTAS las lineas que salgan en el log.')
        return 0

    tipo_id = tipo_de_texto(TIPO_TEXTO_NOTAS)
    if tipo_id is None:
        log.append('ERROR: no hay ningun tipo de texto llamado "{}" en el modelo; las notas '
                   'no se escriben.'.format(TIPO_TEXTO_NOTAS))
        return 0

    escritas = 0
    for sh, sector, vistas in laminas:
        propias = notas_de(sh)
        if propias and not rehacer:
            log.append('{}: ya tiene {} nota(s) de texto, se dejan como estan. Corre con '
                       'rehacer para reescribirlas.'.format(sh.SheetNumber, len(propias)))
            continue
        # rehacer se lleva las notas que ya estaban, incluidas las puestas a mano. Es el
        # mismo trato que hacen las cotas de 03: estas laminas las mantiene el pipeline y
        # rehacer es explicito.
        for vieja in propias:
            try:
                doc.Delete(vieja.Id)
            except Exception:
                pass
        ox, oy = origen_vineta(sh)
        puestas = 0
        creadas = []
        for texto, x_mm, y_mm, ancho_mm in NOTAS:
            try:
                opts = TextNoteOptions(tipo_id)
                opts.HorizontalAlignment = ALINEACION_NOTAS_H
                opts.VerticalAlignment = ALINEACION_NOTAS_V
                creadas.append(TextNote.Create(doc, sh.Id,
                                              XYZ(ox + x_mm / 304.8, oy + y_mm / 304.8, 0.0),
                                              ancho_mm / 304.8, texto, opts))
                puestas += 1
            except Exception as e:
                log.append('ERROR {}: no se pudo escribir una nota ({}).'.format(
                    sh.SheetNumber, e))
        escritas += puestas
        log.append('OK {}: {} nota(s) escritas.'.format(sh.SheetNumber, puestas))
        avisar_si_pisan(sh, creadas)
    return escritas


def avisar_si_pisan(sheet, notas):
    # Las notas van a coordenadas fijas y no negocian con nadie; la tabla de 04, en cambio,
    # busca hueco. Si 04 corrio primero sobre una lamina nueva, se paro sin saber que estas
    # notas iban a llegar. No se mueve nada -la posicion de la nota es el dato-, se avisa.
    if not notas:
        return
    doc.Regenerate()
    ajenos = rects_ocupados(sheet, set())
    chocan = 0
    for nt in notas:
        try:
            bb = nt.get_BoundingBox(sheet)
        except Exception:
            continue
        if bb is None:
            continue
        r = (bb.Min.X, bb.Min.Y, bb.Max.X, bb.Max.Y)
        if any(se_pisan(r, a, 0.0) for a in ajenos):
            chocan += 1
    if chocan:
        log.append('AVISO {}: {} nota(s) quedan montadas sobre una vista o sobre la tabla. '
                   'Corre 04 con rehacer despues de este paso: ahi la tabla ya las ve y se '
                   'busca otro hueco.'.format(sheet.SheetNumber, chocan))


# ---------------------------- EJECUCION ----------------------------

laminas = laminas_de_sector()
if not laminas:
    log.append('No hay laminas con vistas de sector que coincidan con el filtro. Se esperan '
               'laminas con vistas "<sector>{}" o "<sector>{}X", creadas por 01 y 02.'.format(
                   SUF_PLANTA, SUF_ELEV))
else:
    TransactionManager.Instance.EnsureInTransaction(doc)

    if leyendas_pedidas:
        catalogo = leyendas_del_modelo()
        tipo_sin_titulo = tipo_viewport_leyenda()
        estampadas = 0
        for sh, sector, vistas in laminas:
            estampadas += colocar_leyendas(sh, catalogo, tipo_sin_titulo, sh.SheetNumber)
        log.append('{} leyenda(s) estampadas en {} lamina(s) de sector.'.format(
            estampadas, len(laminas)))

    if lamina_diagnostico:
        diagnostico_notas(lamina_diagnostico)
    crear_notas(laminas)

    TransactionManager.Instance.ForceCloseTransaction()

OUT = log
# ----------------------------------------
log = Watch(py_leyendas_y_notas_de_la_lamina)  # graph output
