# Dynamo graph 06_Luminarias - tags Lx.dyn (Dynamo 4.0.2.3852)
# Numera las luminarias L1, L2, L3... barriendo la planta en sentido horario y estampa el codigo en la planta y en las elevaciones de cada sector.

n01_procesar_todos_los_sectores = BoolSelector(false)  # "01. Procesar TODOS los sectores"; graph input
n02_filtro_de_sectores_si_todos = StringInput("SECTOR A")  # "02. Filtro de sectores (si TODOS = False)"; graph input
n03_la_familia_de_la_luminaria = StringInput("")  # "03. La familia de la luminaria CONTIENE (vacio = todas)"; graph input
n04_parametro_donde_se_escribe_el = StringInput("LUMINARIAS")  # "04. Parametro donde se escribe el codigo Lx"; graph input
n05_parametro_numerico_de_orden = StringInput("ORDEN_LUM")  # "05. Parametro numerico de orden (lo lee 07 para ordenar)"; graph input
n06_prefijo_del_codigo = StringInput("L")  # "06. Prefijo del codigo"; graph input
n07_tipo_de_texto_con_que_se = StringInput("2mm wf 0.85 RomanD")  # "07. Tipo de texto con que se dibuja el tag"; graph input
n08_separacion_del_tag_respecto_a = IntegerSlider(4, range=0..40 step 1)  # "08. Separacion del tag respecto a la luminaria (mm)"; graph input
n09_separacion_minima_entre_dos = IntegerSlider(6, range=0..40 step 1)  # "09. Separacion minima entre dos tags (mm)"; graph input
n10_vista_de_planta_que_fija_la = StringInput("")  # "10. Vista de planta que fija la orientacion (vacio = ejes del proyecto)"; graph input
n11_rehacer_los_tags_existentes = BoolSelector(false)  # "11. Rehacer los tags existentes"; graph input
python_script = Python(IN[0]=n01_procesar_todos_los_sectores, IN[1]=n02_filtro_de_sectores_si_todos, IN[2]=n03_la_familia_de_la_luminaria, IN[3]=n04_parametro_donde_se_escribe_el, IN[4]=n05_parametro_numerico_de_orden, IN[5]=n06_prefijo_del_codigo, IN[6]=n07_tipo_de_texto_con_que_se, IN[7]=n08_separacion_del_tag_respecto_a, IN[8]=n09_separacion_minima_entre_dos, IN[9]=n10_vista_de_planta_que_fija_la, IN[10]=n11_rehacer_los_tags_existentes)  # PythonNet3
# ---------- python_script.python (756 lines) ----------
# 06_Luminarias - tags Lx - ILUMINACION
#
# El primero de los DOS PASOS DE LA LUMINARIA. Numera todas las luminarias del modelo con un
# correlativo L1, L2, L3... barriendo la planta en sentido horario, escribe ese codigo en un
# parametro de la luminaria y lo estampa como texto en la planta Y en las cuatro elevaciones
# de cada sector.
#
# El segundo es 07_Luminarias - tabla de alturas, que imprime la TABLA N.2 en cada lamina.
#
# Revit 2027 / Dynamo 4 / CPython3
# IN[0]  = procesar todos los sectores (bool)
# IN[1]  = filtro de sectores si IN[0] es False (parcial, comas)
# IN[2]  = la familia de la luminaria CONTIENE (string; vacio = todas las Lighting Fixtures)
# IN[3]  = parametro donde se escribe el codigo Lx (string, ej. LUMINARIAS)
# IN[4]  = parametro numerico donde se escribe el orden, para que 07 pueda ordenar la tabla
#          (string, ej. ORDEN_LUM); lo crea este paso si no existe
# IN[5]  = prefijo del codigo (string, ej. L)
# IN[6]  = tipo de texto con que se dibuja el tag (string)
# IN[7]  = separacion del tag respecto a la luminaria, en mm de papel
# IN[8]  = separacion minima entre dos tags, en mm de papel
# IN[9]  = vista de planta que fija la orientacion del barrido (string; vacio = ejes X/Y del
#          proyecto)
# IN[10] = rehacer: borra los tags que ya estan puestos y los vuelve a escribir
#
#
# EL CRITERIO SE DECIDE EN LA PLANTA, LAS ELEVACIONES SOLO LO LEEN
#
# El numero de una luminaria no se puede deducir mirandola: sale de DONDE ESTA respecto de
# las demas. Por eso el barrido se hace una sola vez, sobre la planta, el resultado se guarda
# en el parametro de IN[3], y todo lo demas -el texto de la planta, el texto de cada
# elevacion y la fila de la tabla de 07- lee ese parametro.
#
# En una elevacion no habria forma de recalcularlo: la elevacion ve una franja del edificio y
# no sabe que hay detras, asi que un barrido hecho ahi daria otros numeros. Que las cuatro
# elevaciones y la planta digan lo mismo no es una comprobacion que haya que hacer: es una
# consecuencia de que el dato exista en un solo lugar.
#
#
# EL BARRIDO HORARIO
#
# Se ordenan las luminarias por el ANGULO con que se las ve desde el centro de la planta,
# arrancando en LA LUMINARIA DE MAS ARRIBA A LA IZQUIERDA y girando en sentido horario hasta
# volver a ella. Es literalmente una manilla de reloj que arranca a las 10:30 y da una vuelta
# entera.
#
#   L1 -> L2 -> L3 -> L4
#    ^  +--------------+  |
#    |  |              |  v
#   L12 |   (centro)   |  L5      inicio: hacia la esquina superior izquierda
#    ^  |              |  |       giro:   horario
#    |  +--------------+  v
#   L11 <- L10 <- L9 <- L8
#
# Es un criterio poco comun -lo natural seria de arriba a abajo y de izquierda a derecha- pero
# es el que piden los ingenieros y no se discute desde el graph.
#
# EL ARRANQUE ES UNA LUMINARIA, NO UN ANGULO, y esto no es un detalle de implementacion: es la
# correccion de un bug que dio vuelta el resultado. La primera version arrancaba en la
# direccion fija de 135 grados, dando por sentado que la esquina superior izquierda esta a 135
# grados del centro. Solo lo esta si la planta es CUADRADA. En SECTOR A la luminaria de la
# esquina quedaba un pelo pasada de esa raya, el modulo la mandaba al final de la vuelta y se
# llevaba el ULTIMO numero en vez del primero -justo la que cualquiera mira para comprobar que
# el barrido esta bien-.
#
# Ahora la semilla es la luminaria mas cercana al vertice superior izquierdo del rectangulo
# envolvente, y la vuelta se corta encima de ella: su giro es (a - a) % 2*pi, cero exacto en
# cualquier maquina. El error no se atenuo, se quedo sin borde donde ocurrir.
#
# EL CENTRO es el centro del RECTANGULO ENVOLVENTE de las luminarias, no el promedio de sus
# posiciones. Suena parecido y no lo es: el promedio se corre hacia donde haya mas luminarias
# juntas, asi que un racimo denso en una esquina moveria el centro y con el, el orden de todo
# el resto. El rectangulo envolvente depende solo de los cuatro extremos, que es lo que
# cualquiera entiende por "el centro del plano".
#
# LOS EMPATES -dos luminarias exactamente en la misma direccion desde el centro- se rompen
# por distancia al centro, de adentro hacia afuera, y a igualdad de todo por id de elemento.
# Es una regla arbitraria y esta bien que lo sea: lo unico que importa es que sea ESTABLE,
# porque un plano ya emitido tiene que seguir coincidiendo con el modelo. El log dice cuantos
# empates hubo, que es la unica forma de enterarse de que la regla estuvo en juego.
#
#
# LA NUMERACION ES GLOBAL DEL MODELO, NO POR SECTOR
#
# L1..Ln recorre TODAS las luminarias del modelo de una sola vez. Una luminaria se llama igual
# en todos los planos donde salga.
#
# Es lo contrario de lo que hace el ITEM de la TABLA N.1 de 04, que reinicia en cada sector, y
# el motivo de la diferencia es para que sirve cada numero: el ITEM del riel es un renglon de
# cantidades -tiene que ser un correlativo sin huecos dentro de su tabla- mientras que el Lx
# de la luminaria es un NOMBRE, y un nombre que significa dos cosas distintas segun la hoja no
# es un nombre.
#
# La consecuencia visible: la tabla de un sector no arranca en L1 ni lleva numeros seguidos.
# Va a decir L3, L7, L8, L15... y eso es correcto.
#
# Por eso este paso ESCRIBE EL PARAMETRO EN TODAS LAS LUMINARIAS DEL MODELO aunque se corra
# filtrando un solo sector: si escribiera solo las del sector procesado, el correlativo
# dependeria de por cual sector se empezo.
#
#
# ES UN TextNote, NO UN IndependentTag
#
# Misma decision que los tags de riel de 03, y por el mismo motivo: el modelo no tiene una
# familia de etiqueta de luminaria que dibuje el parametro donde vive el codigo, y ninguna API
# dice que parametro dibuja el label de una anotacion. El plano de referencia tampoco usa un
# tag.
#
# El texto va ABAJO de la luminaria y centrado con ella. La colocacion prueba primero ese
# lugar y solo se corre si esta tomado, empezando por los que siguen quedando abajo.
#
# La diferencia con 03: aca los textos van SIN FLECHA y UNO POR LUMINARIA. Los tags de riel se
# agrupan -un R-04 con flechas a los seis rieles de 400 que tiene cerca- porque el codigo del
# riel es un TIPO y repetirlo seis veces no agrega nada. El Lx es una IDENTIDAD: agrupar dos
# seria borrar justamente el dato que se quiere mostrar.
#
# Lo que se pierde es la asociatividad: si alguien mueve una luminaria, el numero miente hasta
# que se vuelva a correr el paso con rehacer.
#
#
# QUE PASA CON LAS LUMINARIAS DE EMERGENCIA
#
# Hoy nada: entran en la misma numeracion que las demas. El modelo tiene el parametro de tipo
# "EMERGENCY LIGHT" y hoy vale 0 en los dos tipos cargados, asi que no hay ninguna. Cuando las
# haya hay que decidir si comparten esta secuencia o llevan la suya, porque la NOTA 5 las
# manda a una tabla aparte, la N.3. Ver el README.

import clr
import math
import os
import re
import hashlib
import tempfile
clr.AddReference('RevitAPI')
clr.AddReference('RevitServices')
from Autodesk.Revit.DB import (FilteredElementCollector, ViewPlan, ViewSection, ViewSchedule,
                               XYZ, Element, ElementId, BuiltInCategory, StorageType,
                               FamilyInstance, TextNote, TextNoteType, ElementTypeGroup,
                               HorizontalTextAlignment, VerticalTextAlignment,
                               CategorySet, GroupTypeId, SpecTypeId,
                               ExternalDefinitionCreationOptions)
from RevitServices.Persistence import DocumentManager
from RevitServices.Transactions import TransactionManager
from System import Guid

doc = DocumentManager.Instance.CurrentDBDocument
app = doc.Application

process_all = bool(IN[0])
filter_text = (IN[1] or '').strip()
fam_contiene = (IN[2] or '').strip()
param_codigo = (IN[3] or 'LUMINARIAS').strip()
param_orden = (IN[4] or 'ORDEN_LUM').strip()
prefijo = (IN[5] or 'L').strip() or 'L'
tipo_texto_nombre = (IN[6] or '').strip()
sep_tag_mm = float(IN[7]) if IN[7] is not None else 4.0
sep_min_mm = float(IN[8]) if IN[8] is not None else 6.0
vista_orientacion = (IN[9] or '').strip()
rehacer = bool(IN[10])

log = []
# se avisa una sola vez aunque fallen los 125 tags: el motivo seria el mismo en todos
aviso_alineacion = False

# --- contrato de nombres con 00_Vistas de sector ---
SUF_PLANTA = ' - PLANTA'
SUF_ELEV = ' - ELEV '

RE_CODIGO = re.compile(r'^' + re.escape(prefijo) + r'\d+$')

DOS_PI = 2.0 * math.pi
# Angulo por debajo del cual dos luminarias se consideran en la misma direccion desde el
# centro. Ver empates en barrido_horario.
TOL_ANG = 1e-9


def elem_name(e):
    try:
        return Element.Name.GetValue(e)
    except Exception:
        try:
            return e.Name
        except Exception:
            return ''


def coincide(nombre, texto):
    # filtro parcial separado por comas, insensible a mayusculas. Mismo criterio que usan
    # 00, 01, 02, 03 y 04 para elegir sectores.
    if not texto:
        return True
    alto = (nombre or '').upper()
    for t in texto.split(','):
        t = t.strip().upper()
        if t and t in alto:
            return True
    return False


def fam_name(el):
    try:
        return el.Symbol.Family.Name or ''
    except Exception:
        return ''


def es_luminaria(el):
    # La categoria ya hace casi todo el trabajo -Lighting Fixtures no tiene nada mas adentro-
    # asi que el filtro de familia arranca vacio. Esta por si algun dia conviven la luminaria
    # de proyecto y una de catalogo que no se documenta.
    if not fam_contiene:
        return True
    return fam_contiene.upper() in fam_name(el).upper()


def luminarias_del_modelo():
    return [el for el in FilteredElementCollector(doc)
            .OfCategory(BuiltInCategory.OST_LightingFixtures)
            .WhereElementIsNotElementType()
            if isinstance(el, FamilyInstance) and es_luminaria(el)]


# ---------------------------- EL BARRIDO ----------------------------

def ejes_del_barrido():
    # Los ejes con que se lee "arriba" e "izquierda". Por defecto los del proyecto, que es lo
    # que ve alguien mirando la planta. Si el modelo trabaja girado se le puede pasar el
    # nombre de una vista de planta y se usan los de ella.
    if vista_orientacion:
        for v in FilteredElementCollector(doc).OfClass(ViewPlan):
            if v.IsTemplate:
                continue
            if elem_name(v) == vista_orientacion:
                return v.RightDirection.Normalize(), v.UpDirection.Normalize()
        log.append('AVISO: no existe la vista de planta "{}"; el barrido usa los ejes X/Y '
                   'del proyecto.'.format(vista_orientacion))
    return XYZ(1, 0, 0), XYZ(0, 1, 0)


def centro_de(el, ex, ey):
    bb = el.get_BoundingBox(None)
    if bb is None:
        return None
    c = XYZ((bb.Min.X + bb.Max.X) / 2.0,
            (bb.Min.Y + bb.Max.Y) / 2.0,
            (bb.Min.Z + bb.Max.Z) / 2.0)
    return c.DotProduct(ex), c.DotProduct(ey)


def barrido_horario(luminarias, ex, ey):
    # Devuelve las luminarias en el orden en que las va tocando la manilla, y de paso cuenta
    # los empates de angulo, que son el unico caso donde el orden lo decide una regla
    # arbitraria en vez de la geometria.
    puntos = []
    sin_bbox = 0
    for el in luminarias:
        c = centro_de(el, ex, ey)
        if c is None:
            sin_bbox += 1
            continue
        puntos.append((el, c[0], c[1]))
    if sin_bbox:
        log.append('AVISO: {} luminaria(s) sin geometria medible; no entran en la '
                   'numeracion.'.format(sin_bbox))
    if not puntos:
        return []

    us = [p[1] for p in puntos]
    ws = [p[2] for p in puntos]
    u_min, u_max = min(us), max(us)
    w_min, w_max = min(ws), max(ws)
    # el centro del RECTANGULO ENVOLVENTE, no el promedio: ver el encabezado
    u_c = (u_min + u_max) / 2.0
    w_c = (w_min + w_max) / 2.0

    # LA MANILLA ARRANCA SOBRE UNA LUMINARIA, NO SOBRE UN ANGULO.
    #
    # La semilla es la mas cercana al vertice superior izquierdo del rectangulo envolvente:
    # exactamente la que alguien senalaria con el dedo diciendo "esa, la de mas arriba a la
    # izquierda". Se le da el 1 y el resto sale girando horario desde ella.
    #
    # Antes el arranque era la direccion fija de 135 grados, y estaba mal por una razon que
    # no se ve leyendo el codigo: la luminaria de la esquina NO esta a 135 grados del centro
    # salvo que la planta sea cuadrada. Si quedaba un pelo pasada de esa raya, el modulo la
    # mandaba a giro ~= 2*pi y se llevaba el ULTIMO numero en vez del primero. Paso de verdad
    # con la primera corrida sobre SECTOR A.
    #
    # Anclando en la semilla el problema desaparece de raiz, no se atenua: su propio giro es
    # (a - a) % 2*pi, que da CERO exacto en cualquier maquina. No hay borde donde caerse
    # porque el corte de la vuelta esta puesto justo encima de la luminaria que tiene que
    # abrirla.
    semilla = min(puntos, key=lambda it: (math.hypot(it[1] - u_min, it[2] - w_max),
                                          it[0].Id.Value))
    ang_inicio = math.atan2(semilla[2] - w_c, semilla[1] - u_c)

    claves = []
    for el, u, w in puntos:
        du, dw = u - u_c, w - w_c
        ang = math.atan2(dw, du)
        # cuanto giro horario hace falta desde la semilla para llegar hasta aca. Horario es
        # angulo DECRECIENTE, de ahi la resta.
        giro = (ang_inicio - ang) % DOS_PI
        # Una que este en la MISMA direccion que la semilla puede caer del lado de arriba del
        # modulo -giro ~= 2*pi- por el signo del error de punto flotante. Es el unico resto
        # del problema anterior, y aca se cierra: se la trae al arranque y el desempate por
        # distancia decide cual va primero.
        if giro > DOS_PI - TOL_ANG:
            giro = 0.0
        claves.append((giro, math.hypot(du, dw), el.Id.Value, el))

    claves.sort(key=lambda k: (k[0], k[1], k[2]))

    empates = 0
    for i in range(1, len(claves)):
        if abs(claves[i][0] - claves[i - 1][0]) < TOL_ANG:
            empates += 1
    if empates:
        log.append('AVISO: {} par(es) de luminarias caen en la misma direccion exacta desde '
                   'el centro. Entre ellas el orden lo decide la distancia al centro, de '
                   'adentro hacia afuera.'.format(empates))

    # Se dice cual abrio la vuelta: es lo primero que hay que mirar en el plano para saber si
    # el barrido arranco donde se esperaba, y no hay otra forma de verlo sin contar tags.
    log.append('El barrido arranca en la luminaria id {} -la mas cercana al vertice superior '
               'izquierdo- y gira horario desde ahi.'.format(semilla[0].Id.Value))

    return [k[3] for k in claves]


# ---------------------------- LOS PARAMETROS ----------------------------

def guid_para(nombre):
    # GUID derivado del nombre, igual que en 04: el parametro creado es el MISMO en todos los
    # modelos de la oficina sin depender de un archivo de parametros compartidos versionado.
    h = hashlib.md5(('ELE01_TBL::' + nombre.upper()).encode('utf-8')).hexdigest()
    return Guid(h)


def existe_como_campo(nombre):
    # Que Revit lo ofrezca como CAMPO DE SCHEDULE. Hace falta porque 07 lo va a usar como
    # columna, y un parametro de familia existe en el elemento pero no se puede poner en una
    # tabla.
    try:
        probe = ViewSchedule.CreateSchedule(doc, ElementId(BuiltInCategory.OST_LightingFixtures))
    except Exception:
        return False
    try:
        for f in probe.Definition.GetSchedulableFields():
            try:
                if f.GetName(doc) == nombre:
                    return True
            except Exception:
                continue
        return False
    finally:
        try:
            doc.Delete(probe.Id)
        except Exception:
            pass


def existe_en_luminarias(nombre):
    # La prueba que importa para ESCRIBIR. No alcanza con que el schedule lo ofrezca: el
    # 2026-08-19, en el paso 04, "ITEM_TBL" aparecia entre los campos schedulables y ningun
    # elemento del modelo lo tenia, asi que el guard daba por hecho que existia, no lo creaba
    # nunca y la columna salia vacia corrida tras corrida.
    #
    # Se mira una sola luminaria porque el parametro se vincula por CATEGORIA: o lo tienen
    # todas o no lo tiene ninguna.
    for el in luminarias_del_modelo():
        try:
            return el.LookupParameter(nombre) is not None
        except Exception:
            return False
    return False


def asegurar_param(nombre, spec, etiqueta):
    # Crea el parametro como COMPARTIDO y lo vincula como parametro de proyecto de instancia
    # de Lighting Fixtures. Misma maquinaria que 04.
    #
    # Ojo: si el parametro YA EXISTE en el modelo -como "LUMINARIAS", que viene con la familia
    # y tiene su propio GUID- esta funcion sale por la primera linea y no lo toca. Recrearlo
    # con el GUID derivado del nombre seria fabricar un segundo parametro homonimo.
    if existe_como_campo(nombre) and existe_en_luminarias(nombre):
        return True
    log.append('El parametro "{}" falta o esta a medias; se (re)crea y se vincula a '
               'Lighting Fixtures.'.format(nombre))
    ruta = os.path.join(tempfile.gettempdir(), 'ELE01_params_tabla.txt')
    if not os.path.exists(ruta):
        # el archivo de parametros compartidos es un TSV con esta cabecera exacta; Revit no
        # lo crea solo y sin el OpenSharedParameterFile devuelve None
        tab = '\t'
        cab = ['# This is a Revit shared parameter file.',
               '*META' + tab + 'VERSION' + tab + 'MINVERSION',
               'META' + tab + '2' + tab + '1',
               '*GROUP' + tab + 'ID' + tab + 'NAME',
               '*PARAM' + tab + tab.join(['GUID', 'NAME', 'DATATYPE', 'DATACATEGORY',
                                          'GROUP', 'VISIBLE', 'DESCRIPTION',
                                          'USERMODIFIABLE', 'HIDEWHENNOVALUE'])]
        with open(ruta, 'w') as f:
            f.write('\n'.join(cab) + '\n')
    anterior = None
    try:
        anterior = app.SharedParametersFilename
    except Exception:
        pass
    try:
        app.SharedParametersFilename = ruta
        df = app.OpenSharedParameterFile()
        if df is None:
            log.append('ERROR: no se pudo abrir el archivo temporal de parametros compartidos.')
            return False
        grupo = None
        for g in df.Groups:
            if g.Name == 'TABLA_ILUMINACION':
                grupo = g
                break
        if grupo is None:
            grupo = df.Groups.Create('TABLA_ILUMINACION')
        defn = None
        for d in grupo.Definitions:
            if d.Name == nombre:
                defn = d
                break
        if defn is None:
            opts = ExternalDefinitionCreationOptions(nombre, spec)
            opts.GUID = guid_para(nombre)
            opts.Visible = True
            defn = grupo.Definitions.Create(opts)
        cats = CategorySet()
        cats.Insert(doc.Settings.Categories.get_Item(BuiltInCategory.OST_LightingFixtures))
        binding = app.Create.NewInstanceBinding(cats)
        ok = False
        try:
            ok = doc.ParameterBindings.Insert(defn, binding, GroupTypeId.Data)
        except Exception:
            try:
                ok = doc.ParameterBindings.Insert(defn, binding)
            except Exception:
                ok = False
        if not ok:
            try:
                ok = doc.ParameterBindings.ReInsert(defn, binding)
            except Exception:
                ok = False
        if ok:
            log.append('Se creo el parametro de proyecto "{}" (instancia, Lighting Fixtures) '
                       'para {}.'.format(nombre, etiqueta))
        else:
            log.append('ERROR: no se pudo crear ni vincular el parametro "{}"; sin el, {} no '
                       'va a funcionar.'.format(nombre, etiqueta))
        return ok
    except Exception as e:
        log.append('ERROR creando el parametro "{}": {}'.format(nombre, e))
        return False
    finally:
        try:
            if anterior is not None:
                app.SharedParametersFilename = anterior
        except Exception:
            pass


def set_string(el, nombre, valor):
    if not nombre:
        return None
    try:
        p = el.LookupParameter(nombre)
    except Exception:
        return None
    if p is None or p.IsReadOnly or p.StorageType != StorageType.String:
        return False
    try:
        if (p.AsString() or '') != valor:
            p.Set(valor)
        return True
    except Exception:
        return False


def set_double(el, nombre, valor):
    if not nombre:
        return None
    try:
        p = el.LookupParameter(nombre)
    except Exception:
        return None
    if p is None or p.IsReadOnly or p.StorageType != StorageType.Double:
        return False
    try:
        if abs((p.AsDouble() or 0.0) - valor) > 1e-9:
            p.Set(valor)
        return True
    except Exception:
        return False


def numerar(ordenadas):
    # Escribe el codigo y el orden en TODAS las luminarias del modelo. Ver el encabezado: el
    # correlativo es global, asi que no puede depender de que sectores se hayan pedido.
    #
    # El orden va aparte del codigo, en un parametro numerico, porque la tabla de 07 tiene que
    # ordenarse por el y un schedule ordena los textos alfabeticamente: por "LUMINARIAS" la
    # tabla saldria L1, L10, L11, L2. Zero-padear el codigo -L01- lo arreglaria y cambiaria lo
    # que se lee en el plano, que no es negociable.
    codigos = {}
    sin_param = set()
    for i, el in enumerate(ordenadas):
        codigo = '{}{}'.format(prefijo, i + 1)
        codigos[el.Id.Value] = codigo
        if set_string(el, param_codigo, codigo) is False:
            sin_param.add(param_codigo)
        if set_double(el, param_orden, float(i + 1)) is False:
            sin_param.add(param_orden)
    for nombre in sorted(sin_param):
        log.append('AVISO: el parametro "{}" no existe en las luminarias, o es de solo '
                   'lectura. Lo que dependa de el va a salir vacio.'.format(nombre))
    log.append('Numeradas {} luminaria(s) del modelo, de {}1 a {}{}, en "{}".'.format(
        len(ordenadas), prefijo, prefijo, len(ordenadas), param_codigo))
    return codigos


# ---------------------------- LOS TEXTOS ----------------------------

def tipo_de_texto(nombre):
    objetivo = (nombre or '').strip().upper()
    for tt in FilteredElementCollector(doc).OfClass(TextNoteType):
        if objetivo and elem_name(tt).upper() == objetivo:
            return tt.Id
    if objetivo:
        log.append('AVISO: no existe el tipo de texto "{}"; los tags salen con el tipo por '
                   'defecto del proyecto.'.format(nombre))
    return doc.GetDefaultElementTypeId(ElementTypeGroup.TextNoteType)


def vistas_de_sector():
    # Planta Y elevaciones: las luminarias se etiquetan en las cinco vistas del sector. Es la
    # diferencia con 03, que solo toca las plantas -una cota entre rieles no significa nada en
    # una elevacion, pero el numero de una luminaria si-.
    res = []
    for cls in (ViewPlan, ViewSection):
        for v in FilteredElementCollector(doc).OfClass(cls):
            if v.IsTemplate:
                continue
            n = elem_name(v)
            sector = None
            if n.endswith(SUF_PLANTA):
                sector = n[:-len(SUF_PLANTA)]
            else:
                i = n.find(SUF_ELEV)
                if i > 0:
                    sector = n[:i]
            if sector is None:
                continue
            if not process_all and not coincide(sector, filter_text):
                continue
            res.append((v, sector, n))
    res.sort(key=lambda t: t[2])
    return res


def proyectar(p, v):
    # El punto tiene que caer en el plano de la vista. En una planta esto es exactamente
    # "bajar la Z a la del plano"; en una elevacion es apoyar el punto contra el plano de
    # corte. Escrito una sola vez sirve para las dos, que es justamente lo que permite que la
    # planta y las elevaciones compartan todo el resto del codigo.
    n = v.ViewDirection.Normalize()
    d = p.Subtract(v.Origin).DotProduct(n)
    return p.Subtract(n.Multiply(d))


def extremos_en_vista(el, v, ex, ey):
    bb = el.get_BoundingBox(v) or el.get_BoundingBox(None)
    if bb is None:
        return None
    us, ws = [], []
    for x in (bb.Min.X, bb.Max.X):
        for y in (bb.Min.Y, bb.Max.Y):
            for z in (bb.Min.Z, bb.Max.Z):
                p = XYZ(x, y, z)
                us.append(p.DotProduct(ex))
                ws.append(p.DotProduct(ey))
    return min(us), max(us), min(ws), max(ws)


def candidatos(u0, u1, w0, w1, sep):
    # ABAJO Y CENTRADO primero, que es donde va la etiqueta en este plano. Si ese hueco esta
    # tomado se prueba abajo pero corrido a un costado -asi la etiqueta se sigue leyendo como
    # "la de abajo", que es lo que importa-, despues a los lados, y arriba al final. El primero
    # que no pise a otro tag gana.
    uc, wc = (u0 + u1) / 2.0, (w0 + w1) / 2.0
    res = []
    for k in (1.0, 2.0, 3.0):
        d = sep * k
        res.extend([(uc, w0 - d),
                    (u1 + d, w0 - d), (u0 - d, w0 - d),
                    (u1 + d, wc), (u0 - d, wc),
                    (uc, w1 + d),
                    (u1 + d, w1 + d), (u0 - d, w1 + d)])
    return res


def alinear_centrado(tn):
    # El punto que se le pasa a TextNote.Create es un ANCLA, no el centro del texto, y por
    # defecto el ancla es el borde IZQUIERDO. Con la etiqueta al costado eso no se notaba -el
    # texto crecia hacia afuera, que era justo lo que se queria- pero abajo de la luminaria
    # deja el "L7" corrido a la derecha, y con dos digitos se corre mas que con uno: las
    # etiquetas de una misma corrida no quedarian ni alineadas entre si.
    #
    # Centrar el ancla en horizontal y anclarla por arriba en vertical resuelve las dos cosas
    # de una: el texto queda simetrico bajo la luminaria y cuelga hacia abajo, asi que la
    # separacion que se pide en el input es la que se ve en el papel.
    #
    # Va por INSTANCIA y no tocando el tipo de texto: el tipo lo comparten las notas generales
    # de 05 y los tags de riel de 03, y centrarlo ahi les cambiaria la alineacion a todos.
    global aviso_alineacion
    try:
        tn.HorizontalAlignment = HorizontalTextAlignment.Center
        tn.VerticalAlignment = VerticalTextAlignment.Top
    except Exception as e:
        if not aviso_alineacion:
            aviso_alineacion = True
            log.append('AVISO: no se pudo centrar el texto de los tags ({}); van a salir '
                       'abajo de la luminaria pero corridos hacia la derecha.'.format(e))


def taggear_vista(v, codigos, orden_de, tt_id):
    escala = v.Scale or 1
    papel = lambda mm: float(mm) / 304.8 * escala
    sep = papel(sep_tag_mm)
    sep_min = papel(sep_min_mm)

    # Los tags que ya estan en la vista. Si hay alguno y no se pidio rehacer, la vista NO se
    # toca: volver a dibujarlos encima dejaria dos textos identicos superpuestos, que en el
    # plano se ven como uno solo y solo aparecen cuando alguien mueve el de arriba.
    existentes = [tn.Id for tn in FilteredElementCollector(doc, v.Id).OfClass(TextNote)
                  if RE_CODIGO.match((tn.Text or '').strip())]
    if existentes and not rehacer:
        return 0, 0, True
    for tid in existentes:
        # Con rehacer se lleva por delante un texto puesto a mano que diga "L7". Es el mismo
        # trato que dan las cotas de 03 y las notas de 05, por el mismo motivo: estas vistas
        # las mantiene el pipeline y rehacer es explicito.
        try:
            doc.Delete(tid)
        except Exception:
            pass

    lums = [el for el in FilteredElementCollector(doc, v.Id)
            .OfCategory(BuiltInCategory.OST_LightingFixtures)
            .WhereElementIsNotElementType()
            if isinstance(el, FamilyInstance) and es_luminaria(el)]
    if not lums:
        return 0, 0, False

    ex = v.RightDirection.Normalize()
    ey = v.UpDirection.Normalize()

    # se recorren en el orden del barrido para que, cuando dos tags se peleen el mismo hueco,
    # gane el de numero mas bajo y el desempate no dependa del orden en que Revit devolvio los
    # elementos: si dependiera de eso, dos corridas seguidas podrian dar planos distintos
    lums.sort(key=lambda e: orden_de.get(e.Id.Value, 10 ** 9))

    puestos = 0
    encimados = 0
    colocados = []

    for el in lums:
        codigo = codigos.get(el.Id.Value)
        if not codigo:
            continue
        ext = extremos_en_vista(el, v, ex, ey)
        if ext is None:
            continue
        u0, u1, w0, w1 = ext

        elegido = None
        for u, w in candidatos(u0, u1, w0, w1, sep):
            p = proyectar(ex.Multiply(u).Add(ey.Multiply(w)), v)
            libre = True
            for q in colocados:
                if p.DistanceTo(q) < sep_min:
                    libre = False
                    break
            if libre:
                elegido = p
                break
        if elegido is None:
            elegido = proyectar(ex.Multiply((u0 + u1) / 2.0).Add(ey.Multiply(w0 - sep)), v)
            encimados += 1

        try:
            tn = TextNote.Create(doc, v.Id, elegido, codigo, tt_id)
            alinear_centrado(tn)
            colocados.append(elegido)
            puestos += 1
        except Exception:
            pass

    return puestos, encimados, False


# ---------------------------- EJECUCION ----------------------------

luminarias = luminarias_del_modelo()
if not luminarias:
    log.append('No hay luminarias en el modelo (categoria Lighting Fixtures{}). No hay nada '
               'que numerar.'.format(
                   ', familia que contiene "{}"'.format(fam_contiene) if fam_contiene else ''))
else:
    vistas = vistas_de_sector()

    TransactionManager.Instance.EnsureInTransaction(doc)

    asegurar_param(param_codigo, SpecTypeId.String.Text, 'el codigo Lx')
    asegurar_param(param_orden, SpecTypeId.Number, 'que 07 pueda ordenar la tabla')
    # Regenerar entre crear los parametros y escribirlos NO es opcional: un parametro de
    # proyecto recien vinculado no aparece en los elementos hasta que el documento regenera,
    # asi que LookupParameter devuelve None y no se escribe nada. El sintoma es que a la
    # SEGUNDA corrida funciona -porque ahi el parametro ya existia-.
    doc.Regenerate()

    ex, ey = ejes_del_barrido()
    ordenadas = barrido_horario(luminarias, ex, ey)
    codigos = numerar(ordenadas)
    orden_de = dict((el.Id.Value, i) for i, el in enumerate(ordenadas))

    if not vistas:
        log.append('AVISO: no hay vistas de sector que coincidan con el filtro, asi que no se '
                   'dibujo ningun tag. Los parametros SI quedaron escritos: la numeracion es '
                   'global y no depende de que sectores se procesen.')
    else:
        tt_id = tipo_de_texto(tipo_texto_nombre)
        total, total_enc, saltadas = 0, 0, 0
        for v, sector, nombre in vistas:
            puestos, encimados, saltada = taggear_vista(v, codigos, orden_de, tt_id)
            if saltada:
                saltadas += 1
                log.append('  {}: ya tiene tags, se salta. Corre con rehacer para volver a '
                           'dibujarlos.'.format(nombre))
                continue
            total += puestos
            total_enc += encimados
            log.append('  {}: {} tag(s).'.format(nombre, puestos))
        log.insert(0, '{} tag(s) de luminaria en {} vista(s) de sector{}.'.format(
            total, len(vistas) - saltadas,
            ' ({} saltada(s))'.format(saltadas) if saltadas else ''))
        if total_enc:
            log.append('AVISO: {} tag(s) no encontraron hueco libre y quedaron abajo de su '
                       'luminaria, posiblemente encimados con otro. Se ven y se corren a '
                       'mano; subir la separacion minima los separa mas, pero aleja el texto '
                       'de la luminaria que nombra.'.format(total_enc))

    TransactionManager.Instance.ForceCloseTransaction()

OUT = log
# ----------------------------------------
log = Watch(python_script)  # graph output
