# Dynamo graph 07_Luminarias - tabla de alturas.dyn (Dynamo 4.0.2.3852)
# La TABLA N2 -alturas de montaje de luminaria, una fila por luminaria- en cada lamina de sector.

n01_procesar_todos_los_sectores = BoolSelector(false)  # "01. Procesar TODOS los sectores"; graph input
n02_filtro_de_sectores_si_todos = StringInput("SECTOR A")  # "02. Filtro de sectores (si TODOS = False)"; graph input
n03_la_familia_de_la_luminaria = StringInput("")  # "03. La familia de la luminaria CONTIENE (vacio = todas)"; graph input
n04_parametro_del_codigo_lx_lo = StringInput("LUMINARIAS")  # "04. Parametro del codigo Lx (lo escribe 06)"; graph input
n05_parametro_numerico_de_orden = StringInput("ORDEN_LUM")  # "05. Parametro numerico de orden (lo escribe 06)"; graph input
n06_parametro_de_la_altura_de = StringInput("ALTURA_TBL")  # "06. Parametro de la altura de montaje (hoy va vacio)"; graph input
n07_parametro_donde_se_marca_el = StringInput("En plano")  # "07. Parametro donde se marca el sector"; graph input
n08_titulo_de_la_tabla = StringInput("TABLA N°2 (NOTA 5)")  # "08. Titulo de la tabla"; graph input
n09_margen_de_la_lamina_mm_el = IntegerSlider(5, range=0..60 step 1)  # "09. Margen de la lamina (mm) - el mismo que 01 y 02"; graph input
n10_franja_inferior_reservada_de = IntegerSlider(55, range=0..200 step 1)  # "10. Franja inferior reservada de la vineta (mm)"; graph input
n11_ancho_del_cajetin_desde_el = IntegerSlider(290, range=0..600 step 1)  # "11. Ancho del cajetin desde el borde derecho (mm)"; graph input
n12_alto_del_cajetin_mm = IntegerSlider(105, range=0..400 step 1)  # "12. Alto del cajetin (mm)"; graph input
n13_esquina_por_la_que_se_busca = StringInput("abajo-izquierda")  # "13. Esquina por la que se busca hueco"; graph input
n14_rehacer_las_tablas_existentes = BoolSelector(false)  # "14. Rehacer las tablas existentes"; graph input
python_script = Python(IN[0]=n01_procesar_todos_los_sectores, IN[1]=n02_filtro_de_sectores_si_todos, IN[2]=n03_la_familia_de_la_luminaria, IN[3]=n04_parametro_del_codigo_lx_lo, IN[4]=n05_parametro_numerico_de_orden, IN[5]=n06_parametro_de_la_altura_de, IN[6]=n07_parametro_donde_se_marca_el, IN[7]=n08_titulo_de_la_tabla, IN[8]=n09_margen_de_la_lamina_mm_el, IN[9]=n10_franja_inferior_reservada_de, IN[10]=n11_ancho_del_cajetin_desde_el, IN[11]=n12_alto_del_cajetin_mm, IN[12]=n13_esquina_por_la_que_se_busca, IN[13]=n14_rehacer_las_tablas_existentes)  # PythonNet3
# ---------- python_script.python (815 lines) ----------
# 07_Luminarias - tabla de alturas - ILUMINACION
#
# Estampa la TABLA N.2 -la de alturas de montaje de luminaria- en las laminas de sector, una
# por lamina, con una fila por LUMINARIA del sector.
#
#   +---------------------------+
#   |    TABLA N.2 (NOTA 5)     |
#   +------+--------------------+
#   |  LX  | ALTURA DE MONTAJE  |
#   |      |        (mm)        |
#   +------+--------------------+
#   |  L3  |                    |
#   |  L7  |                    |
#   |  L8  |                    |
#   +------+--------------------+
#
# Revit 2027 / Dynamo 4 / CPython3
# IN[0]  = procesar todos los sectores (bool)
# IN[1]  = filtro de sectores si IN[0] es False (parcial, comas)
# IN[2]  = la familia de la luminaria CONTIENE (string; vacio = todas las Lighting Fixtures)
# IN[3]  = parametro donde 06 escribio el codigo Lx (string, ej. LUMINARIAS)
# IN[4]  = parametro numerico donde 06 escribio el orden (string, ej. ORDEN_LUM)
# IN[5]  = parametro donde vive la altura de montaje (string, ej. ALTURA_TBL); lo crea este
#          paso si no existe, y HOY NO LO ESCRIBE NADIE -ver mas abajo-
# IN[6]  = parametro donde se marca en que sector aparece (string, ej. En plano)
# IN[7]  = titulo de la tabla (string)
# IN[8]  = margen de la lamina, en mm - el mismo que usan 01 y 02
# IN[9]  = alto de la franja inferior reservada de la vineta, en mm
# IN[10] = ancho del cajetin medido desde el borde derecho, en mm
# IN[11] = alto del cajetin medido desde el borde inferior, en mm
# IN[12] = esquina por la que se empieza a buscar hueco (abajo-izquierda, abajo-derecha,
#          arriba-derecha, arriba-izquierda)
# IN[13] = rehacer: reconfigura las tablas existentes y las vuelve a colocar
#
#
# UNA FILA POR LUMINARIA, NO POR TIPO. ES LO CONTRARIO DE LA TABLA N.1
#
# La TABLA N.1 de 04 lista TIPOS de riel: colapsa las filas iguales y una fila representa a
# los treinta rieles de 400 mm que hay en el sector. Esta lista INDIVIDUOS: L3 es una
# luminaria y solo una, y su altura de montaje es la de ella.
#
# En la mecanica del schedule eso es exactamente "Itemize every instance" encendido, que es el
# opuesto de lo que hace 04. Vale la pena decirlo porque es el unico parametro que separa una
# tabla de la otra, y confundirlo da una tabla que se ve razonable y esta mal: con itemize
# apagado, dos luminarias a la misma altura colapsarian en una sola fila y el plano perderia
# una luminaria sin avisar.
#
#
# LA COLUMNA DE ALTURA VA VACIA A PROPOSITO
#
# Este paso CREA el parametro de la altura y le hace la columna, pero no escribe ni un valor.
# No es un olvido ni una etapa a medio hacer: es que todavia no esta decidido de donde sale el
# numero, y las opciones dan resultados distintos.
#
# Lo que se sabe: las luminarias NO estan asociadas a un nivel -Level vale -1 y "Elevation
# from Level" vale 0 en todas- asi que no hay ningun parametro que ya traiga la altura. Habria
# que calcularla, y la NOTA 5 dice de donde: "desde el N.P.T. en plataforma de transito
# peatonal (GRATING)". O sea, contra el grating que cada luminaria tenga debajo, no contra una
# cota fija del proyecto.
#
# Medir la Z cruda sobre "nivel 1 luminarias" -que esta en cota 0- seria lo comodo y daria
# valores como 5918 o 7669 mm. La tabla del plano de referencia dice 4900, 4000, 5200: numeros
# redondos, que no son esas Z ni sus redondeos. La diferencia es precisamente el grating.
#
# Escribir un numero calculado con la regla equivocada seria peor que dejar la columna vacia,
# porque una altura mal puesta se ve igual de bien que una altura correcta hasta que alguien
# va a instalar. La columna vacia se ve.
#
# Cuando se decida la regla, lo unico que hay que agregar es el calculo y un set_string sobre
# el parametro de IN[5]: la columna, el orden y el filtro ya estan.
#
# POR ESO EL PARAMETRO ES DE TEXTO Y NO NUMERICO. Un parametro numerico que nadie escribio
# puede imprimir un 0, y un 0 en una columna de alturas es un dato falso; uno de texto sin
# escribir imprime la celda vacia, que es lo que hay que ver. Ademas el valor final es un
# entero de milimetros sin unidades ni decimales, asi que el texto lo guarda tal cual y no
# hace falta la maquinaria de FormatOptions que si necesito el LARGO de la TABLA N.1.
#
#
# EL ORDEN DE LAS FILAS NO SALE DE LA COLUMNA QUE SE VE
#
# La tabla va ordenada L1, L2, L3... y esa columna es TEXTO, asi que ordenar por ella daria
# L1, L10, L11, L12, ..., L2, L20. Un schedule no sabe que "L10" es un numero.
#
# Por eso 06 escribe ademas el orden en un parametro numerico (IN[4]) que este paso agrega
# como campo OCULTO y usa para ordenar. La alternativa -escribir el codigo con ceros adelante,
# L01- ordenaria bien y cambiaria lo que se lee en el plano, que es lo unico que no se toca.
#
#
# QUE LAMINAS TOCA Y QUE FILAS LLEVA CADA TABLA
#
# Las laminas que tienen vistas del pipeline, reconocidas por el MISMO contrato de nombres que
# comparten 00, 01, 02, 03, 04 y 06: "<sector> - PLANTA" y "<sector> - ELEV X".
#
# Las filas son las luminarias que se ven en las vistas del SECTOR -la union de sus laminas-,
# no solo las de la hoja que uno tiene delante. Es el mismo criterio que la TABLA N.1, aunque
# aca no hay ninguna obligacion tecnica de que lo sea: en 04 la tabla TIENE que ser por sector
# porque el ITEM es un correlativo que vive en el riel, y aca el codigo Lx es global y una
# luminaria puede salir en cuantas tablas haga falta sin ambiguedad. Es por consistencia: las
# dos tablas del plano se leen con la misma regla.
#
# Y una consecuencia de que el Lx sea global: una luminaria que se vea en DOS sectores no es
# un error. Sale en las dos tablas, con el mismo numero en las dos. En 04 el mismo caso es un
# ERROR en el log, porque ahi el riel necesitaria dos ITEM a la vez.
#
#
# COMO SABE EL SCHEDULE QUE LUMINARIAS SON DE SU SECTOR
#
# Igual que 04 y por el mismo motivo -un schedule no puede filtrar por "esta dibujado en tal
# lamina"-: este paso escribe el sector en el parametro de IN[6], por defecto "En plano", con
# punto y coma alrededor (";SECTOR A;"), y el schedule filtra por "contiene ;SECTOR A;". Sin
# los delimitadores, SECTOR A se llevaria tambien las de SECTOR A2.
#
# El campo del filtro se agrega OCULTO: hace falta que este entre los campos para poder
# filtrar por el, pero no tiene que salir impreso.
#
#
# DONDE SE PARA, Y POR QUE ESTE PASO SI MIRA LAS OTRAS TABLAS
#
# Mismo barrido en grilla que 04: la primera posicion libre mas cercana a la esquina pedida,
# midiendo la tabla despues de colocarla en vez de estimarla.
#
# Con una diferencia que hubo que agregar: lo ocupado incluye LAS OTRAS TABLAS DE LA LAMINA.
# 04 no las miraba -no le hacia falta, era la unica tabla del plano- y en cuanto aparecio una
# segunda las dos se disputaban el mismo hueco y quedaban encimadas. Se excluye la propia,
# porque se coloca antes de medirla y si no se excluyera se bloquearia a si misma.
#
# La esquina por defecto es abajo-IZQUIERDA, la contraria a la de 04, para que en el caso
# normal ni siquiera tengan que negociar.

import clr
import math
import os
import hashlib
import tempfile
clr.AddReference('RevitAPI')
clr.AddReference('RevitServices')
from Autodesk.Revit.DB import (FilteredElementCollector, ViewSheet, ViewSchedule,
                               ScheduleSheetInstance, ScheduleFilter, ScheduleFilterType,
                               ScheduleSortGroupField, Viewport, XYZ, Element,
                               ElementId, BuiltInCategory, StorageType,
                               FamilyInstance, SectionType,
                               CategorySet, GroupTypeId, SpecTypeId,
                               ExternalDefinitionCreationOptions)
from RevitServices.Persistence import DocumentManager
from RevitServices.Transactions import TransactionManager
from System import Guid

doc = DocumentManager.Instance.CurrentDBDocument
app = doc.Application

process_all = bool(IN[0])
filter_text = (IN[1] or '').strip()
fam_contiene = (IN[2] or '').strip()
param_codigo = (IN[3] or 'LUMINARIAS').strip()
param_orden = (IN[4] or 'ORDEN_LUM').strip()
param_altura = (IN[5] or 'ALTURA_TBL').strip()
param_lamina = (IN[6] or 'En plano').strip()
titulo_tabla = (IN[7] or 'TABLA N2').strip()
margen = float(IN[8]) / 304.8
franja_inferior = float(IN[9]) / 304.8
cajetin_ancho = float(IN[10]) / 304.8
cajetin_alto = float(IN[11]) / 304.8
esquina = (IN[12] or 'abajo-izquierda').strip().lower()
rehacer = bool(IN[13])

log = []

# --- contrato de nombres con 00_Vistas de sector ---
SUF_PLANTA = ' - PLANTA'
SUF_ELEV = ' - ELEV '

PREFIJO_SCHEDULE = 'TBL_LUM_'

H_CODIGO = 'LX'
H_ALTURA = 'ALTURA DE MONTAJE (mm)'

# Paso de la grilla con que se barre la lamina buscando hueco, en mm de papel. El mismo que
# 04: mas fino que cualquier ajuste que alguien haga despues a mano.
PASO_BUSQUEDA = 5.0 / 304.8


def elem_name(e):
    try:
        return Element.Name.GetValue(e)
    except Exception:
        try:
            return e.Name
        except Exception:
            return ''


def coincide(nombre, texto):
    if not texto:
        return True
    alto = (nombre or '').upper()
    for t in texto.split(','):
        t = t.strip().upper()
        if t and t in alto:
            return True
    return False


def fam_name(el):
    try:
        return el.Symbol.Family.Name or ''
    except Exception:
        return ''


def es_luminaria(el):
    if not fam_contiene:
        return True
    return fam_contiene.upper() in fam_name(el).upper()


def luminarias_del_modelo():
    return [el for el in FilteredElementCollector(doc)
            .OfCategory(BuiltInCategory.OST_LightingFixtures)
            .WhereElementIsNotElementType()
            if isinstance(el, FamilyInstance) and es_luminaria(el)]


def sector_de_vista(v):
    n = elem_name(v)
    if n.endswith(SUF_PLANTA):
        return n[:-len(SUF_PLANTA)]
    i = n.find(SUF_ELEV)
    if i > 0:
        return n[:i]
    return None


def laminas_de_sector():
    # Lamina -> (sector, [vistas]). Una lamina es del pipeline si tiene alguna vista que
    # cumple el contrato de nombres; por la regla de aislamiento de 01, todas sus vistas de
    # sector son del mismo sector.
    res = []
    for sh in FilteredElementCollector(doc).OfClass(ViewSheet):
        if sh.IsTemplate:
            continue
        vistas = []
        sectores = set()
        for vp in FilteredElementCollector(doc, sh.Id).OfClass(Viewport):
            v = doc.GetElement(vp.ViewId)
            if v is None:
                continue
            s = sector_de_vista(v)
            if s is None:
                continue
            vistas.append(v)
            sectores.add(s)
        if not vistas:
            continue
        sector = sorted(sectores)[0]
        if len(sectores) > 1:
            log.append('AVISO: la lamina {} tiene vistas de mas de un sector ({}). La tabla '
                       'igual lista lo que se ve en la lamina, pero eso rompe la regla de '
                       'aislamiento que fija 01.'.format(sh.SheetNumber,
                                                         ', '.join(sorted(sectores))))
        if not process_all and not coincide(sector, filter_text):
            continue
        res.append((sh, sector, vistas))
    res.sort(key=lambda t: t[0].SheetNumber)
    return res


def luminarias_de_lamina(vistas):
    # Union de las luminarias visibles en cada viewport de la lamina. Se recolecta CONTRA LA
    # VISTA, asi que el crop, el view range y lo oculto ya deciden que se ve y que no.
    vistos = {}
    for v in vistas:
        for el in (FilteredElementCollector(doc, v.Id)
                   .OfCategory(BuiltInCategory.OST_LightingFixtures)
                   .WhereElementIsNotElementType()):
            if isinstance(el, FamilyInstance) and es_luminaria(el):
                vistos[el.Id.Value] = el
    return list(vistos.values())


# ---------------------------- LOS PARAMETROS ----------------------------

def guid_para(nombre):
    h = hashlib.md5(('ELE01_TBL::' + nombre.upper()).encode('utf-8')).hexdigest()
    return Guid(h)


def existe_como_campo(nombre):
    try:
        probe = ViewSchedule.CreateSchedule(doc, ElementId(BuiltInCategory.OST_LightingFixtures))
    except Exception:
        return False
    try:
        for f in probe.Definition.GetSchedulableFields():
            try:
                if f.GetName(doc) == nombre:
                    return True
            except Exception:
                continue
        return False
    finally:
        try:
            doc.Delete(probe.Id)
        except Exception:
            pass


def existe_en_luminarias(nombre):
    # Las dos pruebas hacen falta: que el schedule lo ofrezca como campo Y que las luminarias
    # de verdad lo tengan. Ver la nota de 04 sobre ITEM_TBL, que aparecia como campo sin que
    # ningun elemento lo tuviera y por eso no se creaba nunca.
    for el in luminarias_del_modelo():
        try:
            return el.LookupParameter(nombre) is not None
        except Exception:
            return False
    return False


def asegurar_param(nombre, spec, etiqueta):
    # Identica a la de 06 salvo el mensaje: crea el parametro como compartido, con GUID
    # derivado del nombre, y lo vincula como parametro de instancia de Lighting Fixtures.
    if existe_como_campo(nombre) and existe_en_luminarias(nombre):
        return True
    log.append('El parametro "{}" falta o esta a medias; se (re)crea y se vincula a '
               'Lighting Fixtures.'.format(nombre))
    ruta = os.path.join(tempfile.gettempdir(), 'ELE01_params_tabla.txt')
    if not os.path.exists(ruta):
        tab = '\t'
        cab = ['# This is a Revit shared parameter file.',
               '*META' + tab + 'VERSION' + tab + 'MINVERSION',
               'META' + tab + '2' + tab + '1',
               '*GROUP' + tab + 'ID' + tab + 'NAME',
               '*PARAM' + tab + tab.join(['GUID', 'NAME', 'DATATYPE', 'DATACATEGORY',
                                          'GROUP', 'VISIBLE', 'DESCRIPTION',
                                          'USERMODIFIABLE', 'HIDEWHENNOVALUE'])]
        with open(ruta, 'w') as f:
            f.write('\n'.join(cab) + '\n')
    anterior = None
    try:
        anterior = app.SharedParametersFilename
    except Exception:
        pass
    try:
        app.SharedParametersFilename = ruta
        df = app.OpenSharedParameterFile()
        if df is None:
            log.append('ERROR: no se pudo abrir el archivo temporal de parametros compartidos.')
            return False
        grupo = None
        for g in df.Groups:
            if g.Name == 'TABLA_ILUMINACION':
                grupo = g
                break
        if grupo is None:
            grupo = df.Groups.Create('TABLA_ILUMINACION')
        defn = None
        for d in grupo.Definitions:
            if d.Name == nombre:
                defn = d
                break
        if defn is None:
            opts = ExternalDefinitionCreationOptions(nombre, spec)
            opts.GUID = guid_para(nombre)
            opts.Visible = True
            defn = grupo.Definitions.Create(opts)
        cats = CategorySet()
        cats.Insert(doc.Settings.Categories.get_Item(BuiltInCategory.OST_LightingFixtures))
        binding = app.Create.NewInstanceBinding(cats)
        ok = False
        try:
            ok = doc.ParameterBindings.Insert(defn, binding, GroupTypeId.Data)
        except Exception:
            try:
                ok = doc.ParameterBindings.Insert(defn, binding)
            except Exception:
                ok = False
        if not ok:
            try:
                ok = doc.ParameterBindings.ReInsert(defn, binding)
            except Exception:
                ok = False
        if ok:
            log.append('Se creo el parametro de proyecto "{}" (instancia, Lighting Fixtures) '
                       'para la columna {}.'.format(nombre, etiqueta))
        else:
            log.append('ERROR: no se pudo crear ni vincular el parametro "{}"; la tabla se va '
                       'a quedar sin la columna {}.'.format(nombre, etiqueta))
        return ok
    except Exception as e:
        log.append('ERROR creando el parametro "{}": {}'.format(nombre, e))
        return False
    finally:
        try:
            if anterior is not None:
                app.SharedParametersFilename = anterior
        except Exception:
            pass


def set_string(el, nombre, valor):
    if not nombre:
        return None
    try:
        p = el.LookupParameter(nombre)
    except Exception:
        return None
    if p is None or p.IsReadOnly or p.StorageType != StorageType.String:
        return False
    try:
        if (p.AsString() or '') != valor:
            p.Set(valor)
        return True
    except Exception:
        return False


def get_string(el, nombre):
    try:
        p = el.LookupParameter(nombre)
    except Exception:
        return ''
    if p is None or p.StorageType != StorageType.String:
        return ''
    try:
        return p.AsString() or ''
    except Exception:
        return ''


def marcar_luminarias(laminas):
    # Escribe en cada luminaria el sector donde aparece. Se escribe sobre TODAS las del modelo
    # y no solo sobre las de los sectores procesados: la que ya no aparece en ninguno tiene que
    # quedar con la marca VACIA, o su tabla vieja la seguiria contando.
    donde = {}
    for sh, sector, vistas in laminas:
        for el in luminarias_de_lamina(vistas):
            donde.setdefault(el.Id.Value, set()).add(sector)

    escritas = 0
    sin_codigo = []
    sin_param = set()
    for el in luminarias_del_modelo():
        sectores = sorted(donde.get(el.Id.Value, []))
        marca = ';{};'.format(';'.join(sectores)) if sectores else ''
        if set_string(el, param_lamina, marca) is False:
            sin_param.add(param_lamina)
        if sectores and not get_string(el, param_codigo):
            sin_codigo.append(el.Id.Value)
        escritas += 1
    log.append('Marcadas {} luminaria(s) del modelo: sector en "{}".'.format(
        escritas, param_lamina))
    for nombre in sorted(sin_param):
        log.append('AVISO: el parametro "{}" no existe en las luminarias, o es de solo '
                   'lectura. El filtro de la tabla no va a funcionar.'.format(nombre))
    if sin_codigo:
        # Este es EL aviso que importa en el primer run: sin el codigo, la fila sale con la
        # celda LX vacia y la tabla no sirve para nada. Casi siempre significa que no se corrio
        # 06, o que se corrio con otro nombre de parametro.
        log.append('ERROR: {} luminaria(s) de los sectores procesados no tienen "{}" escrito, '
                   'asi que su fila va a salir sin codigo. Corre 06 antes que este paso. Ids: '
                   '{}.'.format(len(sin_codigo), param_codigo,
                                ', '.join(str(i) for i in sin_codigo[:10])))
    return donde


# ---------------------------- EL SCHEDULE ----------------------------

def campo_por_nombre(schedulable, nombre):
    for f in schedulable:
        try:
            if f.GetName(doc) == nombre:
                return f
        except Exception:
            continue
    return None


def limpiar_definicion(definition):
    # Deja la definicion en blanco para reconfigurarla desde cero, sin importar como haya
    # quedado en una corrida anterior.
    while definition.GetSortGroupFieldCount() > 0:
        definition.RemoveSortGroupField(0)
    while definition.GetFilterCount() > 0:
        definition.RemoveFilter(0)
    for i in range(definition.GetFieldCount() - 1, -1, -1):
        definition.RemoveField(definition.GetField(i).FieldId)


def poner_titulo(sched, titulo):
    # El titulo que se ve sobre la tabla es el nombre del schedule, y el nombre tiene que ser
    # unico en el documento -uno por lamina-. Asi que el nombre queda "TBL_LUM_A1" para el
    # navegador y la celda de encabezado se sobreescribe con el titulo del plano tipo.
    try:
        sd = sched.GetTableData().GetSectionData(SectionType.Header)
        if sd is None or sd.NumberOfRows < 1:
            return False
        sd.SetCellText(0, 0, titulo)
        return True
    except Exception:
        return False


def configurar_schedule(sched, sector, numero_lamina):
    definition = sched.Definition
    limpiar_definicion(definition)
    # UNA FILA POR LUMINARIA. Es el unico parametro que separa esta tabla de la N.1 de 04, que
    # lo tiene apagado para colapsar los rieles del mismo largo en una fila.
    definition.IsItemized = True

    schedulable = definition.GetSchedulableFields()
    faltan = []

    campo_cod = campo_por_nombre(schedulable, param_codigo)
    if campo_cod is None:
        faltan.append(param_codigo)
    campo_alt = campo_por_nombre(schedulable, param_altura)
    if campo_alt is None:
        faltan.append(param_altura)
    campo_lam = campo_por_nombre(schedulable, param_lamina)
    if campo_lam is None:
        faltan.append(param_lamina)
    campo_ord = campo_por_nombre(schedulable, param_orden) if param_orden else None
    if param_orden and campo_ord is None:
        faltan.append(param_orden)
    if faltan:
        return False, faltan

    # LX y ALTURA son las dos columnas que se ven; el orden y el filtro van al final, ocultos
    f_cod = definition.AddField(campo_cod)
    f_cod.ColumnHeading = H_CODIGO
    f_alt = definition.AddField(campo_alt)
    f_alt.ColumnHeading = H_ALTURA

    f_ord = None
    if campo_ord is not None:
        f_ord = definition.AddField(campo_ord)
        try:
            f_ord.IsHidden = True
        except Exception:
            log.append('AVISO {}: no se pudo ocultar la columna "{}"; va a salir impresa en '
                       'la tabla.'.format(numero_lamina, param_orden))

    f_lam = definition.AddField(campo_lam)
    try:
        f_lam.IsHidden = True
    except Exception:
        log.append('AVISO {}: no se pudo ocultar la columna "{}"; va a salir impresa en la '
                   'tabla.'.format(numero_lamina, param_lamina))

    definition.AddFilter(ScheduleFilter(f_lam.FieldId, ScheduleFilterType.Contains,
                                        ';{};'.format(sector)))
    # se ordena por el campo numerico oculto, no por la columna LX que es texto: ver el
    # encabezado
    if f_ord is not None:
        try:
            definition.AddSortGroupField(ScheduleSortGroupField(f_ord.FieldId))
        except Exception:
            log.append('AVISO {}: no se pudo ordenar la tabla por "{}"; las filas salen en el '
                       'orden que quiera Revit.'.format(numero_lamina, param_orden))
    return True, []


def filas_del_cuerpo(sched):
    try:
        sd = sched.GetTableData().GetSectionData(SectionType.Body)
        return sd.NumberOfRows if sd is not None else -1
    except Exception:
        return -1


# ---------------------------- DONDE SE PARA ----------------------------

def rect_util(sheet):
    # area util = bbox de la vineta menos margenes. Identica a la de 02 y 04.
    col = FilteredElementCollector(doc, sheet.Id).OfCategory(BuiltInCategory.OST_TitleBlocks)
    tb = col.FirstElement()
    if tb is not None:
        bb = tb.get_BoundingBox(sheet)
        if bb is not None:
            return (bb.Min.X + margen, bb.Min.Y + margen,
                    bb.Max.X - margen, bb.Max.Y - margen)
    o = sheet.Outline
    return (o.Min.U + margen, o.Min.V + margen, o.Max.U - margen, o.Max.V - margen)


def ocupado_en(sheet, excluir_id):
    # Rectangulos que la tabla no puede pisar: cada viewport con su titulo, las notas de texto,
    # LAS OTRAS TABLAS YA COLOCADAS, la franja inferior de la vineta y el cajetin.
    #
    # Las otras tablas son la diferencia con 04, que no las miraba porque era la unica tabla
    # del plano. Se excluye la propia -excluir_id- porque este paso la coloca primero para
    # poder medirla y recien despues la manda al hueco: sin la exclusion se bloquearia a si
    # misma y siempre terminaria en la esquina de ultimo recurso.
    rects = []
    for n in (FilteredElementCollector(doc, sheet.Id)
              .OfCategory(BuiltInCategory.OST_TextNotes)
              .WhereElementIsNotElementType()):
        try:
            bb = n.get_BoundingBox(sheet)
        except Exception:
            continue
        if bb is not None:
            rects.append((bb.Min.X, bb.Min.Y, bb.Max.X, bb.Max.Y))
    for vp in FilteredElementCollector(doc, sheet.Id).OfClass(Viewport):
        for getter in ('GetBoxOutline', 'GetLabelOutline'):
            try:
                o = getattr(vp, getter)()
            except Exception:
                continue
            if o is not None:
                rects.append((o.MinimumPoint.X, o.MinimumPoint.Y,
                              o.MaximumPoint.X, o.MaximumPoint.Y))
    for ssi in FilteredElementCollector(doc, sheet.Id).OfClass(ScheduleSheetInstance):
        if excluir_id is not None and ssi.Id.Value == excluir_id.Value:
            continue
        try:
            bb = ssi.get_BoundingBox(sheet)
        except Exception:
            continue
        if bb is not None:
            rects.append((bb.Min.X, bb.Min.Y, bb.Max.X, bb.Max.Y))
    x0, y0, x1, y1 = rect_util(sheet)
    if franja_inferior > 0:
        rects.append((x0 - margen, y0 - margen, x1 + margen, y0 + franja_inferior))
    if cajetin_ancho > 0 and cajetin_alto > 0:
        rects.append((x1 - cajetin_ancho, y0 - margen, x1 + margen, y0 + cajetin_alto))
    return rects


def se_pisan(a, b, holgura):
    return not (a[2] + holgura <= b[0] or b[2] + holgura <= a[0] or
                a[3] + holgura <= b[1] or b[3] + holgura <= a[1])


def buscar_hueco(sheet, ancho, alto, excluir_id):
    # Barrido en grilla sobre el area util: la primera posicion -de las que no pisan nada- que
    # quede mas cerca de la esquina pedida. Fuerza bruta a proposito: son unos miles de
    # posiciones por lamina y evita toda la maquinaria de "mayor rectangulo vacio".
    x0, y0, x1, y1 = rect_util(sheet)
    if ancho > x1 - x0 or alto > y1 - y0:
        return None
    ocupados = ocupado_en(sheet, excluir_id)
    derecha = 'derecha' in esquina
    arriba = 'arriba' in esquina
    ref_x = x1 - ancho if derecha else x0
    ref_y = y1 - alto if arriba else y0

    mejor = None
    mejor_d = None
    n = int((x1 - x0 - ancho) / PASO_BUSQUEDA) + 1
    m = int((y1 - y0 - alto) / PASO_BUSQUEDA) + 1
    for i in range(max(n, 1)):
        for j in range(max(m, 1)):
            px = x0 + i * PASO_BUSQUEDA
            py = y0 + j * PASO_BUSQUEDA
            if px + ancho > x1 or py + alto > y1:
                continue
            cand = (px, py, px + ancho, py + alto)
            choca = False
            for r in ocupados:
                if se_pisan(cand, r, margen):
                    choca = True
                    break
            if choca:
                continue
            d = math.hypot(px - ref_x, py - ref_y)
            if mejor_d is None or d < mejor_d:
                mejor_d = d
                mejor = cand
    return mejor


def esquina_de_ultimo_recurso(sheet, ancho, alto):
    x0, y0, x1, y1 = rect_util(sheet)
    px = (x1 - ancho) if 'derecha' in esquina else x0
    py = (y1 - alto) if 'arriba' in esquina else y0
    return (px, py, px + ancho, py + alto)


def colocar(sheet, sched, numero_lamina):
    # Se coloca primero -en cualquier lado-, se le mide el bounding box real y recien despues
    # se la manda al hueco. El alto de un schedule depende del tipo de letra y de cuantas filas
    # quedaron: estimarlo es adivinar, y errarle por dos milimetros la deja pisando una vista.
    # Con itemize encendido son tantas filas como luminarias, asi que esta tabla puede ser
    # bastante mas alta que la de 04.
    x0, y0, x1, y1 = rect_util(sheet)
    try:
        ssi = ScheduleSheetInstance.Create(doc, sheet.Id, sched.Id, XYZ(x0, y1, 0.0))
    except Exception as e:
        log.append('ERROR {}: Revit no permitio colocar la tabla ({}).'.format(numero_lamina, e))
        return None
    doc.Regenerate()
    bb = ssi.get_BoundingBox(sheet)
    if bb is None:
        log.append('AVISO {}: no se pudo medir la tabla; queda en la esquina superior '
                   'izquierda.'.format(numero_lamina))
        return ssi
    ancho = bb.Max.X - bb.Min.X
    alto = bb.Max.Y - bb.Min.Y

    destino = buscar_hueco(sheet, ancho, alto, ssi.Id)
    if destino is None:
        destino = esquina_de_ultimo_recurso(sheet, ancho, alto)
        log.append('AVISO {}: no hay hueco libre de {:.0f}x{:.0f} mm en la lamina; la tabla se '
                   'coloca en la esquina {} y puede quedar montada sobre una vista o sobre la '
                   'TABLA N.1.'.format(numero_lamina, ancho * 304.8, alto * 304.8, esquina))
    # el punto de insercion es la esquina SUPERIOR izquierda del schedule
    delta_x = destino[0] - bb.Min.X
    delta_y = destino[3] - bb.Max.Y
    try:
        ssi.Point = XYZ(ssi.Point.X + delta_x, ssi.Point.Y + delta_y, 0.0)
    except Exception as e:
        log.append('AVISO {}: no se pudo mover la tabla al hueco ({}).'.format(numero_lamina, e))
    return ssi


# ---------------------------- EJECUCION ----------------------------

laminas = laminas_de_sector()
if not laminas:
    log.append('No hay laminas con vistas de sector que coincidan con el filtro. Se esperan '
               'laminas con vistas "<sector>{}" o "<sector>{}X", creadas por 01 y 02.'.format(
                   SUF_PLANTA, SUF_ELEV))
elif not luminarias_del_modelo():
    log.append('No hay luminarias en el modelo (categoria Lighting Fixtures{}); no hay tabla '
               'que armar.'.format(
                   ', familia que contiene "{}"'.format(fam_contiene) if fam_contiene else ''))
else:
    TransactionManager.Instance.EnsureInTransaction(doc)

    asegurar_param(param_altura, SpecTypeId.String.Text, H_ALTURA)
    # Regenerar entre crear el parametro y escribirlo NO es opcional: un parametro de proyecto
    # recien vinculado no aparece en los elementos hasta que el documento regenera, asi que
    # LookupParameter devuelve None. El sintoma es que a la SEGUNDA corrida funciona.
    doc.Regenerate()
    marcar_luminarias(laminas)

    por_sector = {}
    for sh, sector, vistas in laminas:
        acum = por_sector.setdefault(sector, set())
        for el in luminarias_de_lamina(vistas):
            acum.add(el.Id.Value)

    schedules = {}
    for v in FilteredElementCollector(doc).OfClass(ViewSchedule):
        schedules[elem_name(v)] = v
    instancias = {}
    for ssi in FilteredElementCollector(doc).OfClass(ScheduleSheetInstance):
        instancias.setdefault(ssi.ScheduleId.Value, []).append(ssi)

    puestas = 0
    for sh, sector, vistas in laminas:
        numero = sh.SheetNumber
        nombre_sched = PREFIJO_SCHEDULE + numero
        cuantas = len(por_sector.get(sector, ()))
        if not cuantas:
            log.append('{} ({}): no se ve ninguna luminaria en las vistas del sector; no se '
                       'pone tabla.'.format(numero, sector))
            continue

        sched = schedules.get(nombre_sched)
        if sched is not None and not rehacer:
            log.append('{} ({}): ya tiene tabla, se salta. Corre con rehacer para '
                       'reconfigurarla.'.format(numero, sector))
            continue
        if sched is None:
            sched = ViewSchedule.CreateSchedule(
                doc, ElementId(BuiltInCategory.OST_LightingFixtures))
            try:
                sched.Name = nombre_sched
            except Exception as e:
                log.append('AVISO {}: no se pudo nombrar la tabla "{}" ({}); queda con el '
                           'nombre que le puso Revit.'.format(numero, nombre_sched, e))
            schedules[nombre_sched] = sched

        ok, faltan = configurar_schedule(sched, sector, numero)
        if not ok:
            log.append('ERROR {}: las luminarias no tienen estos parametros como campo de '
                       'schedule: {}. Sin ellos la tabla no se puede armar; los crean 06 y '
                       'este mismo paso, asi que revisa que 06 haya corrido.'.format(
                           numero, ', '.join(faltan)))
            continue
        doc.Regenerate()
        if not poner_titulo(sched, titulo_tabla):
            log.append('AVISO {}: no se pudo escribir el titulo "{}" en la tabla; queda el '
                       'nombre del schedule.'.format(numero, titulo_tabla))

        # el cuerpo trae una fila de encabezado de columnas y una en blanco ademas de los
        # datos, asi que se tolera +2. Aca lo que se comprueba es lo CONTRARIO que en 04: que
        # NO haya colapsado. Si salen menos filas que luminarias, itemize no quedo encendido y
        # dos luminarias a la misma altura se estan imprimiendo como una sola.
        filas = filas_del_cuerpo(sched)
        if 0 <= filas < cuantas:
            log.append('AVISO {}: la tabla quedo con {} fila(s) y en el sector hay {} '
                       'luminaria(s). Si son menos, Revit esta colapsando filas iguales: la '
                       'tabla tiene que ir con "Itemize every instance" ENCENDIDO, al reves '
                       'que la TABLA N.1.'.format(numero, filas, cuantas))

        for vieja in instancias.get(sched.Id.Value, []):
            try:
                doc.Delete(vieja.Id)
            except Exception:
                pass
        if colocar(sh, sched, numero) is not None:
            puestas += 1
            log.append('OK {} ({}): tabla con {} luminaria(s).'.format(numero, sector, cuantas))

    log.insert(0, '{} tabla(s) de luminarias en {} lamina(s) de sector.'.format(
        puestas, len(laminas)))
    log.append('Recorda que la columna "{}" va vacia a proposito: todavia no esta decidido de '
               'donde sale la altura de montaje. Ver el encabezado del graph.'.format(H_ALTURA))

    TransactionManager.Instance.ForceCloseTransaction()

OUT = log
# ----------------------------------------
log = Watch(python_script)  # graph output
